# Grasshopper definition 02_Restaurant_.gh (Grasshopper 1.0.8)
# plug-ins: BSim_001a

id = Guid([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])
geo = Geometry([<point referenced from the Rhino model> x822])
pt = Point([<point referenced from the Rhino model> x3684])
pt_2 = Point(geo)
merge = Merge(Data1=pt_2, Data2=pt)
c_script = CSharpScript(Expel=pt_2, Tol=Slider(0.01, range=0..1))  # -> out, A, B; inputs PtCloud: list of Point3d, Expel: list of Point3d, Tol: Double
# ---------- c_script: C# usings ----------
using System.Linq;
# ---------- c_script: C# ----------
    double tol = Tol;
    List<int> index = new List<int>();
    List<Point3d> exp = new List<Point3d>();
    for(int i = 0;i < PtCloud.Count;i++)
    {
      foreach(Point3d pt in Expel)
      {
        if(pt.DistanceTo(PtCloud[i]) < tol)
        {
          index.Add(i);
          exp.Add(pt);
        }
      }
    }

    A = PtCloud.Where((p,i) => !index.Contains(i));
    B = exp;
# ---------- end c_script ----------
pt_3 = Point(merge)
check_tooclosenodes = CSharpScript(NodeCloud=pt_3, Check_Tol=Slider(0.5, range=0..1))  # -> out, Ns, NsId, ErrorPts, Cycles; inputs NodeCloud: list of Point3d, Check_Tol: Double
# ---------- check_tooclosenodes: C# ----------
    double ToClosePts_Tol = Check_Tol > 0.0 ? Check_Tol : 1;

    //00 cleanup the duplicate nodes;
    RTree rtree = new RTree();
    for(int i = 0;i < NodeCloud.Count;i++){rtree.Insert(NodeCloud[i], i);}

    List<Point3d> nodes = new List<Point3d>();
    List<int> nodes_ori_ids = new List<int>();

    List<int> DupliIndex = new List<int>();

    for(int i = 0;i < NodeCloud.Count;i++)
    {
      if(DupliIndex.Contains(i)){continue;}

      Sphere SearchSp = new Sphere(NodeCloud[i], Check_Tol);
      List<int> match = new List<int>();
      rtree.Search(SearchSp, (sender, args) => {match.Add(args.Id);});

      if(match.Count > 1){DupliIndex.AddRange(match);}

      nodes.Add(NodeCloud[i]);
      nodes_ori_ids.Add(i);
    }



    Ns = nodes;
    NsId = nodes_ori_ids;

    ErrorPts = DupliIndex.Select(i => NodeCloud[i]);
    Cycles = DupliIndex.Select(i => NodeCloud[i]).Select(p => new Circle(p, Check_Tol));
# ---------- check_tooclosenodes: C# additional code ----------
  public static int? RT_ClosetPt(List<Point3d> ptCloud, RTree T, Point3d pt, double R)
  {
    Sphere SearchSp = new Sphere(pt, R);
    if (T != null)
    {
      List<int> candidates = new List<int>();
      T.Search(SearchSp, (sender, args) => { candidates.Add(args.Id); });
      if (candidates.Count > 0)
      {
        candidates.Sort((a, b) => ptCloud[a].DistanceTo(pt).CompareTo(ptCloud[b].DistanceTo(pt)));
        return candidates[0];
      }
      else { return null; }
    }
    else { return null; }
  }
# ---------- end check_tooclosenodes ----------
crv = Curve([<curve referenced from the Rhino model> x4604])
check_nodeedge_clouds = CSharpScript(NodeCloud=check_tooclosenodes.Ns, EdgeCloud=crv, tol=Slider(0.0001, range=0..1))  # -> out, Matched_Es, Matched_Ns, Error_E, Error_N; inputs NodeCloud: list of Point3d, EdgeCloud: list of Line, tol: Double
# ---------- check_nodeedge_clouds: C# ----------
    List<Point3d> nodes = NodeCloud;

    //01 match edge;
    double fixtol = tol;
    RTree rtree = new RTree();
    for(int i = 0;i < nodes.Count;i++){rtree.Insert(nodes[i], i);}
    List<List<int>> nodenodeAdj = nodes.Select(p => new List<int>()).ToList();
    List<Line> edges = new List<Line>();
    List<Line> edge_error = new List<Line>();

    for(int i = 0;i < EdgeCloud.Count;i++)
    {
      Point3d P0 = EdgeCloud[i].From;
      Point3d P1 = EdgeCloud[i].To;

      Sphere SearchSp0 = new Sphere(P0, fixtol);
      Sphere SearchSp1 = new Sphere(P1, fixtol);

      List<int> match0 = new List<int>();
      List<int> match1 = new List<int>();

      rtree.Search(SearchSp0, (sender, args) => { match0.Add(args.Id); });
      rtree.Search(SearchSp1, (sender, args) => { match1.Add(args.Id); });

      if(match0.Count > 0 && match1.Count > 0 && match0.Count == 1 && match1.Count == 1)
      {
        int ind0 = match0[0];
        int ind1 = match1[0];

        if(ind0 > ind1)
        {
          if(!nodenodeAdj[ind1].Contains(ind0))
          {nodenodeAdj[ind1].Add(ind0);}
        }
        else
        {
          if(!nodenodeAdj[ind0].Contains(ind1))
          {nodenodeAdj[ind0].Add(ind1);}
        }
      }
      else
      {
        edge_error.Add(EdgeCloud[i]);
      }

    }

    List<int> collection = new List<int>();

    for(int i = 0;i < nodenodeAdj.Count;i++)
    {
      if(nodenodeAdj[i].Count > 0 && !collection.Contains(i)){collection.Add(i);}
      foreach(int j in nodenodeAdj[i])
      {
        edges.Add(new Line(nodes[i], nodes[j]));
        if(!collection.Contains(j)){collection.Add(j);}
      }
    }

    //Detect Split
    double checkTol = 0.5;

    List<Point3d> errorNodes = new List<Point3d>();
    foreach(Point3d pt in nodes)
    {
      foreach(Line edge in edges)
      {
        if(edge.MinimumDistanceTo(pt) < checkTol)
        {
          if(pt.DistanceTo(edge.From) < checkTol || pt.DistanceTo(edge.To) < checkTol)
          {continue;}

          errorNodes.Add(pt);
        }
      }

    }

    Matched_Es = edges;
    Matched_Ns = collection.Select(p => nodes[p]);
    Error_E = edge_error;
    Error_N = errorNodes;
# ---------- check_nodeedge_clouds: C# additional code ----------
  public static int? RT_ClosetPt(List<Point3d> ptCloud, RTree T, Point3d pt, double R)
  {
    Sphere SearchSp = new Sphere(pt, R);
    if (T != null)
    {
      List<int> candidates = new List<int>();
      T.Search(SearchSp, (sender, args) => { candidates.Add(args.Id); });
      if (candidates.Count > 0)
      {
        candidates.Sort((a, b) => ptCloud[a].DistanceTo(pt).CompareTo(ptCloud[b].DistanceTo(pt)));
        return candidates[0];
      }
      else { return null; }
    }
    else { return null; }
  }
# ---------- end check_nodeedge_clouds ----------

# ----
# Get Tableware
rec = Rectangle({Plane=PlaneXY(127.7154414, 19.42912857, 0), Size=Domain2(u=-2.961830128..2.961830128, v=-3.036576629..3.036576629)})
enterexist_ids = Text(["T1", "T2"])
pt_4 = Point([Point(127.3969044, 19.35314071, 0), Point(127.3969044, 11.25314071, 0)])
rec_2 = Rectangle({Plane=PlaneXY(127.9677108, 10.95474395, 0), Size=Domain2(u=-2.915113564..2.915113564, v=-3.027233317..3.027233317)})
占位生成器 = CSharpScript(ori_pt=pt_4, Iter=Slider(25, range=0..1000))  # -> out, A; inputs ori_pt: list of Point3d, Iter: Int32
# ---------- 占位生成器: C# ----------
    DataTree<Point3d> tree_pts = new DataTree<Point3d>();
    for(int i = 0;i < ori_pt.Count;i++)
    {
      tree_pts.AddRange(RotatePt(ori_pt[i], Iter, 0.3), new GH_Path(i));
    }
    A = tree_pts;
# ---------- 占位生成器: C# additional code ----------
  private List<Point3d> RotatePt(Point3d o, int iter, double R)
  {
    List<Point3d> list = new List<Point3d>();
    int lay = 1;
    int sum = 0;
    int count = lay * 6;

    for(int i = 0;i < iter;i++)
    {
      double a = Math.PI / (count * 0.5);
      double r = 2 * R * lay;

      double b = a * (i - sum);
      list.Add(new Point3d(o.X + Math.Sin(b) * r, o.Y + Math.Cos(b) * r, o.Z));

      if(i == sum + count - 1)
      {
        lay++;
        sum += count;
        count = lay * 6;
      }
    }

    return list;
  }
# ---------- end 占位生成器 ----------
rec_3 = Rectangle([rec, rec_2])
ievent_m_vs_as_st = IEvent_M_vS_aS_St(ID=enterexist_ids, Class="GetTableware", Pt=pt_4, Ps=占位生成器.A, Time="20", ADist=Slider(0.6, range=0..1), RT=rec_3, Po=0)

# ----
# Pick Seat
pt_5 = Point([Point(107.3440476, 0.4610269754, 0), Point(108.1139192, 0.4610269754, 0), Point(109.4440476, 0.4610269754, 0), Point(110.2139192, 0.4610269754, 0), Point(111.5440476, 0.4610269754, 0), Point(112.3139192, 0.4610269754, 0)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])
lng = ListLength(List=pt_5)
series = Series(Start=0, Step=1, Count=lng)
concat = Concatenate(FragmentA="seat", FragmentB=series)
ievent_s_vs_as_st = IEvent_S_vS_aS_St(ID=concat, Class="GoToSeat", Pt=pt_5, Time="900", ADist=Slider(0.2, range=0..1), Ra=3, Po=1)

# ----
# Exist
number_slider = Slider(0.3, range=0..1)
enterexist_ids_2 = Text(["exist03", "exist02", "exist01"])
enterexist_locations = Point([Point(107.0720905, 25.57859423, 0), Point(107.0719065, 9.303221974, 0), Point(121.5659451, -0.7720424544, 0)])
ievent_exit = IEvent_Exit(ID=enterexist_ids_2, Pt=enterexist_locations, ADist=number_slider)

# ----
# WashHand Pool
pt_6 = Point(Point(119.4154032, 23.02094816, 0))
pt_7 = Point([Point(116.8626859, 22.47244266, 0), Point(117.3626859, 22.47244266, 0), Point(117.8626859, 22.47244266, 0), Point(118.3626859, 22.47244266, 0), Point(118.8626859, 22.47244266, 0), Point(119.3626859, 22.47244266, 0)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])
rec_4 = Rectangle({Plane=PlaneXY(119.1341704, 23.21497593, 0), Size=Domain2(u=-5.312998809..5.312998809, v=-2.313885463..2.313885463)})
enterexist_ids_3 = Text("W0")
ievent_m_vs_as_st_2 = IEvent_M_vS_aS_St(ID=enterexist_ids_3, Class="WashHand", Pt=pt_6, Ps=pt_7, Time="20", ADist=Slider(0.6, range=0..1), RT=rec_4, Po=0)

# ----
# Get Food
enterexist_ids_4 = Text(["line04", "line03", "line02", "line01"])
pt_8 = Point([Point(131.2096718, 19.92431691, 0), Point(131.2096718, 18.19476078, 0), Point(131.2096718, 16.52444524, 0), Point(131.2096718, 14.62399726, 0)])
rec_5 = Rectangle({Plane=PlaneXY(126.9364823, 17.51073929, 0), Size=Domain2(u=-5.467568176..5.467568176, v=-3.806534806..3.806534806)})
列队占位生成器 = CSharpScript(ori_pt=pt_8, Iter=Slider(20, range=0..1000))  # -> out, A; inputs ori_pt: list of Point3d, Iter: Int32
# ---------- 列队占位生成器: C# ----------
    DataTree<Point3d> tree_pts = new DataTree<Point3d>();
    for(int i = 0;i < ori_pt.Count;i++)
    {
      tree_pts.AddRange(QueuePt(ori_pt[i], Iter, 0.8), new GH_Path(i));
    }
    A = tree_pts;
# ---------- 列队占位生成器: C# additional code ----------
  private List<Point3d> QueuePt(Point3d o, int iter, double D)
  {
    List<Point3d> list = new List<Point3d>();

    for(int i = 0;i < iter;i++)
    {
      list.Add(new Point3d(o.X - i * D, o.Y, o.Z));
    }
    return list;
  }

  private List<Point3d> RotatePt(Point3d o, int iter, double R)
  {
    List<Point3d> list = new List<Point3d>();
    int lay = 1;
    int sum = 0;
    int count = lay * 6;

    for(int i = 0;i < iter;i++)
    {
      double a = Math.PI / (count * 0.5);
      double r = 2 * R * lay;

      double b = a * (i - sum);
      list.Add(new Point3d(o.X + Math.Sin(b) * r, o.Y + Math.Cos(b) * r, o.Z));

      if(i == sum + count - 1)
      {
        lay++;
        sum += count;
        count = lay * 6;
      }
    }

    return list;
  }
# ---------- end 列队占位生成器 ----------
ievent_m_vs_as_st_q = IEvent_M_vS_aS_St_Q(ID=enterexist_ids_4, Class="GetFood", Pt=pt_8, Ps=列队占位生成器.A, Time="100", ADist=Slider(0.2, range=0..1), RT=rec_5, Po=2)

# ----
# Get Soup
pt_9 = Point(Point(131.2096718, 6.733739124, 0))
enterexist_ids_5 = Text("getsoup")
rec_6 = Rectangle({Plane=PlaneXY(123.9438747, 6.927693831, 0), Size=Domain2(u=-8.449346653..8.449346653, v=-1.128688124..1.128688124)})
列队占位生成器_2 = CSharpScript(ori_pt=pt_9, Iter=Slider(10, range=0..1000))  # -> out, A; inputs ori_pt: list of Point3d, Iter: Int32; same code as 列队占位生成器
ievent_m_vs_as_st_q_2 = IEvent_M_vS_aS_St_Q(ID=enterexist_ids_5, Class="GetSoup", Pt=pt_9, Ps=列队占位生成器_2.A, Time="10", ADist=Slider(0.6, range=0..1), RT=rec_6, Po=2)

geo_2 = Geometry([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])

gm = Curve([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])
displaycurves = DisPlayCurves(cvs=flatten(gm), cols=flatten(ColourSwatch(SwatchColor=RGB(128, 128, 128))), thick=flatten(Slider(1, range=0..10)))
preprspace = PreprSpace(Net=gm, Div=1)

events = Merge(
    Data1=flatten(ievent_exit),
    Data2=flatten(ievent_m_vs_as_st_q),
    Data3=flatten(ievent_m_vs_as_st_q_2),
    Data4=flatten(ievent_m_vs_as_st_2),
    Data5=flatten(ievent_m_vs_as_st),
    Data6=flatten(ievent_s_vs_as_st))
interact_avoid = Interact_Avoid(AffectCoeff=1.1, StR=2)

crv_2 = Curve(check_nodeedge_clouds.Matched_Es)
crv_3 = Curve([<curve referenced from the Rhino model> x2120])
crv_4 = Curve(crv_3)
pathnettest = CSharpScript(
    Run=Button(),
    PathNet=crv_3,
    Reference=["C:\Program Files\Rhino 7\Plug-ins\Grasshopper\Components\KangarooSolver.dll", "C:\USERS\SYCAR\ONEDRIVE\NET_LIBRARY\BSim.dll"])  # -> out, Ns, St_N, Rc_N, Er_N; inputs Run: Boolean, PathNet: list of Line
# ---------- pathnettest: C# usings ----------
using System.Linq;
using BSim;
using System.Diagnostics;
using System.IO;
using Path=BSim.PathNet;
using System.Windows.Forms;
# ---------- pathnettest: C# ----------
    if(Run)
    {
      Path.ShortPathGraph Graph = Path.PathNetWork(PathNet, tol, out Nodes);
      report = "";
      Record_path = new List<List<List<int>>>();

      //Load the Environment;
      W = new MiniWatch();

      List<int> reach_indices = new List<int>();
      List<int> error_indices = new List<int>();

      for(int i = 0;i < 1;i++)//Nodes.Count[Change this para to see the consistensy of the entire system]
      {
        bool ifFail = false;
        List<List<int>> Node_i_matrix = Graph.Dijkstra_Record(i);

        reach_indices = new List<int>();
        error_indices = new List<int>();
        for(int j = 0;j < Nodes.Count;j++)
        {
          if(i != j && Node_i_matrix[j].Count < 2)
          {
            error_indices.Add(j);
            ifFail = true;
          }
          else
          {
            reach_indices.Add(j);
          }

        }

        if(ifFail)
        {
          rcPoints = reach_indices.Select(p => Nodes[p]).ToList();
          erPoints = error_indices.Select(p => Nodes[p]).ToList();
          stPoint = Nodes[i];
          report += "\nFail\n";
          break;
        }

        stPoint = Point3d.Origin;
        rcPoints = Nodes;
        if(erPoints != null)erPoints.Clear();
        Record_path.Add(Graph.Dijkstra_Record(i));
        W.Record("SubIter_" + i.ToString());
      }

      W.Record("Dijkstra");

      report = W.GetTime();
    }
    Component.Message = report;
    Ns = Nodes;
    St_N = stPoint;
    Rc_N = rcPoints;
    Er_N = erPoints;
# ---------- pathnettest: C# additional code ----------
  double tol = 0.0001;
  MiniWatch W;
  List<List<List<int>>> Record_path;
  List<Point3d> Nodes;
  Point3d stPoint;
  List<Point3d>rcPoints;
  List<Point3d>erPoints;

  string report = "";

  private void ExportToCSV(string path, List<List<List<int>>> data)
  {
    using (StreamWriter writer = new StreamWriter(path))
    {
      foreach (List<List<int>> sublist in data)
      {
        var row = string.Join(";", sublist.Select(innerList => string.Join(",", innerList)));
        writer.WriteLine(row);
      }
    }
  }

  private List<List<List<int>>> ImportFromCSV(string path)
  {
    List<List<List<int>>> data = new List<List<List<int>>>();

    using (StreamReader reader = new StreamReader(path))
    {
      while (!reader.EndOfStream)
      {
        string line = reader.ReadLine();
        var sublist = line.Split(';')
          .Select(segment => segment.Split(',')
          .Select(int.Parse)
          .ToList())
          .ToList();

        data.Add(sublist);
      }
    }

    return data;
  }
# ---------- end pathnettest ----------
looking_for_3degree_nodes = CSharpScript(NodeCloud=pathnettest.Ns, EdgeCloud=crv_4, tol=Slider(0.0001, range=0..1))  # -> out, Matched_Es, Matched_Ns, Error_E, Error_N; inputs NodeCloud: list of Point3d, EdgeCloud: list of Line, tol: Double
# ---------- looking_for_3degree_nodes: C# ----------
    List<Point3d> nodes = NodeCloud;

    //01 match edge;
    double fixtol = tol;
    RTree rtree = new RTree();
    for(int i = 0;i < nodes.Count;i++){rtree.Insert(nodes[i], i);}
    List<List<int>> nodenodeAdj = nodes.Select(p => new List<int>()).ToList();


    for(int i = 0;i < EdgeCloud.Count;i++)
    {
      int n = nodes.Count-1;
      Point3d P0 = EdgeCloud[i].From;
      Point3d P1 = EdgeCloud[i].To;
      
      rtree.Insert(P0, i*2+n);
      rtree.Insert(P1, i*2+n+1);
    }
    
    List <Point3d> nodes3d = new List<Point3d>();
    foreach(Point3d p in nodes)
    {
      Sphere SearchSp0 = new Sphere(p, fixtol);
      List<int> match0 = new List<int>();
      rtree.Search(SearchSp0, (sender, args) => { match0.Add(args.Id); });
      
      if(match0.Count > 3)
      {
        nodes3d.Add(p);
      }
    }

    Matched_Ns = nodes3d;
# ---------- looking_for_3degree_nodes: C# additional code ----------
  public static int? RT_ClosetPt(List<Point3d> ptCloud, RTree T, Point3d pt, double R)
  {
    Sphere SearchSp = new Sphere(pt, R);
    if (T != null)
    {
      List<int> candidates = new List<int>();
      T.Search(SearchSp, (sender, args) => { candidates.Add(args.Id); });
      if (candidates.Count > 0)
      {
        candidates.Sort((a, b) => ptCloud[a].DistanceTo(pt).CompareTo(ptCloud[b].DistanceTo(pt)));
        return candidates[0];
      }
      else { return null; }
    }
    else { return null; }
  }
# ---------- end looking_for_3degree_nodes ----------
pt_10 = Point(pathnettest.Er_N)
dots = DotDisplay(Point=pathnettest.Rc_N, Colour=ColourSwatch(SwatchColor=RGB(84, 142, 61)), Size=1)
dots_2 = DotDisplay(Point=pathnettest.Er_N, Colour=ColourSwatch(SwatchColor=RGB(230, 22, 61)), Size=0.8)
dots_3 = DotDisplay(Point=pathnettest.St_N, Colour=RGB(0, 0, 0), Size=1.4)
pt_11 = Point(looking_for_3degree_nodes.Matched_Ns)

crv_5 = Curve([<curve referenced from the Rhino model> x1958])
explode = Explode(Curve=crv_5, Recursive=True)  # -> Segments, Vertices
polyline_optimize = CSharpScript(Pts=explode.Vertices, t=Slider(0.9, range=0..2))  # -> out, Angs, SPts; inputs Pts: list of Point3d, t: Double
# ---------- polyline_optimize: C# ----------
    if(Pts.Count == 0){return;}
    if(t <= 0.0){t = 0.8;}
    List<Vector3d> vecs = new List<Vector3d>(Pts.Count - 1);

    for(int i = 0;i < Pts.Count - 1;i++)
    {
      vecs.Add(new Vector3d(Pts[i + 1] - Pts[i]));
    }

    List<double> angles = new List<double>(vecs.Count - 1);
    for(int i = 0;i < vecs.Count - 1;i++)
    {
      Vector3d vec0 = vecs[i];vec0.Unitize();
      Vector3d vec1 = vecs[i + 1];vec1.Unitize();
      double angle = vec0 * vec1;
      angles.Add(angle);
    }

    List < Point3d > keyPts = new List<Point3d>(){Pts[0]};
    for(int i = 0;i < angles.Count;i++)
    {
      if(angles[i] < t){keyPts.Add(Pts[i + 1]);}
    }
    keyPts.Add(Pts[Pts.Count - 1]);
    Angs = angles;
    SPts = keyPts;
# ---------- end polyline_optimize ----------
pline = PolyLine(Vertices=polyline_optimize.SPts, Closed=False)
panel = Panel(polyline_optimize.Angs)
explode_2 = Explode(Curve=pline, Recursive=True)  # -> flatten(Segments), Vertices
line = Line(explode_2.Segments)

# ----
# Agents
pt_12 = Point(Point(107.0720905, 25.57859423, 0))
agent_count = Slider(60, range=0..100)
series_2 = Series(Start=0, Step=1, Count=agent_count)
panel_2 = Panel("""GetFood
GetSoup
GetTableware
GoToSeat
WashHand""")
int = Integer(agent_count)
concat_2 = Concatenate(FragmentA="Person_", FragmentB=series_2)
repeat_by_tree = CSharpScript(
    T=panel_2,
    Count=int,
    Reference=["C:\USERS\SYCAR\ONEDRIVE\NET_LIBRARY\BSim.dll", "C:\Users\sycar\OneDrive\NET_Library\BSim.dll"])  # -> Tree; inputs T: list, Count: Int32
# ---------- repeat_by_tree: C# usings ----------
using BSim;

using System.Windows.Forms;

using System.Linq;

//using KangarooSolver;
# ---------- repeat_by_tree: C# ----------
    DataTree<Object> tree = new DataTree<Object>();

    for(int i = 0;i < Count;i++)
    {
      tree.AddRange(T, new GH_Path(i));
    }
    Tree = tree;
# ---------- end repeat_by_tree ----------
multiplication = Multiplication(A=series_2, B=Slider(20, range=0..100))
agent_meta = Agent_Meta(BirthIter=multiplication)
agent_view = Agent_View(VDist=20, VAngl=1.2)
agent_attr = Agent_Attr(
    ID=concat_2,
    Pt=pt_12,
    StR=2,
    R=0.3,
    Tol=1,
    Spd=0.01,
    Col=ColourSwatch(SwatchColor=RGB(232, 0, 149)),
    GeoP=["\poss\g_walk.3dm", "\poss\g_seat.3dm", "\poss\g_talk.3dm"])

agent_bhav = Agent_Bhav(ToDoList=repeat_by_tree)  # -> flatten(Bhav)

agent = Agent(Attr=agent_attr, Bhav=agent_bhav, Meta=agent_meta, View=agent_view)

abm = ABM(S=preprspace, A=agent, E=events, I=interact_avoid)
simulator = Simulator(ABM=abm)  # -> ABM, Log
displ_agents = Displ_Agents(ABM=simulator.ABM)

# ==== cluster DisPlayCurves
cvs = ClusterInput()
thick = ClusterInput()
cols = ClusterInput()
c_script = CSharpScript(cvs=cvs, cols=cols, thick=thick)  # inputs cvs: list of Curve, cols: list of Color, thick: list of Double
# ---------- c_script: C# usings ----------
using System.IO;
using System.Linq;
using System.Data;
using System.Drawing;
using System.Reflection;
using System.Windows.Forms;
using System.Xml;

using System.Runtime.InteropServices;

using Rhino.DocObjects;
using Rhino.Collections;
using GH_IO;
using GH_IO.Serialization;
# ---------- c_script: C# ----------
    dis_cvs.Clear();
    dis_cols.Clear();
    dis_th.Clear();
    List<int> valid = Enumerable.Range(0, cvs.Count).Where(i => cvs[i].IsValid).ToList();

    if(cvs == null){return;}
    dis_cvs = valid.Select(i => cvs[i]).ToList();
    if(cols.Count == 1){      dis_cols = valid.Select(p => cols[0]).ToList();}
    else if(cols.Count == 0){      dis_cols = valid.Select(p => Color.Black).ToList();}
    else{dis_cols = valid.Select(i => cols[i]).ToList();}

    if(thick.Count == 1) {dis_th = valid.Select(p => thick[0]).ToList();}
    else if(thick.Count == 0){dis_th = valid.Select(p => 1.0).ToList();}
    else{dis_th = valid.Select(i => thick[i]).ToList();}
# ---------- c_script: C# additional code ----------
  private List<Curve> dis_cvs = new List<Curve>();
  private List<Color> dis_cols = new List<Color>();
  private List<double> dis_th = new List<double>();

  public override void BeforeRunScript()
  {
    dis_cvs.Clear();
    dis_cols.Clear();
    dis_th.Clear();
  }

  public override BoundingBox ClippingBox
  {
    get
    {
      return BoundingBox.Empty;
    }
  }

  public override void DrawViewportWires(IGH_PreviewArgs args)
  {
    Plane pl0_Plane;
    args.Viewport.GetFrustumFarPlane(out pl0_Plane);

    Rhino.Display.Text3d drawText = null;  // Initialize to null

    for (int i = 0; i < dis_cvs.Count; i++)
    {
      Curve cv = dis_cvs[i];
      Color col = dis_cols[i];
      double th = dis_th[i];

      pl0_Plane.Origin = cv.PointAt(0.5 * cv.Domain.Length);

      args.Display.DrawCurve(cv, col, System.Convert.ToInt32(th));

      // Create a new Text3d object
      //drawText = new Rhino.Display.Text3d(txt, pl0_Plane, txt_size);
      //args.Display.Draw3dText(drawText, col);
    }

    // Dispose of the last Text3d object
    if (drawText != null)
    {
      drawText.Dispose();
    }
  }
# ---------- end c_script ----------
