# Grasshopper definition 241222_MultiFloor_SubWay.gh (Grasshopper 1.0.7)
# plug-ins: Kangaroo2 Components

id = Guid([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])
geo = Geometry([<point referenced from the Rhino model> x822])
pt = Point([<point referenced from the Rhino model> x3684])
pt_2 = Point(geo)
merge = Merge(Data1=pt_2, Data2=pt)
c_script = CSharpScript(Expel=pt_2, Tol=Slider(0.01, range=0..1))  # -> out, A, B; inputs PtCloud: list of Point3d, Expel: list of Point3d, Tol: Double
# ---------- c_script: C# usings ----------
using System.Linq;
# ---------- c_script: C# ----------
    double tol = Tol;
    List<int> index = new List<int>();
    List<Point3d> exp = new List<Point3d>();
    for(int i = 0;i < PtCloud.Count;i++)
    {
      foreach(Point3d pt in Expel)
      {
        if(pt.DistanceTo(PtCloud[i]) < tol)
        {
          index.Add(i);
          exp.Add(pt);
        }
      }
    }

    A = PtCloud.Where((p,i) => !index.Contains(i));
    B = exp;
# ---------- end c_script ----------
pt_3 = Point(merge)
check_tooclosenodes = CSharpScript(NodeCloud=pt_3, Check_Tol=Slider(0.5, range=0..1))  # -> out, Ns, NsId, ErrorPts, Cycles; inputs NodeCloud: list of Point3d, Check_Tol: Double
# ---------- check_tooclosenodes: C# ----------
    double ToClosePts_Tol = Check_Tol > 0.0 ? Check_Tol : 1;

    //00 cleanup the duplicate nodes;
    RTree rtree = new RTree();
    for(int i = 0;i < NodeCloud.Count;i++){rtree.Insert(NodeCloud[i], i);}

    List<Point3d> nodes = new List<Point3d>();
    List<int> nodes_ori_ids = new List<int>();

    List<int> DupliIndex = new List<int>();

    for(int i = 0;i < NodeCloud.Count;i++)
    {
      if(DupliIndex.Contains(i)){continue;}

      Sphere SearchSp = new Sphere(NodeCloud[i], Check_Tol);
      List<int> match = new List<int>();
      rtree.Search(SearchSp, (sender, args) => {match.Add(args.Id);});

      if(match.Count > 1){DupliIndex.AddRange(match);}

      nodes.Add(NodeCloud[i]);
      nodes_ori_ids.Add(i);
    }



    Ns = nodes;
    NsId = nodes_ori_ids;

    ErrorPts = DupliIndex.Select(i => NodeCloud[i]);
    Cycles = DupliIndex.Select(i => NodeCloud[i]).Select(p => new Circle(p, Check_Tol));
# ---------- check_tooclosenodes: C# additional code ----------
  public static int? RT_ClosetPt(List<Point3d> ptCloud, RTree T, Point3d pt, double R)
  {
    Sphere SearchSp = new Sphere(pt, R);
    if (T != null)
    {
      List<int> candidates = new List<int>();
      T.Search(SearchSp, (sender, args) => { candidates.Add(args.Id); });
      if (candidates.Count > 0)
      {
        candidates.Sort((a, b) => ptCloud[a].DistanceTo(pt).CompareTo(ptCloud[b].DistanceTo(pt)));
        return candidates[0];
      }
      else { return null; }
    }
    else { return null; }
  }
# ---------- end check_tooclosenodes ----------
crv = Curve([<curve referenced from the Rhino model> x4604])
check_nodeedge_clouds = CSharpScript(NodeCloud=check_tooclosenodes.Ns, EdgeCloud=crv, tol=Slider(0.0001, range=0..1))  # -> out, Matched_Es, Matched_Ns, Error_E, Error_N; inputs NodeCloud: list of Point3d, EdgeCloud: list of Line, tol: Double
# ---------- check_nodeedge_clouds: C# ----------
    List<Point3d> nodes = NodeCloud;

    //01 match edge;
    double fixtol = tol;
    RTree rtree = new RTree();
    for(int i = 0;i < nodes.Count;i++){rtree.Insert(nodes[i], i);}
    List<List<int>> nodenodeAdj = nodes.Select(p => new List<int>()).ToList();
    List<Line> edges = new List<Line>();
    List<Line> edge_error = new List<Line>();

    for(int i = 0;i < EdgeCloud.Count;i++)
    {
      Point3d P0 = EdgeCloud[i].From;
      Point3d P1 = EdgeCloud[i].To;

      Sphere SearchSp0 = new Sphere(P0, fixtol);
      Sphere SearchSp1 = new Sphere(P1, fixtol);

      List<int> match0 = new List<int>();
      List<int> match1 = new List<int>();

      rtree.Search(SearchSp0, (sender, args) => { match0.Add(args.Id); });
      rtree.Search(SearchSp1, (sender, args) => { match1.Add(args.Id); });

      if(match0.Count > 0 && match1.Count > 0 && match0.Count == 1 && match1.Count == 1)
      {
        int ind0 = match0[0];
        int ind1 = match1[0];

        if(ind0 > ind1)
        {
          if(!nodenodeAdj[ind1].Contains(ind0))
          {nodenodeAdj[ind1].Add(ind0);}
        }
        else
        {
          if(!nodenodeAdj[ind0].Contains(ind1))
          {nodenodeAdj[ind0].Add(ind1);}
        }
      }
      else
      {
        edge_error.Add(EdgeCloud[i]);
      }

    }

    List<int> collection = new List<int>();

    for(int i = 0;i < nodenodeAdj.Count;i++)
    {
      if(nodenodeAdj[i].Count > 0 && !collection.Contains(i)){collection.Add(i);}
      foreach(int j in nodenodeAdj[i])
      {
        edges.Add(new Line(nodes[i], nodes[j]));
        if(!collection.Contains(j)){collection.Add(j);}
      }
    }

    //Detect Split
    double checkTol = 0.5;

    List<Point3d> errorNodes = new List<Point3d>();
    foreach(Point3d pt in nodes)
    {
      foreach(Line edge in edges)
      {
        if(edge.MinimumDistanceTo(pt) < checkTol)
        {
          if(pt.DistanceTo(edge.From) < checkTol || pt.DistanceTo(edge.To) < checkTol)
          {continue;}

          errorNodes.Add(pt);
        }
      }

    }

    Matched_Es = edges;
    Matched_Ns = collection.Select(p => nodes[p]);
    Error_E = edge_error;
    Error_N = errorNodes;
# ---------- check_nodeedge_clouds: C# additional code ----------
  public static int? RT_ClosetPt(List<Point3d> ptCloud, RTree T, Point3d pt, double R)
  {
    Sphere SearchSp = new Sphere(pt, R);
    if (T != null)
    {
      List<int> candidates = new List<int>();
      T.Search(SearchSp, (sender, args) => { candidates.Add(args.Id); });
      if (candidates.Count > 0)
      {
        candidates.Sort((a, b) => ptCloud[a].DistanceTo(pt).CompareTo(ptCloud[b].DistanceTo(pt)));
        return candidates[0];
      }
      else { return null; }
    }
    else { return null; }
  }
# ---------- end check_nodeedge_clouds ----------

agent_count = Slider(100, range=0..100)
number_slider = Slider(1000, range=0..1000)
enters = Point([<point referenced from the Rhino model> x4])
stations = Point([<point referenced from the Rhino model> x14])
randomgen = CSharpScript(n=agent_count, o=enters, s=Slider(1000, range=0..1000))  # -> out, A; inputs n: Int32, o: list, s: Int32
# ---------- randomgen: C# ----------
    Random r = new Random(s);

    List<Object> objs = new List<Object>();
    for(int i = 0;i < n;i++)
    {
      objs.Add(o[r.Next(0, o.Count)]);
    }

    A = objs;
# ---------- end randomgen ----------
randomgen_2 = CSharpScript(n=agent_count, o=stations, s=number_slider)  # -> out, A; inputs n: Int32, o: list, s: Int32; same code as randomgen

# ----
# Agents
# (From stations to exsit)
panel = Panel("""CheckOut
Shopping""")
int = Integer(agent_count)
pt_4 = Point(randomgen_2.A)
series = Series(Start=0, Step=1, Count=agent_count)
repeat_by_tree = CSharpScript(
    T=panel,
    Count=int,
    Reference=["C:\USERS\SYCAR\ONEDRIVE\NET_LIBRARY\BSim.dll", "C:\Users\sycar\OneDrive\NET_Library\BSim.dll"])  # -> Tree; inputs T: list, Count: Int32
# ---------- repeat_by_tree: C# usings ----------
using BSim;

using System.Windows.Forms;

using System.Linq;

//using KangarooSolver;
# ---------- repeat_by_tree: C# ----------
    DataTree<Object> tree = new DataTree<Object>();

    for(int i = 0;i < Count;i++)
    {
      tree.AddRange(T, new GH_Path(i));
    }
    Tree = tree;
# ---------- end repeat_by_tree ----------
freewalk = CSharpScript(Reference=["C:\USERS\SYCAR\ONEDRIVE\NET_LIBRARY\BSim.dll", "C:\USERS\SYCAR\ONEDRIVE\NET_LIBRARY\temp\KangarooSolver.dll"])  # -> out, A
# ---------- freewalk: C# usings ----------
using BSim;

using System.Windows.Forms;

using System.Linq;

using KangarooSolver;
# ---------- freewalk: C# ----------
    A = new IBehav_FreeWalk();
# ---------- freewalk: C# additional code ----------
  public class IBehav_FreeWalk : Behavior
  {
    public IBehav_FreeWalk() { }

    public override List<IGoal> Act(Person P, ABM EN)
    {
      List<IGoal> Goals = new List<IGoal>(0);
      bool Leisure = P.State == Person_state.Free;

      if ((Leisure && P.Target == null && P.Path.Count - 1 == P.step))
      {
        Random rd = new Random();
        Approach(P, EN, EN.Space.WalkSpaceNodes[rd.Next(0, EN.Space.WalkSpaceNodes.Count - 1)]);
      }
      return Goals;
    }

    public void Approach(Person P, ABM EN, Point3d target)
    {
      P.Path = PathNet.ShortestPath_Quick(EN.Space.Quick_WalkSpace, P.Locate, target, Config.SearchRange, Config.SoomthRate);
      P.step = 0;
    }
  }
# ---------- end freewalk ----------
multiplication = Multiplication(A=series, B=Slider(20, range=0..100))
metabolism = CSharpScript(Iteration=multiplication, Reference="C:\USERS\SYCAR\ONEDRIVE\NET_LIBRARY\BSim.dll")  # -> Meta; inputs Iteration: Int32
# ---------- metabolism: C# usings ----------
using BSim;

using System.Windows.Forms;

using System.Linq;
# ---------- metabolism: C# ----------
    Meta = (Metabolism) (new MetaP(Iteration));
# ---------- metabolism: C# additional code ----------
  public class MetaP:Metabolism
  {
    public int emergeIteration;
    public MetaP(int Iteration)
    {
      this.emergeIteration = Iteration;
    }
    public bool IfEmerge(Person P, ABM ABM)
    {
      if(ABM.PS.iteration == emergeIteration){return true;}
      else{return false;}
    }

    public bool IfExpire(Person P, ABM ABM)
    {
      if(P.State == Person_state.Gone){return true;}
      else{return false;}
    }

    public object log (Person P, ABM ABM)
    {
      return null;
    }
    
    public override string ToString()
    {
      return "Emerge at " + emergeIteration.ToString();
    }
  }
# ---------- end metabolism ----------
makemove = CSharpScript(
    ATol=Slider(2, range=0..2),
    Speed=Slider(0.01, range=0..1),
    Strengh=Slider(1, range=0..1),
    Reference="C:\USERS\SYCAR\ONEDRIVE\NET_LIBRARY\BSim.dll")  # -> IWalk; inputs ATol: Double, Speed: Double, Strengh: Double
# ---------- makemove: C# ----------
    IWalk = new IBehav_MakeMove(ATol, Speed, Strengh);
# ---------- end makemove ----------
ibehavior = CSharpScript(
    N=int,
    E=freewalk.A,
    Reference=["C:\USERS\SYCAR\ONEDRIVE\NET_LIBRARY\BSim.dll", "C:\Users\sycar\OneDrive\NET_Library\BSim.dll"])  # -> BE; inputs N: Int32
# ---------- ibehavior: C# ----------
    DataTree<Behavior> BEs = new DataTree<Behavior>();

    List <Behavior> Behaviors = new List<Behavior>(){
        new IBehav_NextJob(SelectTheCloset),//IBehavior_Func.RandomSelectTheLeastOccupied
        new IBehav_DoJob()//,
        //(Behavior) E
        //new IBehav_Wait(0.9, 2)
        //,
        //new IBehav_AvoidObs(4) //,
        //new IBehav_Wait(0.9, 2)
        };

    for(int i = 0;i < N;i++)
    {
      BEs.AddRange(Behaviors, new GH_Path(i));
    }
    BE = BEs;
# ---------- ibehavior: C# additional code ----------
  public static List<Event> SelectTheCloset(string next, Person P, ABM ABM)
  {
    List<Event> ValidPoIs = new List<Event>();
    //Pack the untraveled interest points
    foreach (Event poi in ABM.POIs)
    {
      if (!poi.IsType(next)) {continue;}
      if (poi.CanBeVisit(P, ABM))
      {
        ValidPoIs.Add(poi);
      }
    }

    if (ValidPoIs.Count == 0) { return new List<Event>(); }

    //Select the least beTarget Poi
    ValidPoIs.Sort(
      (a, b) => (a.locate.DistanceTo(P.Locate) * Math.Pow((a.beTarget.Count + 1), 2)).CompareTo(b.locate.DistanceTo(P.Locate) * Math.Pow((b.beTarget.Count + 1), 2))
      );

    //Select the next Poi
    Event POI = ValidPoIs[0];
    return new List<Event>() { POI };
  }
# ---------- end ibehavior ----------
concat = Concatenate(FragmentA="P_Exsit_", FragmentB=series)
a_iperson = CSharpScript(
    ID=simplify(graft(concat)),
    Birth_locate=simplify(graft(pt_4)),
    Body_size=Slider(0.3, range=0..1),
    Strengh=Slider(2, range=0..10),
    View_Length=Slider(10, range=0..10),
    View_Angle=Slider(1.2, range=0..10),
    IWalk=makemove,
    Meta=simplify(graft(metabolism)),
    BE=ibehavior,
    TDL=simplify(repeat_by_tree),
    Reference="C:\USERS\SYCAR\ONEDRIVE\NET_LIBRARY\BSim.dll")  # -> flatten(IPerson); inputs ID: String, Birth_locate: Point3d, Body_size: Double, Strengh: Double, View_Length: Double, View_Angle: Double, BE: list, TDL: list
# ---------- a_iperson: C# ----------
    List<Behavior> Behaves = BE.Select(p => p as Behavior).ToList();
    List<string> ToDoList = TDL.Select(p => (string) p).ToList();

    Person P = new Person(ID, Birth_locate, Body_size, Strengh, View_Length, View_Angle, (Behavior) IWalk, Behaves, ToDoList);
    P.Meta = (Metabolism) Meta;
    IPerson = P;
# ---------- end a_iperson ----------

subwaycase = Curve([<curve referenced from the Rhino model> x3694])
rec = Rectangle({Plane=PlaneXY(254.5200343, 31.16101843, 0), Size=Domain2(u=-10.15883401..10.15883401, v=-4.642430796..4.642430796)})

# ----
# BuyTicket
enterexist_ids = Text(["line00", "line01", "line02", "line03", "line04", "line05", "line06", "line07", "line08", "line09", "line10", "line11", "line12", "line13"])
pt_5 = Point([<point referenced from the Rhino model> x14])
列队占位生成器 = CSharpScript(ori_pt=pt_5, Iter=Slider(8, range=0..1000))  # -> out, A; inputs ori_pt: list of Point3d, Iter: Int32
# ---------- 列队占位生成器: C# ----------
    DataTree<Point3d> tree_pts = new DataTree<Point3d>();
    for(int i = 0;i < ori_pt.Count;i++)
    {
      tree_pts.AddRange(QueuePt(ori_pt[i], Iter, 0.5), new GH_Path(i));
    }
    A = tree_pts;
# ---------- 列队占位生成器: C# additional code ----------
  private List<Point3d> QueuePt(Point3d o, int iter, double D)
  {
    List<Point3d> list = new List<Point3d>();

    for(int i = 0;i < iter;i++)
    {
      list.Add(new Point3d(o.X, o.Y - i * D, o.Z));
    }
    return list;
  }

  private List<Point3d> RotatePt(Point3d o, int iter, double R)
  {
    List<Point3d> list = new List<Point3d>();
    int lay = 1;
    int sum = 0;
    int count = lay * 6;

    for(int i = 0;i < iter;i++)
    {
      double a = Math.PI / (count * 0.5);
      double r = 2 * R * lay;

      double b = a * (i - sum);
      list.Add(new Point3d(o.X + Math.Sin(b) * r, o.Y + Math.Cos(b) * r, o.Z));

      if(i == sum + count - 1)
      {
        lay++;
        sum += count;
        count = lay * 6;
      }
    }

    return list;
  }
# ---------- end 列队占位生成器 ----------
e_ievent_m_vs_as_st_q = CSharpScript(
    ID=simplify(graft(enterexist_ids)),
    Locate=simplify(graft(pt_5)),
    Category=simplify(graft("BuyTicket")),
    SubPoints=列队占位生成器.A,
    TimeCons=simplify(graft("100")),
    ActDis=Slider(0.2, range=0..1),
    RT=rec,
    Reference="C:\USERS\SYCAR\ONEDRIVE\NET_LIBRARY\BSim.dll")  # -> out, flatten(IE); inputs ID: String, Locate: Point3d, Category: String, SubPoints: list of Point3d, TimeCons: Int32, ActDis: Double
# ---------- e_ievent_m_vs_as_st_q: C# ----------
    IE = new IEvent_M_vS_aS_St_Q(ID, Locate, TimeCons, ActDis, SubPoints, Category, RT, Config.LevelTol);
# ---------- end e_ievent_m_vs_as_st_q ----------

pt_6 = Point(<point referenced from the Rhino model>)
box = Box({Plane=PlaneXY(242.6551514, 10.5163269, -0.4744629049), X=Domain(0, 13.56182861), Y=Domain(0, 5.490684509), Z=Domain(0, 1.117868027)})

# ----
# Shopping
enterexist_ids_2 = Text("Shopping01")
pt_7 = Point([<point referenced from the Rhino model> x20])
number_slider_2 = Slider(25, range=0..1000)
e_ievent_m_vs_as_st = CSharpScript(
    ID=simplify(graft(enterexist_ids_2)),
    Locate=simplify(graft(pt_6)),
    Category=simplify(graft("Shopping")),
    SubPoints=pt_7,
    TimeCons=simplify(graft("10")),
    ActDis=Slider(0.6, range=0..1),
    RT=box,
    Reference="C:\USERS\SYCAR\ONEDRIVE\NET_LIBRARY\BSim.dll")  # -> out, flatten(IE); inputs ID: String, Locate: Point3d, Category: String, SubPoints: list of Point3d, TimeCons: Int32, ActDis: Double
# ---------- e_ievent_m_vs_as_st: C# ----------
    IE = new IEvent_M_vS_aS_St(ID, Locate, TimeCons, ActDis, SubPoints, Category,RT,Config.LevelTol);
# ---------- end e_ievent_m_vs_as_st ----------

# ----
# Take Seat
pt_8 = Point([<point referenced from the Rhino model> x48])
lng = ListLength(List=pt_8)
series_2 = Series(Start=0, Step=1, Count=lng)
concat_2 = Concatenate(FragmentA="seat", FragmentB=series_2)
e_ievent_s_vs_as_st = CSharpScript(
    ID=simplify(graft(concat_2)),
    Locate=simplify(graft(pt_8)),
    Category=simplify(graft("Seat")),
    TimeCons=simplify(graft("300")),
    ActDis=Slider(0.2, range=0..1),
    Reference="C:\USERS\SYCAR\ONEDRIVE\NET_LIBRARY\BSim.dll")  # -> out, flatten(IE); inputs ID: String, Locate: Point3d, Category: String, TimeCons: Int32, ActDis: Double
# ---------- e_ievent_s_vs_as_st: C# ----------
    IE = new IEvent_S_vS_aS_St(ID, Locate, TimeCons, ActDis, Category,5);
# ---------- end e_ievent_s_vs_as_st ----------

rec_2 = Rectangle({Plane=PlaneXY(281.7044449, 20.06984697, 0), Size=Domain2(u=-6.432996884..6.432996884, v=-2.408136528..2.408136528)})

# ----
# CheckOut
number_slider_3 = Slider(15, range=0..1000)
enterexist_ids_3 = Text(["CheckOut01", "CheckOut02", "CheckOut03"])
pt_9 = Point([<point referenced from the Rhino model> x3])
列队占位生成器_2 = CSharpScript(ori_pt=pt_9, Iter=number_slider_3)  # -> out, A; inputs ori_pt: list of Point3d, Iter: Int32
# ---------- 列队占位生成器_2: C# ----------
    DataTree<Point3d> tree_pts = new DataTree<Point3d>();
    for(int i = 0;i < ori_pt.Count;i++)
    {
      tree_pts.AddRange(QueuePt(ori_pt[i], Iter, 0.8), new GH_Path(i));
    }
    A = tree_pts;
# ---------- 列队占位生成器_2: C# additional code ----------
  private List<Point3d> QueuePt(Point3d o, int iter, double D)
  {
    List<Point3d> list = new List<Point3d>();

    for(int i = 0;i < iter;i++)
    {
      list.Add(new Point3d(o.X + i * D, o.Y, o.Z));
    }
    return list;
  }

  private List<Point3d> RotatePt(Point3d o, int iter, double R)
  {
    List<Point3d> list = new List<Point3d>();
    int lay = 1;
    int sum = 0;
    int count = lay * 6;

    for(int i = 0;i < iter;i++)
    {
      double a = Math.PI / (count * 0.5);
      double r = 2 * R * lay;

      double b = a * (i - sum);
      list.Add(new Point3d(o.X + Math.Sin(b) * r, o.Y + Math.Cos(b) * r, o.Z));

      if(i == sum + count - 1)
      {
        lay++;
        sum += count;
        count = lay * 6;
      }
    }

    return list;
  }
# ---------- end 列队占位生成器_2 ----------
e_ievent_m_vs_as_st_q_2 = CSharpScript(
    ID=simplify(graft(enterexist_ids_3)),
    Locate=simplify(graft(pt_9)),
    Category=simplify(graft("CheckOut")),
    SubPoints=列队占位生成器_2.A,
    TimeCons=simplify(graft("30")),
    ActDis=Slider(0.4, range=0..1),
    RT=rec_2,
    Reference="C:\USERS\SYCAR\ONEDRIVE\NET_LIBRARY\BSim.dll")  # -> out, flatten(IE); inputs ID: String, Locate: Point3d, Category: String, SubPoints: list of Point3d, TimeCons: Int32, ActDis: Double; same code as e_ievent_m_vs_as_st_q

rec_3 = Rectangle({Plane=PlaneXY(270.9215718, 32.55423144, 0), Size=Domain2(u=-6.407865472..6.407865472, v=-3.249217785..3.249217785)})

# ----
# CheckIn
number_slider_4 = Slider(15, range=0..1000)
enterexist_ids_4 = Text(["CheckIn01", "CheckIn02", "CheckIn03"])
pt_10 = Point([<point referenced from the Rhino model> x3])
列队占位生成器_3 = CSharpScript(ori_pt=pt_10, Iter=number_slider_4)  # -> out, A; inputs ori_pt: list of Point3d, Iter: Int32
# ---------- 列队占位生成器_3: C# ----------
    DataTree<Point3d> tree_pts = new DataTree<Point3d>();
    for(int i = 0;i < ori_pt.Count;i++)
    {
      tree_pts.AddRange(QueuePt(ori_pt[i], Iter, 0.8), new GH_Path(i));
    }
    A = tree_pts;
# ---------- 列队占位生成器_3: C# additional code ----------
  private List<Point3d> QueuePt(Point3d o, int iter, double D)
  {
    List<Point3d> list = new List<Point3d>();

    for(int i = 0;i < iter;i++)
    {
      list.Add(new Point3d(o.X - i * D, o.Y, o.Z));
    }
    return list;
  }

  private List<Point3d> RotatePt(Point3d o, int iter, double R)
  {
    List<Point3d> list = new List<Point3d>();
    int lay = 1;
    int sum = 0;
    int count = lay * 6;

    for(int i = 0;i < iter;i++)
    {
      double a = Math.PI / (count * 0.5);
      double r = 2 * R * lay;

      double b = a * (i - sum);
      list.Add(new Point3d(o.X + Math.Sin(b) * r, o.Y + Math.Cos(b) * r, o.Z));

      if(i == sum + count - 1)
      {
        lay++;
        sum += count;
        count = lay * 6;
      }
    }

    return list;
  }
# ---------- end 列队占位生成器_3 ----------
e_ievent_m_vs_as_st_q_3 = CSharpScript(
    ID=simplify(graft(enterexist_ids_4)),
    Locate=simplify(graft(pt_10)),
    Category=simplify(graft("CheckIn")),
    SubPoints=列队占位生成器_3.A,
    TimeCons=simplify(graft("10")),
    ActDis=Slider(0.4, range=0..1),
    RT=rec_3,
    Reference="C:\USERS\SYCAR\ONEDRIVE\NET_LIBRARY\BSim.dll")  # -> out, flatten(IE); inputs ID: String, Locate: Point3d, Category: String, SubPoints: list of Point3d, TimeCons: Int32, ActDis: Double; same code as e_ievent_m_vs_as_st_q

# ----
# Prep-Calculation
# ISpace
number_slider_5 = Slider(3, range=0..10)
# ABM Config
# {The abm model is running on a Graph
# (E,V)-based Map, ISpace indicates the Map configuration}
swatch = ColourSwatch(SwatchColor=RGB(128, 128, 128))
gm = Curve(subwaycase)
crv_2 = Curve(<curve referenced from the Rhino model>)
crv_3 = Curve(gm)
displaycurves = DisPlayCurves(cvs=flatten(gm), cols=flatten(swatch), thick=flatten(number_slider_5))
preprocess_gm = CSharpScript(
    Run=Button(),
    PathNet=crv_3,
    Reference=["C:\Program Files\Rhino 7\Plug-ins\Grasshopper\Components\KangarooSolver.dll", "C:\USERS\SYCAR\ONEDRIVE\NET_LIBRARY\BSim.dll"])  # -> out, Ns; inputs Run: Boolean, PathNet: list of Line
# ---------- preprocess_gm: C# usings ----------
using System.Linq;
using BSim;
using BSim_Network;
using BSim_IO;
using System.Diagnostics;
using System.IO;
using Path=BSim.PathNet;
using System.Windows.Forms;
using System.Threading.Tasks;
# ---------- preprocess_gm: C# ----------
    if(Run)
    {
      saveFileDialog = new SaveFileDialog();
      saveFileDialog.Filter = "bin files (*.bin)|*.bin";
      saveFileDialog.Title = "Setting Data";
      saveFileDialog.RestoreDirectory = true;

      if (saveFileDialog.ShowDialog() == DialogResult.OK)
      {
        saveFileDialog.Dispose();

        W = new MiniWatch();//Start Watch;


        Path.PathNetWork(PathNet, tol, out Nodes, out Adj, out Wi);
        BSim_Network.Prep_Dijkstra PD = new BSim_Network.Prep_Dijkstra(Adj, Wi);

        report = "";
        W.Record("Initialize");
        //Load the Environment;

        data = PD.Prep();

        W.Record("Dijkstra");

        BSim_IO.IO.Matr2D_ExportToBin(saveFileDialog.FileName, data);

        W.Record("Export_Bin");
        report = W.GetTime();

        saveFileDialog.Dispose();
      }

    }
    Component.Message = report;
    Ns = Nodes;
# ---------- preprocess_gm: C# additional code ----------
  double tol = 0.001;
  MiniWatch W;
  List<List<int>> data;
  List<Point3d> Nodes;
  SaveFileDialog saveFileDialog;
  List<List<int>> Adj;
  List<List<double>> Wi;
  string report = "";
# ---------- end preprocess_gm ----------
s_ispace = CSharpScript(
    Obstacles=crv_2,
    Obs_Div=Slider(1, range=0..1),
    Path_Net=crv_3,
    LoadFile=Button(),
    Reference="C:\Users\sycar\OneDrive\NET_Library\BSim.dll")  # -> out, SP; inputs Obstacles: list of Curve, Obs_Div: Double, Path_Net: list of Line, LoadFile: Boolean
# ---------- s_ispace: C# usings ----------
using BSim;
using BSim_IO;
using System.IO;
using System.Windows.Forms;

using System.Linq;
# ---------- s_ispace: C# ----------
    if(LoadFile)
    {
      openFileDialog = new OpenFileDialog();
      openFileDialog.Filter = "Bin files (*.bin)|*.bin";
      openFileDialog.Title = "Open Path Data";
      openFileDialog.RestoreDirectory = true;

      string path = "";
      if (openFileDialog.ShowDialog() == DialogResult.OK)
      {
        path = openFileDialog.FileName;

        List<Point3d> Nodes;
        List<List<int>> Adj;
        List<List<double>> Wi;
        List<List<int>> data;
        PathNet.PathNetWork(Path_Net, tol, out Nodes, out Adj, out Wi);

        try
        {
          BSim_IO.IO.Matr2D_ReadWithBin(path, out data);
          PathNet.QuickPath QP = new PathNet.QuickPath(data, Nodes);
          Space = new ISpace(Obstacles, Obs_Div, QP, Nodes);
          Component.Message = "Loaded:\n" + openFileDialog.SafeFileName;
        }
        catch(Exception e)
        {
          Component.Message = "Error: UnMatch";
          Print(e.ToString());
        }

      }
      openFileDialog.Dispose();
    }

    SP = Space;
# ---------- s_ispace: C# additional code ----------
  ISpace Space;
  OpenFileDialog openFileDialog;
  double tol = 0.001;

  public override void AfterRunScript()
  {
    if(openFileDialog != null)openFileDialog.Dispose();
  }
# ---------- end s_ispace ----------

boundary = BoundarySurfaces(Edges=<geometry referenced from the Rhino model>)
qrsettings = QuadRemeshSettings(TargetCount=100, AdaptiveSize=0, AdaptiveCount=False, HardEdges=False, SeamEdges=0, Symmetry=0, GuideCurves=0)
qrmesh = QuadRemesh(Mesh=boundary, Settings=qrsettings)
medges = MeshEdges(Mesh=qrmesh)  # -> NakedEdges, InteriorEdges, NonManifoldEdges
boundary_2 = BoundarySurfaces(Edges=[<geometry referenced from the Rhino model> x4])
qrsettings_2 = QuadRemeshSettings(TargetCount=1000, AdaptiveSize=0, AdaptiveCount=False, HardEdges=False, SeamEdges=0, Symmetry=0, GuideCurves=0)
crv_4 = Curve([medges.NakedEdges, medges.InteriorEdges, medges.NonManifoldEdges])
qrmesh_2 = QuadRemesh(Mesh=boundary_2, Settings=qrsettings_2)
medges_2 = MeshEdges(Mesh=qrmesh_2)  # -> NakedEdges, InteriorEdges, NonManifoldEdges
crv_5 = Curve([medges_2.NakedEdges, medges_2.InteriorEdges, medges_2.NonManifoldEdges])
dupln = RemoveDuplicateLines(Lines=crv_5, Tolerance=0.01)  # disabled

# ----
# IComunication
c_icommunicate = CSharpScript(Reference="C:\USERS\SYCAR\ONEDRIVE\NET_LIBRARY\BSim.dll")  # -> C
# ---------- c_icommunicate: C# ----------
    List<Communicate> PP_Commun = new List<Communicate>()
      {
        new ICom_Avoid(1.1, 2),
        //new ICom_Talk(0.5, 30, 10, 2)
        };

    C = PP_Commun;
# ---------- end c_icommunicate ----------

crv_6 = Curve(check_nodeedge_clouds.Matched_Es)
crv_7 = Curve([<curve referenced from the Rhino model> x2120])
crv_8 = Curve(crv_7)
pathnettest = CSharpScript(
    Run=Button(),
    PathNet=crv_7,
    Reference=["C:\Program Files\Rhino 7\Plug-ins\Grasshopper\Components\KangarooSolver.dll", "C:\USERS\SYCAR\ONEDRIVE\NET_LIBRARY\BSim.dll"])  # -> out, Ns, St_N, Rc_N, Er_N; inputs Run: Boolean, PathNet: list of Line
# ---------- pathnettest: C# usings ----------
using System.Linq;
using BSim;
using System.Diagnostics;
using System.IO;
using Path=BSim.PathNet;
using System.Windows.Forms;
# ---------- pathnettest: C# ----------
    if(Run)
    {
      Path.ShortPathGraph Graph = Path.PathNetWork(PathNet, tol, out Nodes);
      report = "";
      Record_path = new List<List<List<int>>>();

      //Load the Environment;
      W = new MiniWatch();

      List<int> reach_indices = new List<int>();
      List<int> error_indices = new List<int>();

      for(int i = 0;i < 1;i++)//Nodes.Count[Change this para to see the consistensy of the entire system]
      {
        bool ifFail = false;
        List<List<int>> Node_i_matrix = Graph.Dijkstra_Record(i);

        reach_indices = new List<int>();
        error_indices = new List<int>();
        for(int j = 0;j < Nodes.Count;j++)
        {
          if(i != j && Node_i_matrix[j].Count < 2)
          {
            error_indices.Add(j);
            ifFail = true;
          }
          else
          {
            reach_indices.Add(j);
          }

        }

        if(ifFail)
        {
          rcPoints = reach_indices.Select(p => Nodes[p]).ToList();
          erPoints = error_indices.Select(p => Nodes[p]).ToList();
          stPoint = Nodes[i];
          report += "\nFail\n";
          break;
        }

        stPoint = Point3d.Origin;
        rcPoints = Nodes;
        if(erPoints != null)erPoints.Clear();
        Record_path.Add(Graph.Dijkstra_Record(i));
        W.Record("SubIter_" + i.ToString());
      }

      W.Record("Dijkstra");

      report = W.GetTime();
    }
    Component.Message = report;
    Ns = Nodes;
    St_N = stPoint;
    Rc_N = rcPoints;
    Er_N = erPoints;
# ---------- pathnettest: C# additional code ----------
  double tol = 0.0001;
  MiniWatch W;
  List<List<List<int>>> Record_path;
  List<Point3d> Nodes;
  Point3d stPoint;
  List<Point3d>rcPoints;
  List<Point3d>erPoints;

  string report = "";

  private void ExportToCSV(string path, List<List<List<int>>> data)
  {
    using (StreamWriter writer = new StreamWriter(path))
    {
      foreach (List<List<int>> sublist in data)
      {
        var row = string.Join(";", sublist.Select(innerList => string.Join(",", innerList)));
        writer.WriteLine(row);
      }
    }
  }

  private List<List<List<int>>> ImportFromCSV(string path)
  {
    List<List<List<int>>> data = new List<List<List<int>>>();

    using (StreamReader reader = new StreamReader(path))
    {
      while (!reader.EndOfStream)
      {
        string line = reader.ReadLine();
        var sublist = line.Split(';')
          .Select(segment => segment.Split(',')
          .Select(int.Parse)
          .ToList())
          .ToList();

        data.Add(sublist);
      }
    }

    return data;
  }
# ---------- end pathnettest ----------
looking_for_3degree_nodes = CSharpScript(NodeCloud=pathnettest.Ns, EdgeCloud=crv_8, tol=Slider(0.0001, range=0..1))  # -> out, Matched_Es, Matched_Ns, Error_E, Error_N; inputs NodeCloud: list of Point3d, EdgeCloud: list of Line, tol: Double
# ---------- looking_for_3degree_nodes: C# ----------
    List<Point3d> nodes = NodeCloud;

    //01 match edge;
    double fixtol = tol;
    RTree rtree = new RTree();
    for(int i = 0;i < nodes.Count;i++){rtree.Insert(nodes[i], i);}
    List<List<int>> nodenodeAdj = nodes.Select(p => new List<int>()).ToList();


    for(int i = 0;i < EdgeCloud.Count;i++)
    {
      int n = nodes.Count-1;
      Point3d P0 = EdgeCloud[i].From;
      Point3d P1 = EdgeCloud[i].To;
      
      rtree.Insert(P0, i*2+n);
      rtree.Insert(P1, i*2+n+1);
    }
    
    List <Point3d> nodes3d = new List<Point3d>();
    foreach(Point3d p in nodes)
    {
      Sphere SearchSp0 = new Sphere(p, fixtol);
      List<int> match0 = new List<int>();
      rtree.Search(SearchSp0, (sender, args) => { match0.Add(args.Id); });
      
      if(match0.Count > 3)
      {
        nodes3d.Add(p);
      }
    }

    Matched_Ns = nodes3d;
# ---------- looking_for_3degree_nodes: C# additional code ----------
  public static int? RT_ClosetPt(List<Point3d> ptCloud, RTree T, Point3d pt, double R)
  {
    Sphere SearchSp = new Sphere(pt, R);
    if (T != null)
    {
      List<int> candidates = new List<int>();
      T.Search(SearchSp, (sender, args) => { candidates.Add(args.Id); });
      if (candidates.Count > 0)
      {
        candidates.Sort((a, b) => ptCloud[a].DistanceTo(pt).CompareTo(ptCloud[b].DistanceTo(pt)));
        return candidates[0];
      }
      else { return null; }
    }
    else { return null; }
  }
# ---------- end looking_for_3degree_nodes ----------
pt_11 = Point(pathnettest.Er_N)
dots = DotDisplay(Point=pathnettest.Rc_N, Colour=ColourSwatch(SwatchColor=RGB(84, 142, 61)), Size=1)
dots_2 = DotDisplay(Point=pathnettest.Er_N, Colour=ColourSwatch(SwatchColor=RGB(230, 22, 61)), Size=0.8)
dots_3 = DotDisplay(Point=pathnettest.St_N, Colour=RGB(0, 0, 0), Size=1.4)
pt_12 = Point(looking_for_3degree_nodes.Matched_Ns)

# ----
# Simulator
number_slider_6 = Slider(2, range=0..50)

crv_9 = Curve([<curve referenced from the Rhino model> x1958])
explode = Explode(Curve=crv_9, Recursive=True)  # -> Segments, Vertices
polyline_optimize = CSharpScript(Pts=explode.Vertices, t=Slider(0.9, range=0..2))  # -> out, Angs, SPts; inputs Pts: list of Point3d, t: Double
# ---------- polyline_optimize: C# ----------
    if(Pts.Count == 0){return;}
    if(t <= 0.0){t = 0.8;}
    List<Vector3d> vecs = new List<Vector3d>(Pts.Count - 1);

    for(int i = 0;i < Pts.Count - 1;i++)
    {
      vecs.Add(new Vector3d(Pts[i + 1] - Pts[i]));
    }

    List<double> angles = new List<double>(vecs.Count - 1);
    for(int i = 0;i < vecs.Count - 1;i++)
    {
      Vector3d vec0 = vecs[i];vec0.Unitize();
      Vector3d vec1 = vecs[i + 1];vec1.Unitize();
      double angle = vec0 * vec1;
      angles.Add(angle);
    }

    List < Point3d > keyPts = new List<Point3d>(){Pts[0]};
    for(int i = 0;i < angles.Count;i++)
    {
      if(angles[i] < t){keyPts.Add(Pts[i + 1]);}
    }
    keyPts.Add(Pts[Pts.Count - 1]);
    Angs = angles;
    SPts = keyPts;
# ---------- end polyline_optimize ----------
pline = PolyLine(Vertices=polyline_optimize.SPts, Closed=False)
panel_2 = Panel(polyline_optimize.Angs)
explode_2 = Explode(Curve=pline, Recursive=True)  # -> flatten(Segments), Vertices
line = Line(explode_2.Segments)

swatch_2 = ColourSwatch(SwatchColor=RGB(235, 5, 5))  # disabled
# 结果文档载入
number_slider_7 = Slider(3056, range=0..3500)
# Document &
# Post-proceedure
toggle = BooleanToggle(False)

# ----
# Exist
enterexist_locations = Point([<point referenced from the Rhino model> x4])

lng_2 = ListLength(List=enterexist_locations)
series_3 = Series(Start=0, Step=1, Count=lng_2)
concat_3 = Concatenate(FragmentA="Exsit_station", FragmentB=series_3)
randomgen_3 = CSharpScript(n=agent_count, o=concat_3, s=number_slider)  # -> out, simplify(graft(A)); inputs n: Int32, o: list, s: Int32; same code as randomgen
merge_2 = Merge(Data1=repeat_by_tree, Data2=randomgen_3.A)

e_ievent_exit = CSharpScript(
    ID=concat_3,
    Locate=enterexist_locations,
    ActDis=Slider(0.3, range=0..1),
    Reference="C:\USERS\SYCAR\ONEDRIVE\NET_LIBRARY\BSim.dll")  # -> out, IE; inputs ID: String, Locate: Point3d, ActDis: Double
# ---------- e_ievent_exit: C# ----------
    IE = new IEvent_Exit(ID, Locate, ActDis);
# ---------- end e_ievent_exit ----------

# ----
# Exist
enterexist_locations_2 = Point([<point referenced from the Rhino model> x14])

lng_3 = ListLength(List=enterexist_locations_2)
series_4 = Series(Start=0, Step=1, Count=lng_3)
concat_4 = Concatenate(FragmentA="Exsit_train", FragmentB=series_4)
randomgen_4 = CSharpScript(n=agent_count, o=concat_4, s=number_slider)  # -> out, simplify(graft(A)); inputs n: Int32, o: list, s: Int32; same code as randomgen

e_ievent_exit_2 = CSharpScript(
    ID=concat_4,
    Locate=enterexist_locations_2,
    ActDis=Slider(0.3, range=0..1),
    Reference="C:\USERS\SYCAR\ONEDRIVE\NET_LIBRARY\BSim.dll")  # -> out, IE; inputs ID: String, Locate: Point3d, ActDis: Double; same code as e_ievent_exit

peek_the_scope_of_events = CSharpScript(E=e_ievent_exit_2.IE, Reference="C:\USERS\SYCAR\ONEDRIVE\NET_LIBRARY\BSim.dll")  # -> out, flatten(geo)
# ---------- peek_the_scope_of_events: C# ----------
    geo = ((Event) E).RT;
# ---------- end peek_the_scope_of_events ----------
merge_3 = Merge(
    Data1=flatten(e_ievent_exit_2.IE),
    Data2=flatten(e_ievent_exit.IE),
    Data3=flatten(e_ievent_m_vs_as_st_q.IE),
    Data4=flatten(e_ievent_m_vs_as_st_q_3.IE),
    Data5=flatten(e_ievent_m_vs_as_st_q_2.IE),
    Data7=flatten(e_ievent_m_vs_as_st.IE),
    Data8=flatten(e_ievent_s_vs_as_st.IE))

# ----
# Agents
series_5 = Series(Start=0, Step=1, Count=agent_count)
pt_13 = Point(randomgen.A)
panel_3 = Panel("""BuyTicket
CheckIn
Seat""")
int_2 = Integer(agent_count)
freewalk_2 = CSharpScript(Reference=["C:\USERS\SYCAR\ONEDRIVE\NET_LIBRARY\BSim.dll", "C:\USERS\SYCAR\ONEDRIVE\NET_LIBRARY\temp\KangarooSolver.dll"])  # -> out, A; same code as freewalk
multiplication_2 = Multiplication(A=series_5, B=Slider(20, range=0..100))
metabolism_2 = CSharpScript(Iteration=multiplication_2, Reference="C:\USERS\SYCAR\ONEDRIVE\NET_LIBRARY\BSim.dll")  # -> Meta; inputs Iteration: Int32; same code as metabolism
makemove_2 = CSharpScript(
    ATol=Slider(0.6, range=0..1),
    Speed=Slider(0.01, range=0..1),
    Strengh=Slider(1, range=0..1),
    Reference="C:\USERS\SYCAR\ONEDRIVE\NET_LIBRARY\BSim.dll")  # -> IWalk; inputs ATol: Double, Speed: Double, Strengh: Double; same code as makemove
repeat_by_tree_2 = CSharpScript(
    T=panel_3,
    Count=int_2,
    Reference=["C:\USERS\SYCAR\ONEDRIVE\NET_LIBRARY\BSim.dll", "C:\Users\sycar\OneDrive\NET_Library\BSim.dll"])  # -> Tree; inputs T: list, Count: Int32; same code as repeat_by_tree
ibehavior_2 = CSharpScript(
    N=int_2,
    E=freewalk_2.A,
    Reference=["C:\USERS\SYCAR\ONEDRIVE\NET_LIBRARY\BSim.dll", "C:\Users\sycar\OneDrive\NET_Library\BSim.dll"])  # -> BE; inputs N: Int32
# ---------- ibehavior_2: C# ----------
    DataTree<Behavior> BEs = new DataTree<Behavior>();

    List <Behavior> Behaviors = new List<Behavior>(){
        new IBehav_NextJob(SelectTheCloset),//IBehavior_Func.RandomSelectTheLeastOccupied
        new IBehav_DoJob(),
        (Behavior) E
        //new IBehav_Wait(0.9, 2)
        //,
        //new IBehav_AvoidObs(4) //,
        //new IBehav_Wait(0.9, 2)
        };

    for(int i = 0;i < N;i++)
    {
      BEs.AddRange(Behaviors, new GH_Path(i));
    }
    BE = BEs;
# ---------- ibehavior_2: C# additional code ----------
  public static List<Event> SelectTheCloset(string next,Person P, ABM ABM)
  {
    List<Event> ValidPoIs = new List<Event>();
    //Pack the untraveled interest points
    foreach (Event poi in ABM.POIs)
    {
      if (!poi.IsType(next)) {continue;}
      if (poi.CanBeVisit(P, ABM))
      {
        ValidPoIs.Add(poi);
      }
    }

    if (ValidPoIs.Count == 0) { return new List<Event>(); }

    //Select the least beTarget Poi
    ValidPoIs.Sort(
      (a, b) => (a.locate.DistanceTo(P.Locate) * Math.Pow((a.beTarget.Count + 1), 2)).CompareTo(b.locate.DistanceTo(P.Locate) * Math.Pow((b.beTarget.Count + 1), 2))
      );

    //Select the next Poi
    Event POI = ValidPoIs[0];
    return new List<Event>() { POI };
  }
# ---------- end ibehavior_2 ----------
concat_5 = Concatenate(FragmentA="P_Enter_", FragmentB=series_5)

merge_4 = Merge(Data1=repeat_by_tree_2, Data2=randomgen_4.A)

a_iperson_2 = CSharpScript(
    ID=simplify(graft(concat_5)),
    Birth_locate=simplify(graft(pt_13)),
    Body_size=Slider(0.3, range=0..1),
    Strengh=Slider(2, range=0..10),
    View_Length=Slider(10, range=0..10),
    View_Angle=Slider(1.2, range=0..10),
    IWalk=makemove_2,
    Meta=simplify(graft(metabolism_2)),
    BE=ibehavior_2,
    TDL=simplify(merge_4),
    Reference="C:\USERS\SYCAR\ONEDRIVE\NET_LIBRARY\BSim.dll")  # -> flatten(IPerson); inputs ID: String, Birth_locate: Point3d, Body_size: Double, Strengh: Double, View_Length: Double, View_Angle: Double, BE: list, TDL: list; same code as a_iperson

merge_5 = Merge(Data1=multiplication, Data2=multiplication_2)
merge_6 = Merge(Data1=a_iperson, Data2=a_iperson_2)

# ----
# ABM
# Model
abm_model = CSharpScript(
    S=flatten(s_ispace.SP),
    A=flatten(merge_6),
    C=flatten(c_icommunicate),
    E=flatten(merge_3),
    Reference="C:\USERS\SYCAR\ONEDRIVE\NET_LIBRARY\BSim.dll")  # -> Model; inputs S: list, A: list, C: list, E: list
# ---------- abm_model: C# ----------
    List<ISpace> ISpaces = S.Select(p => (ISpace) p).ToList();
    List<Person> Persons = A.Select(p => (Person) p).ToList();
    List<Communicate> Communis = C.Select(p => (Communicate) p).ToList();
    List<Event> Events = E.Select(p => (Event) p).ToList();

    ABM AgentBasedModel = new ABM(ISpaces[0], Events, Persons, Communis);

    Model = AgentBasedModel;
# ---------- end abm_model ----------

# ----
# Simulation
button = Button()
trigger = Trigger(Interval=10, TimerInterval=10, Target=simulation)  # disabled
# delta T:
# Walk speed: 1.5m/s
# Real world time: 1s
# 运算器
data = Data(abm_model)
simulation = CSharpScript(Model=data, reset=button, run=Toggle(True), Reference="C:\Users\sycar\OneDrive\NET_Library\BSim.dll")  # -> out, M; inputs reset: Boolean, run: Boolean
# ---------- simulation: C# usings ----------
using BSim;

using System.Windows.Forms;

using System.Linq;

using System.Threading;
using System.Threading.Tasks;

using System.IO;
using System.Runtime.Serialization;
using System.Runtime.Serialization.Formatters.Binary;
# ---------- simulation: C# ----------
    int MaxIter = 20000;
    Run = run;
    Reset = reset;
    string timeRep = "";

    if (Reset)
    {
      ABM_simu = (ABM) Model;
      agentCount = ABM_simu.PPs_Wait.Count;
    }
    else if(Run)
    {
      if(ABM_simu != null && ABM_simu.PS.iteration < MaxIter && ABM_simu.PPs_Sink.Count<agentCount)
      {
        try{
          Print(ABM_simu.Simulate(Reset, out timeRep));
        }
        catch (Exception e)
        {
          Print(e.ToString());
        }
      }
    }

    if(ABM_simu != null){Print(ABM_simu.PS.iteration.ToString());}

    Component.Message = timeRep;
    M = ABM_simu;
# ---------- simulation: C# additional code ----------
  ABM ABM_simu;
  bool Reset = false;
  bool Run = false;
  int agentCount = -1;
# ---------- end simulation ----------

panel_4 = Panel(simulation.out)
showminitarget = CSharpScript(M=simulation.M, Reference="C:\USERS\SYCAR\ONEDRIVE\NET_LIBRARY\BSim.dll")  # -> out, Views, Detect, Cur_Pts, Abm_Count
# ---------- showminitarget: C# usings ----------
using System.Linq;
using BSim;

using System.Diagnostics;
using System.Windows.Forms;
# ---------- showminitarget: C# ----------
    List<Line> PointTo = new List<Line>();
    List<Point3d> TPts = new List<Point3d>();
    List<Line> PlCv = new List<Line>();
    List<Line> ViewLn = new List<Line>();
    DataTree<Point3d> Paths = new DataTree<Point3d>();

    ABM ABM = M as ABM;
    int k = 0;
    
    foreach(Person doc in ABM.PPs)
    {
      TPts.Add(doc.Locate);
      k++;
    }

    Component.Message = "agents: " + ABM.PPs.Count.ToString() + "\n Generated: " + ABM.Document.Count.ToString();
    Print(ABM.debug);
    Views = ViewLn;
    Detect = PointTo;
    Cur_Pts = TPts;
    Abm_Count = ABM.PPs.Count;
# ---------- showminitarget: C# additional code ----------
  public Line Viewline(Person P)
  {
    Line ln = new Line(P.Locate, P.Locate);
    if(P.Path.Count > 0)
    {
      ln = new Line(P.Locate, P.Path[P.step]);
    }

    return ln;
  }

  public List<Line> WayPath(List<Point3d>P)
  {
    List<Line> ln = new List<Line>();
    if(P.Count > 1)
    {
      for(int i = 0;i < P.Count - 1;i++)
      {ln.Add(new Line(P[i], P[i + 1]));}
    }

    return ln;
  }

  public Point3d TargetPt(Person P)
  {
    if(P.Path.Count > 0)
    {
      return P.Path[P.Path.Count - 1];
    }
    else
    {
      return P.Locate;
    }
  }
# ---------- end showminitarget ----------
result_display = CSharpScript(Model=simulation.M, Reference="C:\USERS\SYCAR\ONEDRIVE\NET_LIBRARY\BSim.dll")  # -> out, A, M
# ---------- result_display: C# usings ----------
using BSim;

using System.Windows.Forms;

using System.Linq;
using System.Drawing;
# ---------- result_display: C# ----------
    ABM ABM = (ABM) Model;
    Person_Body = ABM.PPs.Select(p => p.Body).ToList();
    Person_Text = ABM.PPs.Select(p => p.State.ToString()).ToList();
    Person_Bar = ABM.PPs.Select(p => ProgressBar(p)).ToList();
    Person_Locate = ABM.PPs.Select(p => p.Locate + new Vector3d(0, -p.SizeR * 0.25, 0) + new Vector3d(-p.SizeR * 0.5, 0, 0)).ToList();

    M = ABM.PPs;
# ---------- result_display: C# additional code ----------
  List<Point3d>Person_Locate = new List<Point3d>();
  List<Curve>Person_Body = new List<Curve>();
  List<string>Person_Text = new List<string>();
  List<List<Point3d>>Person_Bar = new List<List<Point3d>>();

  public List<Point3d> ProgressBar(Person P)
  {
    if(P.Brain.Count > 0)
    {
      double percent = (double) P.Brain[P.Brain.Count - 1].Step / (double) P.Brain[P.Brain.Count - 1].MaxStep;
      Point3d basePt = new Point3d(P.Locate); basePt.Y += P.SizeR * 1.3;
      Point3d P0 = basePt - new Vector3d(P.SizeR, 0, 0) * percent + new Vector3d(0, 0.02, 0);
      Point3d P1 = basePt - new Vector3d(P.SizeR, 0, 0) * percent - new Vector3d(0, 0.02, 0);
      Point3d P2 = basePt + new Vector3d(P.SizeR, 0, 0) * percent - new Vector3d(0, 0.02, 0);
      Point3d P3 = basePt + new Vector3d(P.SizeR, 0, 0) * percent + new Vector3d(0, 0.02, 0);

      if(percent == 1){return new List <Point3d>();}
      List <Point3d> polygon = new List<Point3d>(){P0,P1,P2,P3,P0};
      return polygon;
    }
    else
    {
      return new List <Point3d>(){};
    }
  }

  public override void DrawViewportWires(IGH_PreviewArgs args)
  {
    Plane pl0_Plane;
    args.Viewport.GetFrustumFarPlane(out pl0_Plane);
    Rhino.Display.Text3d drawText = null;  // Initialize to null

    for (int i = 0; i < Person_Bar.Count; i++)
    {
      pl0_Plane.Origin = Person_Locate[i];

      //args.Display.DrawCurve(new PolylineCurve(Person_Bar[i]), Color.Black, 2);
      args.Display.DrawPolygon(Person_Bar[i], Color.Gray, true);
      args.Display.DrawCurve(Person_Body[i], Color.Black, 2);

      drawText = new Rhino.Display.Text3d(Person_Text[i], pl0_Plane, 0.1);
      args.Display.Draw3dText(drawText, Color.Black);
    }

    if(drawText != null)
    {drawText.Dispose();}

  }
# ---------- end result_display ----------
the_agents_in_certain_iter = CSharpScript(
    M=simulation.M,
    I=multiplication,
    n=Slider(3210, range=0..13000),
    Reference="C:\USERS\SYCAR\ONEDRIVE\NET_LIBRARY\BSim.dll")  # -> out, Views, Detect, Cur_Pts, Abm_Count; inputs I: list of Int32, n: Int32
# ---------- the_agents_in_certain_iter: C# ----------
    int Get_iter = n;

    List<Point3d> TPts = new List<Point3d>();

    ABM ABM = M as ABM;


    foreach(Person_Doc doc in ABM.Document)
    {
      string id = doc.id;
      int index = System.Convert.ToInt32(id.Split('_')[1]);

      int meta_iter = I[index];
      if(meta_iter < Get_iter)
      {
        int k = Get_iter - meta_iter;
        if(k < doc.trajectory.Count)
        {TPts.Add(doc.trajectory[Get_iter - meta_iter]);}
      }
    }

    Cur_Pts = TPts;
# ---------- end the_agents_in_certain_iter ----------

showminitarget_2 = CSharpScript(M=simulation.M, Reference="C:\USERS\SYCAR\ONEDRIVE\NET_LIBRARY\BSim.dll")  # -> out, Views, Detect, Trajs, TraPts
# ---------- showminitarget_2: C# ----------
    List<Line> PointTo = new List<Line>();
    List<Point3d> TPts = new List<Point3d>();
    List<Line> PlCv = new List<Line>();
    List<Line> ViewLn = new List<Line>();
    DataTree<Point3d> Paths = new DataTree<Point3d>();

    ABM ABM = M as ABM;
    int k = 0;
    foreach(Person doc in ABM.PPs)
    {
      //PointTo.Add(new Line(doc.Locate, TargetPt(doc)));
      TPts.Add(TargetPt(doc));

      PlCv.AddRange(WayPath(doc.Path));

      Paths.AddRange(doc.Path, new GH_Path(k));

      ViewLn.Add(Viewline(doc));

      Point3d? CPt = ABM.Space.Obs_ClosetPt(doc.Locate, doc.SizeR * 1.005);
      if(CPt != null){PointTo.Add(new Line(doc.Locate, (Point3d) CPt));}

      if(doc.Brain.Count > 0)
      {
        Print(doc.Target.ID + " " + doc.Brain.Last().Step.ToString() + "|" + doc.Brain.Last().MaxStep.ToString());
      }

      Print(doc.Name + ": " + doc.Path.Count.ToString());
      Print(doc.log);
      Print(doc.step.ToString());
      k++;
    }

    Print(ABM.debug);
    Views = ViewLn;
    Detect = PointTo;
    Trajs = PlCv;
    TraPts = Paths;
# ---------- showminitarget_2: C# additional code ----------
  public Line Viewline(Person P)
  {
    Line ln = new Line(P.Locate, P.Locate);
    if(P.Path.Count > 0)
    {
      ln = new Line(P.Locate, P.Path[P.step]);
    }

    return ln;
  }

  public List<Line> WayPath(List<Point3d>P)
  {
    List<Line> ln = new List<Line>();
    if(P.Count > 1)
    {
      for(int i = 0;i < P.Count - 1;i++)
      {ln.Add(new Line(P[i], P[i + 1]));}
    }

    return ln;
  }

  public Point3d TargetPt(Person P)
  {
    if(P.Path.Count > 0)
    {
      return P.Path[P.Path.Count - 1];
    }
    else
    {
      return P.Locate;
    }
  }
# ---------- end showminitarget_2 ----------
pt_14 = Point(showminitarget_2.TraPts)
path = CSharpScript(M=pt_14, Reference="C:\USERS\SYCAR\ONEDRIVE\NET_LIBRARY\BSim.dll")  # -> out, TraPts, MinLen; inputs M: list of Point3d; disabled
# ---------- path: C# ----------
    List<Line> lns = WayPath(Smooth(Smooth(Smooth(M, 0.5), 0.5),0.5));
    lns.Sort((a,b) => a.Length.CompareTo(b.Length));
    TraPts = lns;
    MinLen = lns[0];
# ---------- path: C# additional code ----------
  private static List<Point3d> Smooth(List<Point3d> Pts, double t)
  {
    List<Vector3d> vecs = new List<Vector3d>(Pts.Count - 1);
    List<double> score = new List<double>(Pts.Count - 2);

    for (int i = 0; i < Pts.Count - 1; i++)
    {
      vecs.Add(new Vector3d(Pts[i + 1] - Pts[i]));
    }

    for (int i = 0; i < vecs.Count - 1; i++)
    {
      double angle = Math.Acos(vecs[i] * vecs[i + 1] / (vecs[i].Length * vecs[i + 1].Length));
      score.Add(angle / (vecs[i].Length + vecs[i + 1].Length));
    }


    double score_ave = 0.0;
    foreach (double s in score) { if (s > 0) { score_ave += s; } }
    score_ave /= score.Count;

    List<Point3d> keyPts = new List<Point3d>() { Pts[0] };

    for (int i = 0; i < score.Count; i++)
    {
      if (score[i] > score_ave * t) { keyPts.Add(Pts[i + 1]); }
    }

    keyPts.Add(Pts[Pts.Count - 1]);
    return keyPts;
  }

  public List<Line> WayPath(List<Point3d>P)
  {
    List<Line> ln = new List<Line>();
    if(P.Count > 1)
    {
      for(int i = 0;i < P.Count - 1;i++)
      {ln.Add(new Line(P[i], P[i + 1]));}
    }

    return ln;
  }
# ---------- end path ----------
crv_10 = Curve(path.TraPts)  # disabled
crv_11 = Curve(path.MinLen)  # disabled

showminitarget_3 = CSharpScript(M=simulation.M, n=number_slider_6, Reference="C:\USERS\SYCAR\ONEDRIVE\NET_LIBRARY\BSim.dll")  # -> out, Poi, ToDoList, Target, Brain; inputs n: Int32
# ---------- showminitarget_3: C# ----------
    ABM ABM = M as ABM;
    List<Person> P = ABM.PPs;

    Person check = P[n];
    Print(check.Name);
    Print(check.log);

    Poi = check.Locate;
    ToDoList = check.ToDoList;
    Target = check.Target.ToString();
    Brain = check.Brain.Select(p => "\n" + p.Event.ID + string.Format(" : {0}/{1}", p.Step.ToString(), p.MaxStep.ToString()));
# ---------- showminitarget_3: C# additional code ----------
  public Line Viewline(Person P)
  {
    Line ln = new Line(P.Locate, P.Locate);
    if(P.Path.Count > 0)
    {
      ln = new Line(P.Locate, P.Path[P.step]);
    }

    return ln;
  }

  public List<Line> WayPath(List<Point3d>P)
  {
    List<Line> ln = new List<Line>();
    if(P.Count > 1)
    {
      for(int i = 0;i < P.Count - 1;i++)
      {ln.Add(new Line(P[i], P[i + 1]));}
    }

    return ln;
  }

  public Point3d TargetPt(Person P)
  {
    if(P.Path.Count > 0)
    {
      return P.Path[P.Path.Count - 1];
    }
    else
    {
      return P.Locate;
    }
  }
# ---------- end showminitarget_3 ----------
sph = Sphere(Base=showminitarget_3.Poi, Radius=1)  # disabled
lng_4 = ListLength(List=result_display.M)  # disabled
crv_12 = Curve(showminitarget_2.Views)
panel_5 = Panel(showminitarget_2.out)
item = ListItem(List=showminitarget.Cur_Pts, Index=Slider(32, range=0..100), Wrap=True)
panel_6 = Panel(lng_4)
dots_4 = DotDisplay(Point=showminitarget.Cur_Pts, Colour=swatch_2, Size=5)  # disabled
panel_7 = Panel(showminitarget_3.out)
panel_8 = Panel(showminitarget_3.ToDoList)
panel_9 = Panel(result_display.out)
pline_2 = PolyLine(Vertices=pt_14, Closed=False)
panel_10 = Panel(showminitarget_3.Target)
panel_11 = Panel(showminitarget_3.Brain)

# ----
# Document
button_2 = Button()
write_person_doc = CSharpScript(
    M=simulation.M,
    Run=Button(),
    Reference=["C:\Program Files\Rhino 7\Plug-ins\Grasshopper\Components\KangarooSolver.dll", "C:\USERS\SYCAR\ONEDRIVE\NET_LIBRARY\BSim.dll"])  # -> Doc; inputs Run: Boolean
# ---------- write_person_doc: C# usings ----------
using System.Linq;
using BSim;
using BSim_IO;
using System.Diagnostics;
using System.IO;
using Path=BSim.PathNet;
using System.Windows.Forms;
# ---------- write_person_doc: C# ----------
    if(Run)
    {
      SaveFileDialog saveFileDialog = new SaveFileDialog();
      saveFileDialog.Filter = "Bin files (*.bin)|*.bin";
      saveFileDialog.Title = "Simulated Data";
      saveFileDialog.RestoreDirectory = true;

      if (saveFileDialog.ShowDialog() == DialogResult.OK)
      {
        ABM ABM = (ABM) M;
        BSim_IO.IO.Doc_ExportToBin(saveFileDialog.FileName, ABM.Document);
      }
    }
# ---------- end write_person_doc ----------
read_person_doc = CSharpScript(
    Run=button_2,
    Reference=["C:\Program Files\Rhino 7\Plug-ins\Grasshopper\Components\KangarooSolver.dll", "C:\USERS\SYCAR\ONEDRIVE\NET_LIBRARY\BSim.dll"])  # -> Doc; inputs Run: Boolean
# ---------- read_person_doc: C# ----------
    if(Run)
    {
      OpenFileDialog openFileDialog = new OpenFileDialog();
      openFileDialog.Filter = "Bin files (*.bin)|*.bin";
      openFileDialog.Title = "Open Result Data";
      openFileDialog.RestoreDirectory = true;

      if (openFileDialog.ShowDialog() == DialogResult.OK)
      {
        BSim_IO.IO.Doc_ReadWithBin(openFileDialog.FileName, out Docs);
        Component.Message = "Loaded:\n" + openFileDialog.SafeFileName;
        openFileDialog.Dispose();
      }
    }

    Doc = Docs;
# ---------- read_person_doc: C# additional code ----------
  List<Person_Doc>Docs;
# ---------- end read_person_doc ----------

# ----
# 运算结果文档化
int_3 = Integer(merge_5)
全过程人流统计 = CSharpScript(D=read_person_doc, I=int_3, n=number_slider_7, Reference="C:\USERS\SYCAR\ONEDRIVE\NET_LIBRARY\BSim.dll")  # -> out, Views, Detect, Cur_Pts, Abm_Count; inputs D: list, I: list of Int32, n: Int32; disabled
# ---------- 全过程人流统计: C# ----------
    int sample = 12500;
    List<int> countList = Enumerable.Range(0, sample).Select(p => 0).ToList();

    for(int j = 0;j < sample;j++)
    {
      int Get_iter = j;

      foreach(Person_Doc doc in D)
      {
        string id = doc.id;
        int index = System.Convert.ToInt32(id.Split('_')[1]);

        int meta_iter = I[index];
        if(meta_iter < Get_iter)
        {
          int k = Get_iter - meta_iter;
          if(k < doc.trajectory.Count)
          {countList[j]++;}
        }
      }
    }



    Cur_Pts = countList;
# ---------- end 全过程人流统计 ----------
replay_agents = CSharpScript(D=read_person_doc, I=int_3, n=number_slider_7, Reference="C:\USERS\SYCAR\ONEDRIVE\NET_LIBRARY\BSim.dll")  # -> out, Col, Cur_Pts; inputs D: list, I: list of Int32, n: Int32
# ---------- replay_agents: C# usings ----------
using System.Drawing;
using System.Linq;
using BSim;

using System.Diagnostics;
using System.Windows.Forms;
# ---------- replay_agents: C# ----------
    int Get_iter = n;

    List<Point3d> TPts = new List<Point3d>();
    List<Color> cols = new List<Color>();
    //List<Person_Doc> Docs = M as List<Person_Doc>;

    foreach(Person_Doc doc in D)
    {
      string id = doc.id;
      int index = System.Convert.ToInt32(id.Split('_')[2]);

      string col = id.Split('_')[1];


      int meta_iter = I[index];
      if(meta_iter < Get_iter)
      {
        int k = Get_iter - meta_iter;
        if(k < doc.trajectory.Count)
        {
          TPts.Add(doc.trajectory[Get_iter - meta_iter]);
          if(col == "Exsit"){cols.Add(Color.Blue);}
          if(col == "Enter"){cols.Add(Color.Red);}
        }
      }
    }

    Cur_Pts = TPts;
    Col_ = cols;
# ---------- end replay_agents ----------
selectdata = SelectData(_1=replay_agents.Cur_Pts, gate=toggle)
panel_13 = Panel(全过程人流统计.Cur_Pts)
dots_5 = DotDisplay(Point=replay_agents.Cur_Pts, Colour=replay_agents.Col, Size=0.3)

# ----
# Track Single Person's Traj
number_slider_8 = Slider(0, range=0..6312)
data_2 = Data(read_person_doc)
selectdata_2 = SelectData(_1=data_2, gate=Toggle(False))
singleperson = CSharpScript(Docs=selectdata_2, I=number_slider_8, Reference="C:\Users\sycar\OneDrive\NET_Library\BSim.dll")  # -> out, S, E, Ta, TripPlan, D; inputs Docs: list, I: Int32
# ---------- singleperson: C# usings ----------
using System.Linq;
using BSim;
using System.Diagnostics;
using System.Windows.Forms;
# ---------- singleperson: C# ----------
    List <int> P_index = new List<int>(){1,5,6};

    List<Person_Doc> Doc = Docs.Select(p => (Person_Doc) p).ToList();

    Person_Doc doc = Doc[I];

    List<double> dis = ((Person_Doc) doc).trajectory.Zip(((Person_Doc) doc).trajectory.Skip(1), (a,b) => a.DistanceTo(b)).ToList();
    List<Point3d> ta_pts = ((Person_Doc) doc).trajectory.Skip(1).Where((p,i) => dis[i] > 0.1).Where((p,i) => i % 5 == 0).ToList();

    S = ta_pts.First();
    E = ta_pts.Last();
    Ta = ta_pts;
    TripPlan = Doc[I].eventName;
D=Doc[I].duration;
# ---------- end singleperson ----------
dots_6 = DotDisplay(Point=singleperson.E, Colour=ColourSwatch(SwatchColor=RGB(255, 0, 0)), Size=10)
dots_7 = DotDisplay(Point=singleperson.S, Colour=ColourSwatch(SwatchColor=RGB(0, 0, 255)), Size=10)
pline_3 = PolyLine(Vertices=singleperson.Ta, Closed=False)
panel_14 = Panel(singleperson.TripPlan)
displaycurves_2 = DisPlayCurves(cvs=flatten(pline_3), cols=flatten(ColourSwatch(SwatchColor=RGB(255, 134, 0))), thick=flatten(Slider(5, range=0..15)))

panel_15 = Panel(singleperson.D)

pt_15 = Point(selectdata)
number_slider_9 = Slider(50, range=0..100)
crv_13 = Curve(<curve referenced from the Rhino model>)
cluster = Cluster(evaluaterange=crv_13, U=number_slider_9, V=number_slider_9, nodecloud=pt_15, check_range=Slider(2, range=0..100))  # -> B, ns
sqrt = SquareRoot(Value=cluster.ns)
bnd = Bounds(Numbers=sqrt)
dedomain = DeconstructDomain(Domain=bnd)  # -> Start, End
gradient = Gradient(
    LowerLimit=dedomain.End,
    UpperLimit=dedomain.Start,
    Parameter=sqrt,
    stops=[0.1: RGB(128, 0, 0), 0.2: RGB(192, 0, 0), 0.3: RGB(255, 0, 0), 0.4: RGB(205, 133, 63), 0.5: RGB(255, 140, 0), 0.6: RGB(255, 165, 0), 0.7: RGB(255, 215, 0), 0.8: RGB(240, 230, 140), 0.9: RGB(192, 192, 192)])

selectdata_3 = SelectData(_1=cluster.B, gate=toggle)
argb = SplitARGB(Colour=gradient, IntegerChannels=True)  # -> Alpha, Red, Green, Blue
rgb = ColourRGB(Alpha=50, Red=argb.Red, Green=argb.Green, Blue=argb.Blue)

dots_8 = DotDisplay(Point=selectdata_3, Colour=rgb, Size=Slider(0.5, range=0..10))

# ==== cluster DisPlayCurves
cvs = ClusterInput()
thick = ClusterInput()
cols = ClusterInput()
c_script = CSharpScript(cvs=cvs, cols=cols, thick=thick)  # inputs cvs: list of Curve, cols: list of Color, thick: list of Double
# ---------- c_script: C# usings ----------
using System.IO;
using System.Linq;
using System.Data;
using System.Drawing;
using System.Reflection;
using System.Windows.Forms;
using System.Xml;

using System.Runtime.InteropServices;

using Rhino.DocObjects;
using Rhino.Collections;
using GH_IO;
using GH_IO.Serialization;
# ---------- c_script: C# ----------
    dis_cvs.Clear();
    dis_cols.Clear();
    dis_th.Clear();
    List<int> valid = Enumerable.Range(0, cvs.Count).Where(i => cvs[i].IsValid).ToList();

    if(cvs == null){return;}
    dis_cvs = valid.Select(i => cvs[i]).ToList();
    if(cols.Count == 1){      dis_cols = valid.Select(p => cols[0]).ToList();}
    else if(cols.Count == 0){      dis_cols = valid.Select(p => Color.Black).ToList();}
    else{dis_cols = valid.Select(i => cols[i]).ToList();}

    if(thick.Count == 1) {dis_th = valid.Select(p => thick[0]).ToList();}
    else if(thick.Count == 0){dis_th = valid.Select(p => 1.0).ToList();}
    else{dis_th = valid.Select(i => thick[i]).ToList();}
# ---------- c_script: C# additional code ----------
  private List<Curve> dis_cvs = new List<Curve>();
  private List<Color> dis_cols = new List<Color>();
  private List<double> dis_th = new List<double>();

  public override void BeforeRunScript()
  {
    dis_cvs.Clear();
    dis_cols.Clear();
    dis_th.Clear();
  }

  public override BoundingBox ClippingBox
  {
    get
    {
      return BoundingBox.Empty;
    }
  }

  public override void DrawViewportWires(IGH_PreviewArgs args)
  {
    Plane pl0_Plane;
    args.Viewport.GetFrustumFarPlane(out pl0_Plane);

    Rhino.Display.Text3d drawText = null;  // Initialize to null

    for (int i = 0; i < dis_cvs.Count; i++)
    {
      Curve cv = dis_cvs[i];
      Color col = dis_cols[i];
      double th = dis_th[i];

      pl0_Plane.Origin = cv.PointAt(0.5 * cv.Domain.Length);

      args.Display.DrawCurve(cv, col, System.Convert.ToInt32(th));

      // Create a new Text3d object
      //drawText = new Rhino.Display.Text3d(txt, pl0_Plane, txt_size);
      //args.Display.Draw3dText(drawText, col);
    }

    // Dispose of the last Text3d object
    if (drawText != null)
    {
      drawText.Dispose();
    }
  }
# ---------- end c_script ----------

# ==== cluster Cluster
evaluaterange = ClusterInput()
evaluaterange_2 = Curve(evaluaterange)
boundary = BoundarySurfaces(Edges=evaluaterange_2)
U = ClusterInput()
V = ClusterInput()
sdivide = DivideSurface(Surface=boundary, UCount=U, VCount=V)  # -> flatten(Points), Normals, Parameters
null = NullItem(Item=sdivide.Points)  # -> NullFlags, InvalidFlags, Description
nodecloud = ClusterInput()
check_range = ClusterInput()
dispatch = Dispatch(List=sdivide.Points, DispatchPattern=null.NullFlags)  # -> ListA, ListB
B = ClusterOutput(dispatch.ListB)
heatmap_rtree = CSharpScript(HeatNetWork=dispatch.ListB, NodeCloud=nodecloud, Check_Range=check_range)  # -> out, Ns, NsId, ErrorPts, Cycles; inputs HeatNetWork: list of Point3d, NodeCloud: list of Point3d, Check_Range: Double
# ---------- heatmap_rtree: C# usings ----------
using System.Linq;
using System.Threading.Tasks;
# ---------- heatmap_rtree: C# ----------
    Check_Range = Check_Range > 0 ? Check_Range : 1.0;

    //00 cleanup the duplicate nodes;
    RTree rtree = new RTree();
    for(int i = 0;i < NodeCloud.Count;i++){rtree.Insert(NodeCloud[i], i);}
    double[] HeatMap = new double[HeatNetWork.Count];


    Parallel.For(0, HeatNetWork.Count, (i) =>
      {

      Sphere SearchSp = new Sphere(HeatNetWork[i], Check_Range);
      List<int> match = new List<int>();

      rtree.Search(SearchSp, (sender, args) => {match.Add(args.Id);});
      HeatMap[i] = match.Aggregate(0.0, (acc,p) => acc +  (Check_Range-NodeCloud[p].DistanceTo(HeatNetWork[i])));

      });

    Ns = HeatMap;
    //Cycles = HeatNetWork.Select(p => new Circle(p, Check_Range));
# ---------- heatmap_rtree: C# additional code ----------
  public static int? RT_ClosetPt(List<Point3d> ptCloud, RTree T, Point3d pt, double R)
  {
    Sphere SearchSp = new Sphere(pt, R);
    if (T != null)
    {
      List<int> candidates = new List<int>();
      T.Search(SearchSp, (sender, args) => { candidates.Add(args.Id); });
      if (candidates.Count > 0)
      {
        candidates.Sort((a, b) => ptCloud[a].DistanceTo(pt).CompareTo(ptCloud[b].DistanceTo(pt)));
        return candidates[0];
      }
      else { return null; }
    }
    else { return null; }
  }
# ---------- end heatmap_rtree ----------
ns = ClusterOutput(heatmap_rtree.Ns)

# ==== cluster SelectData: SelectData via identifications
_0 = ClusterInput()
gate = ClusterInput()
_1 = ClusterInput()
c_script = CSharpScript(ListA=_0, ListB=_1, gate=gate)  # -> flatten(A); inputs ListA: list, ListB: list, gate: Int32
# ---------- c_script: C# ----------
    if(gate == 0)
    {
      A = ListA;
    }
    else if(gate == 1)
    {
      A = ListB;
    }
# ---------- end c_script ----------
out = ClusterOutput(c_script)
