# Grasshopper definition TwoClaudPeople.gh (Grasshopper 1.0.8)
# plug-ins: BSim_001a

number_slider = Slider(20, range=0..20)
R = Point([<point referenced from the Rhino model> x9])
L = Point([<point referenced from the Rhino model> x9])
lng = ListLength(List=R)
lng_2 = ListLength(List=L)
bsim_listrepeat = BSIM_ListRepeat(T=R, count=number_slider)  # -> flatten(tree)
bsim_listrepeat_2 = BSIM_ListRepeat(T=L, count=number_slider)  # -> flatten(tree)
series = Series(Start=0, Step="1", Count=number_slider)  # -> graft(Series)
series_2 = Series(Start=0, Step="1", Count=number_slider)  # -> graft(Series)
bsim_batchnaming = BSIM_BatchNaming(txt="LExsit", data=R)
crv = Curve(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)
bsim_batchnaming_2 = BSIM_BatchNaming(txt="RExsit", data=L)

路径随机化 = CSharpScript(Range="1")  # -> out, IBehav; inputs Range: Double
# ---------- 路径随机化: C# ----------
// Grasshopper Script Instance
#r "C:\Users\sycar\AppData\Roaming\Grasshopper\Libraries\BSim\BSim.dll"
#region Usings
using System;
using System.Linq;
using System.Collections;
using System.Collections.Generic;
using System.Drawing;

using Rhino;
using Rhino.Geometry;

using Grasshopper;
using Grasshopper.Kernel;
using Grasshopper.Kernel.Data;
using Grasshopper.Kernel.Types;
using BSim;
using BSim_Physic;

#endregion

public class Script_Instance : GH_ScriptInstance
{
    #region Notes
    /* 
      Members:
        RhinoDoc RhinoDocument
        GH_Document GrasshopperDocument
        IGH_Component Component
        int Iteration

      Methods (Virtual & overridable):
        Print(string text)
        Print(string format, params object[] args)
        Reflect(object obj)
        Reflect(object obj, string method_name)
    */
    #endregion

    private void RunScript(double Range, ref object IBehav_)
    {
        // Write your logic here
        IBehav_ = new IBehav_RandomPath(Range);
    }

    public class IBehav_RandomPath : Behavior
    {
        private double ra;
        public IBehav_RandomPath(double range)
        {
           ra=range;
        }

        public override List<IPhysic> Act(Agent P, ABM EN)
        {
            if(!P.attr.Ext.Contains("ra")){P.attr.Ext.Set("ra",false);}
            bool randomed=false;
            P.attr.Ext.TryGet("ra",out randomed);

            List<Point3d>temp_path=P.temp.Path;

            if(temp_path.Count>2 && !randomed)
            {
                Random rd=new Random(EN.Iteration);

                for(int i=1;i<temp_path.Count-1;i++)
                {
                    double X=(rd.NextDouble()-0.5)*ra*2;
                    double Y=(rd.NextDouble()-0.5)*ra*2;
                    Point3d o=temp_path[i];
                    temp_path[i]=new Point3d(o.X+X,o.Y+Y,o.Z);
                }
                P.attr.Ext.Set("ra",true);
            }
            if(temp_path.Count==0 && randomed==true){P.attr.Ext.Set("ra",false);}

            return new List<IPhysic>();

            int GetIndex(string str)
            {
                int index=1;
                int.TryParse(str.Split("_")[1],out index);
                return index; 
            }
        }
    }




}
# ---------- end 路径随机化 ----------

bsim_surftonetmap = BSIM_SurfToNetMap(srf=crv, B=2)
repeat = RepeatData(Data=series, Length=lng)  # -> simplify(flatten(Data))
bsim_batchnaming_3 = BSIM_BatchNaming(txt="RP", data=bsim_listrepeat)  # -> simplify(R)
ievent_exit = IEvent_Exit(ID=bsim_batchnaming, Pt=L, ADist=0.6, Sel="Default")
repeat_2 = RepeatData(Data=series_2, Length=lng_2)  # -> simplify(flatten(Data))
bsim_batchnaming_4 = BSIM_BatchNaming(txt="LP_", data=bsim_listrepeat_2)  # -> simplify(R)
bsim_listrepeat_3 = BSIM_ListRepeat(T=bsim_batchnaming, count=number_slider)  # -> flatten(tree)
bsim_listrepeat_4 = BSIM_ListRepeat(T=bsim_batchnaming_2, count=number_slider)  # -> flatten(tree)
lng_3 = ListLength(List=bsim_batchnaming_3)
ievent_exit_2 = IEvent_Exit(ID=bsim_batchnaming_2, Pt=R, ADist=0.6, Sel="Default")
number_slider_2 = Slider(0.34, range=0..1)
series_3 = Series(Start=2, Step=0.1, Count=20)
lng_4 = ListLength(List=bsim_batchnaming_4)
series_4 = Series(Start=2, Step=0.1, Count=20)
number_slider_3 = Slider(3, range=0.8..3)
srf = Surface(<surface referenced from the Rhino model>)
bsim_randrepeat = BSIM_RandRepeat(n=lng_3, o=series_3, s=1000)
bsim_randrepeat_2 = BSIM_RandRepeat(n=lng_4, o=series_4, s=Slider(900, range=0..1000))
project = ProjectCurve(Curve=bsim_surftonetmap, Brep=srf, Direction=Vector(0, 0, 1), UseTasks=False)  # -> flatten(Curve)
agent_bhav = Agent_Bhav(ToDoList=graft(bsim_listrepeat_3), IBehavs=路径随机化.IBehav)  # -> flatten(Bhav)
agent_meta = Agent_Meta(BirthIter=flatten(repeat))
agent_bhav_2 = Agent_Bhav(ToDoList=graft(bsim_listrepeat_4), IBehavs=路径随机化.IBehav)  # -> flatten(Bhav)
agent_meta_2 = Agent_Meta(BirthIter=flatten(repeat_2))
midpt = CurveMiddle(Curve=project)
agent_attr = Agent_Attr(
    ID=flatten(bsim_batchnaming_3),
    Pt=flatten(bsim_listrepeat),
    StR=bsim_randrepeat,
    R=0.3,
    Tol=number_slider_3,
    Spd=number_slider_2,
    Col=ColourSwatch(SwatchColor=RGB(255, 0, 255)),
    GeoP=["\poss\g_walk.3dm", "\poss\g_seat.3dm", "\poss\g_talk.3dm"])
agent_view = Agent_View(VDist=20, VAngl=1.2)
agent_attr_2 = Agent_Attr(
    ID=flatten(bsim_batchnaming_4),
    Pt=flatten(bsim_listrepeat_2),
    StR=bsim_randrepeat_2,
    R=0.3,
    Tol=number_slider_3,
    Spd=number_slider_2,
    Col=ColourSwatch(SwatchColor=RGB(0, 0, 255)),
    GeoP=["\poss\g_walk.3dm", "\poss\g_seat.3dm", "\poss\g_talk.3dm"])
agent_view_2 = Agent_View(VDist=20, VAngl=1.2)
number_slider_4 = Slider(1.5, range=0..10)
panel = Panel("0")
midpt_2 = CurveMiddle(Curve=bsim_surftonetmap)
pdecon = Deconstruct(Point=midpt)  # -> XComponent, YComponent, ZComponent
bnd = Bounds(Numbers=pdecon.ZComponent)
remap = RemapNumbers(Value=pdecon.ZComponent, Source=bnd, Target=Domain(1, 20))  # -> Mapped, Clipped
preprspace = PreprSpace(
    Net=bsim_surftonetmap,
    NetWeights=remap.Mapped,
    Div=1,
    path="C:\05_Works\003_软件开发\230828_Behaviour_Simulator\_Compile as Tool\Publish_case\TwoClaud.bin")
interact_avoid = Interact_Avoid(DistCoeff=1.5, W0=1, VeloCoeff="2", W1=1.5)
agent = Agent(Attr=agent_attr, Bhav=agent_bhav, Meta=agent_meta, View=agent_view)  # -> flatten(A)
round = Round(Number=remap.Mapped)  # -> Nearest, Floor, Ceiling
bnd_2 = Bounds(Numbers=remap.Mapped)
agent_2 = Agent(Attr=agent_attr_2, Bhav=agent_bhav_2, Meta=agent_meta_2, View=agent_view_2)  # -> flatten(A)
ievent_roam = IEvent_Roam(Time=1, ADist=0.3, Po=0, Sel="Default")
panel_2 = Panel(agent_2)
gradient = Gradient(
    LowerLimit=20,
    UpperLimit=1,
    Parameter=round.Floor,
    stops=[0: RGB(234, 38, 0), 0.25: RGB(234, 126, 0), 0.5: RGB(254, 244, 84), 0.75: RGB(173, 203, 249), 1: RGB(75, 107, 169)])
tag = TextTag(Location=midpt_2, Text=round.Floor, Colour=gradient)
abm = ABM(S=flatten(preprspace), A=flatten([agent_2, agent]), E=flatten([ievent_exit_2, ievent_exit]))
c_script = CSharpScript()  # -> out, a
# ---------- c_script: C# ----------
// Grasshopper Script Instance
#region Usings
using System;
using System.Linq;
using System.Collections;
using System.Collections.Generic;
using System.Drawing;

using Rhino;
using Rhino.Geometry;

using Grasshopper;
using Grasshopper.Kernel;
using Grasshopper.Kernel.Data;
using Grasshopper.Kernel.Types;
#endregion

public class Script_Instance : GH_ScriptInstance
{
    #region Notes
    /* 
      Members:
        RhinoDoc RhinoDocument
        GH_Document GrasshopperDocument
        IGH_Component Component
        int Iteration

      Methods (Virtual & overridable):
        Print(string text)
        Print(string format, params object[] args)
        Reflect(object obj)
        Reflect(object obj, string method_name)
    */
    #endregion

    private void RunScript(object x, object y, ref object a)
    {
        // Write your logic here
        a = null;
    }
}
# ---------- end c_script ----------
number_slider_5 = Slider(1078, range=1..4000)
simulator = Simulator(ABM=abm)  # -> ABM, Log
simulator_background = SimulatorBackGround(ABM=abm, Max=20000, Run=Button())  # -> ABM, Doc, Log
ievent_stroll = IEvent_Stroll(Time=1, SDist=50, Po=0, Sel="Default")
displ_agents = Displ_Agents(ABM=simulator.ABM)
extractresult = ExtractResult(Doc=simulator_background.Doc, ABM=simulator_background.ABM, AtIter=0)  # -> ID, Pt, Col, St, Po
preview = CustomPreview(Geometry=extractresult.Po, Material=extractresult.Col)
panel_3 = Panel(simulator.Log)

# ==== cluster BSIM_SurfToNetMap
srf = ClusterInput()
B = ClusterInput()
srf_2 = Surface(srf)
area = Area(Geometry=srf_2)  # -> Area, Centroid
division = Division(A=area.Area, B=B)
qrsettings = QuadRemeshSettings(TargetCount=division, AdaptiveSize=0, AdaptiveCount=False, HardEdges=False, SeamEdges=0, Symmetry=0, GuideCurves=0)
qrmesh = QuadRemesh(Geometry=srf_2, Settings=qrsettings)
medges = MeshEdges(Mesh=qrmesh)  # -> NakedEdges, InteriorEdges, NonManifoldEdges
crv = Curve(flatten([medges.NakedEdges, medges.InteriorEdges, medges.NonManifoldEdges]))
dupln = RemoveDuplicateLines(Lines=crv, Tolerance=0.01)
Q = ClusterOutput(dupln)

# ==== cluster BSIM_BatchNaming
txt = ClusterInput()
data = ClusterInput()
data_2 = Data(data)
txt_2 = Text(txt)
lng = ListLength(List=data_2)
series = Series(Start=0, Step=1, Count=lng)
concat = Concatenate(FragmentA=txt_2, FragmentC=series)
R = ClusterOutput(concat)

# ==== cluster BSIM_ListRepeat: Repeat the list objects as tree data
count = ClusterInput()
T = ClusterInput()
repeat_by_tree = CSharpScript(
    T=T,
    Count=count,
    Reference=["C:\USERS\SYCAR\ONEDRIVE\NET_LIBRARY\BSim.dll", "C:\Users\sycar\OneDrive\NET_Library\BSim.dll"])  # -> Tree; inputs T: list, Count: Int32
# ---------- repeat_by_tree: C# usings ----------
using BSim;

using System.Windows.Forms;

using System.Linq;

//using KangarooSolver;
# ---------- repeat_by_tree: C# ----------
    DataTree<Object> tree = new DataTree<Object>();

    for(int i = 0;i < Count;i++)
    {
      tree.AddRange(T, new GH_Path(i));
    }
    Tree = tree;
# ---------- end repeat_by_tree ----------
tree = ClusterOutput(repeat_by_tree)

# ==== cluster BSIM_RandRepeat: Random Repeat the objects
n = ClusterInput()
o = ClusterInput()
s = ClusterInput()
randomgen = CSharpScript(n=n, o=o, s=s)  # -> out, A; inputs n: Int32, o: list, s: Int32
# ---------- randomgen: C# ----------
    Random r = new Random(s);

    List<Object> objs = new List<Object>();
    for(int i = 0;i < n;i++)
    {
      objs.Add(o[r.Next(0, o.Count)]);
    }

    A = objs;
# ---------- end randomgen ----------
A = ClusterOutput(randomgen.A)
