# Grasshopper definition 231017_Scenario_Exhibitions.gh (Grasshopper 1.0.7)
# plug-ins: Kangaroo2 Components, Weaverbird, LunchBox

# Scenario 2-3
crv = Curve([<curve referenced from the Rhino model> x40])
crv_2 = Curve([<curve referenced from the Rhino model> x2133])
pt = Point(<point referenced from the Rhino model>)
pt_2 = Point([<point referenced from the Rhino model> x42])
pt_3 = Point(<point referenced from the Rhino model>)
cellexclude = Curve([<curve referenced from the Rhino model> x40])
trees = Curve([<curve referenced from the Rhino model> x6])
viewobs = Curve([<curve referenced from the Rhino model> x30])
cellbound = Boundary({Plane=PlaneXY(79.14964489, 17.45751539, 0), Size=Domain2(u=-7.15..7.15, v=-3.237400744..3.237400744)})
# Scenario 2-0
crv_3 = Curve([<curve referenced from the Rhino model> x29])
crv_4 = Curve([<curve referenced from the Rhino model> x1993])
pt_4 = Point(<point referenced from the Rhino model>)
pt_5 = Point([<point referenced from the Rhino model> x40])
pt_6 = Point(<point referenced from the Rhino model>)
viewobs_2 = Curve([<curve referenced from the Rhino model> x29])
cellbound_2 = Boundary({Plane=PlaneXY(-29.62795489, 17.45566352, 0), Size=Domain2(u=-7.15..7.15, v=-3.239252616..3.239252616)})
trees_2 = Curve([<curve referenced from the Rhino model> x6])
cellexclude_2 = Curve([<curve referenced from the Rhino model> x29])
# Scenario 2-2
crv_5 = Curve([<curve referenced from the Rhino model> x30])
crv_6 = Curve([<curve referenced from the Rhino model> x2239])
pt_7 = Point(<point referenced from the Rhino model>)
pt_8 = Point([<point referenced from the Rhino model> x42])
pt_9 = Point(<point referenced from the Rhino model>)
trees_3 = Curve([<curve referenced from the Rhino model> x6])
viewobs_3 = Curve([<curve referenced from the Rhino model> x29])
cellbound_3 = Boundary({Plane=PlaneXY(44.00470353, 17.45751539, 0), Size=Domain2(u=-7.15..7.15, v=-3.237400744..3.237400744)})
cellexclude_3 = Curve([<curve referenced from the Rhino model> x30])
# Scenario 2-1
crv_7 = Curve([<curve referenced from the Rhino model> x28])
crv_8 = Curve([<curve referenced from the Rhino model> x1797])
pt_10 = Point(<point referenced from the Rhino model>)
pt_11 = Point([<point referenced from the Rhino model> x40])
pt_12 = Point(<point referenced from the Rhino model>)
trees_4 = Curve([<curve referenced from the Rhino model> x6])
viewobs_4 = Curve([<curve referenced from the Rhino model> x28])
cellbound_4 = Boundary({Plane=PlaneXY(7.18837432, 17.45751539, 0), Size=Domain2(u=-7.15..7.15, v=-3.237400744..3.237400744)})
cellexclude_4 = Curve([<curve referenced from the Rhino model> x28])

# ---- group: Space
_01_room_obs = Curve(crv)
_02_path_net = Curve(crv_2)

# ---- group: Person
agent_count = Integer(Slider(30, range=1..64))
emerge_gap = Integer(Slider(40, range=0..100))
birth_locate = Point(pt)

# ---- group: Events
event_locate_01 = Point(pt_2)
exsit_locate = Point(pt_3)

# ----
cellexclude_5 = Curve(cellexclude)
cellbound_5 = Boundary(cellbound)
w_count = WidthCount(143)
h_count = HeightCount(65)

viewobs_5 = Curve(viewobs)
trees_5 = Curve(trees)

# ---- group: Space
_01_room_obs_2 = Curve(crv_3)
_02_path_net_2 = Curve(crv_4)

_01_room_obs_3 = Curve(crv_5)
_02_path_net_3 = Curve(crv_6)

# ---- group: Events
event_locate_01_2 = Point(pt_5)
exsit_locate_2 = Point(pt_6)

# ---- group: Person
agent_count_2 = Integer(Slider(30, range=1..64))
emerge_gap_2 = Integer(Slider(40, range=0..100))
birth_locate_2 = Point(pt_4)

# ---- group: Events
event_locate_01_3 = Point(pt_8)
exsit_locate_3 = Point(pt_9)

# ---- group: Person
agent_count_3 = Integer(Slider(30, range=1..64))
emerge_gap_3 = Integer(Slider(40, range=0..100))
birth_locate_3 = Point(pt_7)

# ----
cellexclude_6 = Curve(cellexclude_2)
cellbound_6 = Boundary(cellbound_2)
w_count_2 = WidthCount(143)
h_count_2 = HeightCount(65)

# ---- group: Space
_01_room_obs_4 = Curve(crv_7)
_02_path_net_4 = Curve(crv_8)

# ----
cellexclude_7 = Curve(cellexclude_3)
cellbound_7 = Boundary(cellbound_3)
w_count_3 = WidthCount(143)
h_count_3 = HeightCount(65)

viewobs_6 = Curve(viewobs_2)
trees_6 = Curve(trees_2)

# ---- group: Person
agent_count_4 = Integer(Slider(30, range=1..64))
emerge_gap_4 = Integer(Slider(40, range=0..100))
birth_locate_4 = Point(pt_10)

# ---- group: Events
event_locate_01_4 = Point(pt_11)
exsit_locate_4 = Point(pt_12)

# ----
viewobs_7 = Curve(viewobs_3)
trees_7 = Curve(trees_3)

cellexclude_8 = Curve(cellexclude_4)
cellbound_8 = Boundary(cellbound_4)
w_count_4 = WidthCount(143)
h_count_4 = HeightCount(65)

viewobs_8 = Curve(viewobs_4)
trees_8 = Curve(trees_4)

V = VDivisions(40)  # disabled
U = UDivisions(72)  # disabled
crv_9 = Curve(<curve referenced from the Rhino model>)  # disabled
boundary = BoundarySurfaces(Edges=crv_9)  # disabled
hex = HexagonCells(Surface=boundary, UDivisions=U, VDivisions=V, TParameter=0.25)  # -> HexagonCells, Centers; disabled
trib = TrianglePanelsB(Surface=boundary, UDivisions=U, VDivisions=V)  # disabled
explode = Explode(Curve=trib, Recursive=True)  # -> flatten(Segments), Vertices; disabled
dupln = RemoveDuplicateLines(Lines=explode.Segments, Tolerance=0.01)  # disabled

crv_10 = Curve(_01_room_obs)
crv_11 = Curve(_02_path_net)
s_ispace = CSharpScript(
    Obstacles=crv_10,
    Obs_Div=Slider(0.25, range=0..1),
    Path_Net=crv_11,
    LoadFile=Button(),
    Reference="C:\05_Works\003_软件开发\230828_Behaviour_Simulator\231010_BSim\BSim\bin\Release\net48\BSim.dll")  # -> out, SP; inputs Obstacles: list of Curve, Obs_Div: Double, Path_Net: list of Line, LoadFile: Boolean
# ---------- s_ispace: C# usings ----------
using BSim;

using System.Windows.Forms;

using System.Linq;
# ---------- s_ispace: C# ----------
    if(LoadFile)
    {
      OpenFileDialog openFileDialog = new OpenFileDialog();
      openFileDialog.Filter = "CSV files (*.csv)|*.csv";
      openFileDialog.Title = "Open Path Data";
      openFileDialog.RestoreDirectory = true;

      if (openFileDialog.ShowDialog() == DialogResult.OK)
      {
        List<Point3d> Nodes;
        PathNet.ShortPathGraph Graph = PathNet.PathNetWork(Path_Net, tol, out Nodes);
        try
        {
          PathNet.QuickPath QP = new PathNet.QuickPath(openFileDialog.FileName, Nodes);
          Space = new ISpace(Obstacles, Obs_Div, QP, Nodes);
          Component.Message = "Loaded:\n" + openFileDialog.SafeFileName;
        }
        catch(Exception e)
        {
          Component.Message = "Error: UnMatch";
          Print(e.ToString());
        }

      }

    }

    SP = Space;
# ---------- s_ispace: C# additional code ----------
  ISpace Space;
  double tol = 0.001;
# ---------- end s_ispace ----------
panel = Panel(s_ispace.out)

crv_12 = Curve(_01_room_obs_3)
crv_13 = Curve(_02_path_net_3)
s_ispace_2 = CSharpScript(
    Obstacles=crv_12,
    Obs_Div=Slider(0.25, range=0..1),
    Path_Net=crv_13,
    LoadFile=Button(),
    Reference="C:\05_Works\003_软件开发\230828_Behaviour_Simulator\231010_BSim\BSim\bin\Release\net48\BSim.dll")  # -> out, SP; inputs Obstacles: list of Curve, Obs_Div: Double, Path_Net: list of Line, LoadFile: Boolean; same code as s_ispace
panel_2 = Panel(s_ispace_2.out)

crv_14 = Curve(_01_room_obs_2)
crv_15 = Curve(_02_path_net_2)
s_ispace_3 = CSharpScript(
    Obstacles=crv_14,
    Obs_Div=Slider(0.25, range=0..1),
    Path_Net=crv_15,
    LoadFile=Button(),
    Reference="C:\05_Works\003_软件开发\230828_Behaviour_Simulator\231010_BSim\BSim\bin\Release\net48\BSim.dll")  # -> out, SP; inputs Obstacles: list of Curve, Obs_Div: Double, Path_Net: list of Line, LoadFile: Boolean; same code as s_ispace
panel_3 = Panel(s_ispace_3.out)

crv_16 = Curve(_01_room_obs_4)
crv_17 = Curve(_02_path_net_4)
s_ispace_4 = CSharpScript(
    Obstacles=crv_16,
    Obs_Div=Slider(0.25, range=0..1),
    Path_Net=crv_17,
    LoadFile=Button(),
    Reference="C:\05_Works\003_软件开发\230828_Behaviour_Simulator\231010_BSim\BSim\bin\Release\net48\BSim.dll")  # -> out, SP; inputs Obstacles: list of Curve, Obs_Div: Double, Path_Net: list of Line, LoadFile: Boolean; same code as s_ispace
panel_4 = Panel(s_ispace_4.out)

# ----
# ISpace
# IPerson
# Behave Mode
# IEvents
group = CSharpScript(pts=event_locate_01)  # -> out, T; inputs pts: list of Point3d
# ---------- group: C# ----------
    int groupNum = 2;
    DataTree<Point3d> tree = new DataTree<Point3d>();
    for(int i = 0;i < pts.Count / groupNum;i++)
    {
      for(int k = 0;k < groupNum;k++)
      {
        int index = i * groupNum + k;
        tree.Add(pts[index], new GH_Path(i));
      }
    }
    T = tree;
# ---------- end group ----------
avr = Average(Input=group.T)  # -> flatten(ArithmeticMean)
ibehavior = CSharpScript(Reference=["C:\05_Works\003_软件开发\230828_Behaviour_Simulator\231010_BSim\BSim\bin\Release\net48\BSim.dll", "C:\05_Works\003_软件开发\230828_Behaviour_Simulator\231010_BSim\BSim\bin\Release\net48\KangarooSolver.dll"])  # -> BE
# ---------- ibehavior: C# usings ----------
using BSim;

using System.Windows.Forms;

using System.Linq;

using KangarooSolver;
# ---------- ibehavior: C# ----------
    List <Behavior> Behaviors = new List<Behavior>(){
        new IBehav_NextJob(IBehavior_Func.RandomSelectTheLeastOccupied),//IBehavior_Func.RandomSelectTheLeastOccupied new IBehav_NextJob(SelectTheCloset)
        new IBehav_DoJob(),
        new IBehav_AvoidObs(4),
        new IBehav_Wait(0.9, 2)
        };

    BE = Behaviors;
# ---------- ibehavior: C# additional code ----------
  public static List<Event> SelectTheCloset(Person P, ABM ABM)
  {
    List<Event> ValidPoIs = new List<Event>();
    //Pack the untraveled interest points
    foreach (Event poi in ABM.POIs)
    {
      if (!poi.IsType(P.NextToDo)) {continue;}
      if (poi.CanBeVisit(P, ABM))
      {
        ValidPoIs.Add(poi);
      }
    }

    if (ValidPoIs.Count == 0) { return new List<Event>(); }

    //Select the least beTarget Poi
    ValidPoIs.Sort(
      (a, b) => (a.locate.DistanceTo(P.Locate) * Math.Pow((a.beTarget.Count + 1), 2)).CompareTo(b.locate.DistanceTo(P.Locate) * Math.Pow((b.beTarget.Count + 1), 2))
      );

    //Select the next Poi
    Event POI = ValidPoIs[0];
    return new List<Event>() { POI };
  }
# ---------- end ibehavior ----------
e_ievent_untrapped = CSharpScript(
    Duplicate=Slider(10, range=0..10),
    Reference="C:\05_Works\003_软件开发\230828_Behaviour_Simulator\231010_BSim\BSim\bin\Release\net48\BSim.dll")  # -> out, IE; inputs Duplicate: Int32
# ---------- e_ievent_untrapped: C# ----------
    IE = new IEvent_UnTrapped(10);
# ---------- end e_ievent_untrapped ----------

series = Series(Start=0, Step=1, Count=agent_count)
multiplication = Multiplication(A=series, B=emerge_gap)
metabolism = CSharpScript(
    Iteration=multiplication,
    Reference="C:\05_Works\003_软件开发\230828_Behaviour_Simulator\231010_BSim\BSim\bin\Release\net48\BSim.dll")  # -> Meta; inputs Iteration: Int32
# ---------- metabolism: C# ----------
    Meta = (Metabolism) (new MetaP(Iteration));
# ---------- metabolism: C# additional code ----------
  public class MetaP:Metabolism
  {
    public int emergeIteration;
    public MetaP(int Iteration)
    {
      this.emergeIteration = Iteration;
    }
    public bool IfEmerge(Person P, ABM ABM)
    {
      if(ABM.PS.iteration == emergeIteration){return true;}
      else{return false;}
    }

    public bool IfExpire(Person P, ABM ABM)
    {
      if(P.State == Person_state.Gone){return true;}
      else{return false;}
    }

    public override string ToString()
    {
      return "Emerge at:" + emergeIteration.ToString();
    }
  }
# ---------- end metabolism ----------
makemove = CSharpScript(Reference="C:\05_Works\003_软件开发\230828_Behaviour_Simulator\231010_BSim\BSim\bin\Release\net48\BSim.dll")  # -> IWalk
# ---------- makemove: C# ----------
    IWalk = new IBehav_MakeMove(0.3, 0.01, 1);
# ---------- end makemove ----------
todolist = CSharpScript(Reference="C:\05_Works\003_软件开发\230828_Behaviour_Simulator\231010_BSim\BSim\bin\Release\net48\BSim.dll")  # -> TDL
# ---------- todolist: C# ----------
    List<string> ToDoList = new List<string>(){
        "WatchDisPlay","WatchDisPlay","WatchDisPlay","WatchDisPlay",
        "WatchDisPlay","WatchDisPlay","WatchDisPlay","WatchDisPlay",
        "WatchDisPlay","WatchDisPlay","WatchDisPlay","WatchDisPlay",
        "WatchDisPlay","WatchDisPlay","WatchDisPlay","WatchDisPlay",
        "WatchDisPlay","WatchDisPlay","WatchDisPlay","WatchDisPlay"
        };


    TDL = ToDoList;
# ---------- end todolist ----------
concat = Concatenate(FragmentA="Robot_", FragmentB=series)
pt_13 = Point(birth_locate)
a_iperson = CSharpScript(
    ID=concat,
    Locate=pt_13,
    RSize=Slider(0.3, range=0..1),
    Strengh=Slider(2, range=0..10),
    VLength=Slider(10, range=0..10),
    VAngle=Slider(1.2, range=0..10),
    IWalk=makemove,
    Meta=metabolism,
    BE=ibehavior,
    TDL=todolist,
    Reference="C:\05_Works\003_软件开发\230828_Behaviour_Simulator\231010_BSim\BSim\bin\Release\net48\BSim.dll")  # -> IPerson; inputs ID: String, Locate: Point3d, RSize: Double, Strengh: Double, VLength: Double, VAngle: Double, BE: list, TDL: list
# ---------- a_iperson: C# ----------
    List<Behavior> Behaves = BE.Select(p => p as Behavior).ToList();
    List<string> ToDoList = TDL.Select(p => (string) p).ToList();

    Person P = new Person(ID, Locate, RSize, Strengh, VLength, VAngle, (Behavior) IWalk, Behaves, ToDoList);
    P.Meta = (Metabolism) Meta;
    IPerson = P;
# ---------- end a_iperson ----------

record_path_net = CSharpScript(
    Run=Button(),
    PathNet=crv_11,
    Reference=["C:\Program Files\Rhino 7\Plug-ins\Grasshopper\Components\KangarooSolver.dll", "C:\05_Works\003_软件开发\230828_Behaviour_Simulator\231010_BSim\BSim\bin\Release\net48\BSim.dll"])  # -> Ns; inputs Run: Boolean, PathNet: list of Line
# ---------- record_path_net: C# usings ----------
using System.Linq;
using BSim;
using System.Diagnostics;
using System.IO;
using Path=BSim.PathNet;
using System.Windows.Forms;
# ---------- record_path_net: C# ----------
    if(Run)
    {
      SaveFileDialog saveFileDialog = new SaveFileDialog();
      saveFileDialog.Filter = "CSV files (*.csv)|*.csv";
      saveFileDialog.Title = "Setting Data";
      saveFileDialog.RestoreDirectory = true;

      if (saveFileDialog.ShowDialog() == DialogResult.OK)
      {
        Path.ShortPathGraph Graph = Path.PathNetWork(PathNet, tol, out Nodes);
        report = "";
        Record_path = new List<List<List<int>>>();

        //Load the Environment;
        W = new MiniWatch();

        for(int i = 0;i < Nodes.Count;i++)
        {
          Record_path.Add(Graph.Dijkstra_Record(i));
        }

        W.Record("Dijkstra");

        ExportToCSV(saveFileDialog.FileName, Record_path);

        report = W.GetTime();
      }
    }
    Component.Message = report;
    Ns = Nodes;
# ---------- record_path_net: C# additional code ----------
  double tol = 0.001;
  MiniWatch W;
  List<List<List<int>>> Record_path;
  List<Point3d> Nodes;
  string report = "";

  private void ExportToCSV(string path, List<List<List<int>>> data)
  {
    using (StreamWriter writer = new StreamWriter(path))
    {
      foreach (List<List<int>> sublist in data)
      {
        var row = string.Join(";", sublist.Select(innerList => string.Join(",", innerList)));
        writer.WriteLine(row);
      }
    }
  }

  private List<List<List<int>>> ImportFromCSV(string path)
  {
    List<List<List<int>>> data = new List<List<List<int>>>();

    using (StreamReader reader = new StreamReader(path))
    {
      while (!reader.EndOfStream)
      {
        string line = reader.ReadLine();
        var sublist = line.Split(';')
          .Select(segment => segment.Split(',')
          .Select(int.Parse)
          .ToList())
          .ToList();

        data.Add(sublist);
      }
    }

    return data;
  }
# ---------- end record_path_net ----------

# ----
# ISpace
# IPerson
# Behave Mode
# IEvents
group_2 = CSharpScript(pts=event_locate_01_3)  # -> out, T; inputs pts: list of Point3d; same code as group
avr_2 = Average(Input=group_2.T)  # -> flatten(ArithmeticMean)
ibehavior_2 = CSharpScript(Reference=["C:\05_Works\003_软件开发\230828_Behaviour_Simulator\231010_BSim\BSim\bin\Release\net48\BSim.dll", "C:\05_Works\003_软件开发\230828_Behaviour_Simulator\231010_BSim\BSim\bin\Release\net48\KangarooSolver.dll"])  # -> BE; same code as ibehavior
e_ievent_untrapped_2 = CSharpScript(
    Duplicate=Slider(10, range=0..10),
    Reference="C:\05_Works\003_软件开发\230828_Behaviour_Simulator\231010_BSim\BSim\bin\Release\net48\BSim.dll")  # -> out, IE; inputs Duplicate: Int32; same code as e_ievent_untrapped

series_2 = Series(Start=0, Step=1, Count=agent_count_3)
multiplication_2 = Multiplication(A=series_2, B=emerge_gap_3)
metabolism_2 = CSharpScript(
    Iteration=multiplication_2,
    Reference="C:\05_Works\003_软件开发\230828_Behaviour_Simulator\231010_BSim\BSim\bin\Release\net48\BSim.dll")  # -> Meta; inputs Iteration: Int32; same code as metabolism
makemove_2 = CSharpScript(Reference="C:\05_Works\003_软件开发\230828_Behaviour_Simulator\231010_BSim\BSim\bin\Release\net48\BSim.dll")  # -> IWalk; same code as makemove
todolist_2 = CSharpScript(Reference="C:\05_Works\003_软件开发\230828_Behaviour_Simulator\231010_BSim\BSim\bin\Release\net48\BSim.dll")  # -> TDL; same code as todolist
concat_2 = Concatenate(FragmentA="Robot_", FragmentB=series_2)
pt_14 = Point(birth_locate_3)
a_iperson_2 = CSharpScript(
    ID=concat_2,
    Locate=pt_14,
    RSize=Slider(0.3, range=0..1),
    Strengh=Slider(2, range=0..10),
    VLength=Slider(10, range=0..10),
    VAngle=Slider(1.2, range=0..10),
    IWalk=makemove_2,
    Meta=metabolism_2,
    BE=ibehavior_2,
    TDL=todolist_2,
    Reference="C:\05_Works\003_软件开发\230828_Behaviour_Simulator\231010_BSim\BSim\bin\Release\net48\BSim.dll")  # -> IPerson; inputs ID: String, Locate: Point3d, RSize: Double, Strengh: Double, VLength: Double, VAngle: Double, BE: list, TDL: list; same code as a_iperson

# ----
# ISpace
# IPerson
# Behave Mode
# IEvents
group_3 = CSharpScript(pts=event_locate_01_2)  # -> out, T; inputs pts: list of Point3d; same code as group
avr_3 = Average(Input=group_3.T)  # -> flatten(ArithmeticMean)
ibehavior_3 = CSharpScript(Reference=["C:\05_Works\003_软件开发\230828_Behaviour_Simulator\231010_BSim\BSim\bin\Release\net48\BSim.dll", "C:\05_Works\003_软件开发\230828_Behaviour_Simulator\231010_BSim\BSim\bin\Release\net48\KangarooSolver.dll"])  # -> BE; same code as ibehavior
e_ievent_untrapped_3 = CSharpScript(
    Duplicate=Slider(10, range=0..10),
    Reference="C:\05_Works\003_软件开发\230828_Behaviour_Simulator\231010_BSim\BSim\bin\Release\net48\BSim.dll")  # -> out, IE; inputs Duplicate: Int32; same code as e_ievent_untrapped

record_path_net_2 = CSharpScript(
    Run=Button(),
    PathNet=crv_13,
    Reference=["C:\Program Files\Rhino 7\Plug-ins\Grasshopper\Components\KangarooSolver.dll", "C:\05_Works\003_软件开发\230828_Behaviour_Simulator\231010_BSim\BSim\bin\Release\net48\BSim.dll"])  # -> Ns; inputs Run: Boolean, PathNet: list of Line; same code as record_path_net

series_3 = Series(Start=0, Step=1, Count=agent_count_2)
multiplication_3 = Multiplication(A=series_3, B=emerge_gap_2)
metabolism_3 = CSharpScript(
    Iteration=multiplication_3,
    Reference="C:\05_Works\003_软件开发\230828_Behaviour_Simulator\231010_BSim\BSim\bin\Release\net48\BSim.dll")  # -> Meta; inputs Iteration: Int32; same code as metabolism
makemove_3 = CSharpScript(Reference="C:\05_Works\003_软件开发\230828_Behaviour_Simulator\231010_BSim\BSim\bin\Release\net48\BSim.dll")  # -> IWalk; same code as makemove
todolist_3 = CSharpScript(Reference="C:\05_Works\003_软件开发\230828_Behaviour_Simulator\231010_BSim\BSim\bin\Release\net48\BSim.dll")  # -> TDL; same code as todolist
concat_3 = Concatenate(FragmentA="Robot_", FragmentB=series_3)
pt_15 = Point(birth_locate_2)
a_iperson_3 = CSharpScript(
    ID=concat_3,
    Locate=pt_15,
    RSize=Slider(0.3, range=0..1),
    Strengh=Slider(2, range=0..10),
    VLength=Slider(10, range=0..10),
    VAngle=Slider(1.2, range=0..10),
    IWalk=makemove_3,
    Meta=metabolism_3,
    BE=ibehavior_3,
    TDL=todolist_3,
    Reference="C:\05_Works\003_软件开发\230828_Behaviour_Simulator\231010_BSim\BSim\bin\Release\net48\BSim.dll")  # -> IPerson; inputs ID: String, Locate: Point3d, RSize: Double, Strengh: Double, VLength: Double, VAngle: Double, BE: list, TDL: list; same code as a_iperson

# ----
# ISpace
# IPerson
# Behave Mode
# IEvents
group_4 = CSharpScript(pts=event_locate_01_4)  # -> out, T; inputs pts: list of Point3d; same code as group
avr_4 = Average(Input=group_4.T)  # -> flatten(ArithmeticMean)
ibehavior_4 = CSharpScript(Reference=["C:\05_Works\003_软件开发\230828_Behaviour_Simulator\231010_BSim\BSim\bin\Release\net48\BSim.dll", "C:\05_Works\003_软件开发\230828_Behaviour_Simulator\231010_BSim\BSim\bin\Release\net48\KangarooSolver.dll"])  # -> BE; same code as ibehavior
e_ievent_untrapped_4 = CSharpScript(
    Duplicate=Slider(10, range=0..10),
    Reference="C:\05_Works\003_软件开发\230828_Behaviour_Simulator\231010_BSim\BSim\bin\Release\net48\BSim.dll")  # -> out, IE; inputs Duplicate: Int32; same code as e_ievent_untrapped

series_4 = Series(Start=0, Step=1, Count=agent_count_4)
multiplication_4 = Multiplication(A=series_4, B=emerge_gap_4)
metabolism_4 = CSharpScript(
    Iteration=multiplication_4,
    Reference="C:\05_Works\003_软件开发\230828_Behaviour_Simulator\231010_BSim\BSim\bin\Release\net48\BSim.dll")  # -> Meta; inputs Iteration: Int32; same code as metabolism
makemove_4 = CSharpScript(Reference="C:\05_Works\003_软件开发\230828_Behaviour_Simulator\231010_BSim\BSim\bin\Release\net48\BSim.dll")  # -> IWalk; same code as makemove
todolist_4 = CSharpScript(Reference="C:\05_Works\003_软件开发\230828_Behaviour_Simulator\231010_BSim\BSim\bin\Release\net48\BSim.dll")  # -> TDL; same code as todolist
concat_4 = Concatenate(FragmentA="Robot_", FragmentB=series_4)
pt_16 = Point(birth_locate_4)
a_iperson_4 = CSharpScript(
    ID=concat_4,
    Locate=pt_16,
    RSize=Slider(0.3, range=0..1),
    Strengh=Slider(2, range=0..10),
    VLength=Slider(10, range=0..10),
    VAngle=Slider(1.2, range=0..10),
    IWalk=makemove_4,
    Meta=metabolism_4,
    BE=ibehavior_4,
    TDL=todolist_4,
    Reference="C:\05_Works\003_软件开发\230828_Behaviour_Simulator\231010_BSim\BSim\bin\Release\net48\BSim.dll")  # -> IPerson; inputs ID: String, Locate: Point3d, RSize: Double, Strengh: Double, VLength: Double, VAngle: Double, BE: list, TDL: list; same code as a_iperson

record_path_net_3 = CSharpScript(
    Run=Button(),
    PathNet=crv_17,
    Reference=["C:\Program Files\Rhino 7\Plug-ins\Grasshopper\Components\KangarooSolver.dll", "C:\05_Works\003_软件开发\230828_Behaviour_Simulator\231010_BSim\BSim\bin\Release\net48\BSim.dll"])  # -> Ns; inputs Run: Boolean, PathNet: list of Line; same code as record_path_net

pt_17 = Point(avr)
lng = ListLength(List=pt_17)
series_5 = Series(Start=0, Step=1, Count=lng)
concat_5 = Concatenate(FragmentA="Exhibit_", FragmentB=series_5)
e_ievent_m_vs_as_st = CSharpScript(
    ID=graft(concat_5),
    Locate=graft(pt_17),
    SubPoints=group.T,
    TimeCons=Slider(150, range=0..1000),
    ActDis=Slider(0.05, range=0..1),
    Reference="C:\05_Works\003_软件开发\230828_Behaviour_Simulator\231010_BSim\BSim\bin\Release\net48\BSim.dll")  # -> out, flatten(IE); inputs ID: String, Locate: Point3d, SubPoints: list of Point3d, TimeCons: Int32, ActDis: Double
# ---------- e_ievent_m_vs_as_st: C# ----------
    IE = new IEvent_M_vS_aS_St(ID, Locate, TimeCons, ActDis, SubPoints, "WatchDisPlay");
# ---------- end e_ievent_m_vs_as_st ----------

pt_18 = Point(avr_2)
lng_2 = ListLength(List=pt_18)
series_6 = Series(Start=0, Step=1, Count=lng_2)
concat_6 = Concatenate(FragmentA="Exhibit_", FragmentB=series_6)
e_ievent_m_vs_as_st_2 = CSharpScript(
    ID=graft(concat_6),
    Locate=graft(pt_18),
    SubPoints=group_2.T,
    TimeCons=Slider(150, range=0..1000),
    ActDis=Slider(0.05, range=0..1),
    Reference="C:\05_Works\003_软件开发\230828_Behaviour_Simulator\231010_BSim\BSim\bin\Release\net48\BSim.dll")  # -> out, flatten(IE); inputs ID: String, Locate: Point3d, SubPoints: list of Point3d, TimeCons: Int32, ActDis: Double; same code as e_ievent_m_vs_as_st

pt_19 = Point(avr_3)
lng_3 = ListLength(List=pt_19)
series_7 = Series(Start=0, Step=1, Count=lng_3)
concat_7 = Concatenate(FragmentA="Exhibit_", FragmentB=series_7)
e_ievent_m_vs_as_st_3 = CSharpScript(
    ID=graft(concat_7),
    Locate=graft(pt_19),
    SubPoints=group_3.T,
    TimeCons=Slider(150, range=0..1000),
    ActDis=Slider(0.05, range=0..1),
    Reference="C:\05_Works\003_软件开发\230828_Behaviour_Simulator\231010_BSim\BSim\bin\Release\net48\BSim.dll")  # -> out, flatten(IE); inputs ID: String, Locate: Point3d, SubPoints: list of Point3d, TimeCons: Int32, ActDis: Double; same code as e_ievent_m_vs_as_st

pt_20 = Point(avr_4)
lng_4 = ListLength(List=pt_20)
series_8 = Series(Start=0, Step=1, Count=lng_4)
concat_8 = Concatenate(FragmentA="Exhibit_", FragmentB=series_8)
e_ievent_m_vs_as_st_4 = CSharpScript(
    ID=graft(concat_8),
    Locate=graft(pt_20),
    SubPoints=group_4.T,
    TimeCons=Slider(150, range=0..1000),
    ActDis=Slider(0.05, range=0..1),
    Reference="C:\05_Works\003_软件开发\230828_Behaviour_Simulator\231010_BSim\BSim\bin\Release\net48\BSim.dll")  # -> out, flatten(IE); inputs ID: String, Locate: Point3d, SubPoints: list of Point3d, TimeCons: Int32, ActDis: Double; same code as e_ievent_m_vs_as_st

record_path_net_4 = CSharpScript(
    Run=Button(),
    PathNet=crv_15,
    Reference=["C:\Program Files\Rhino 7\Plug-ins\Grasshopper\Components\KangarooSolver.dll", "C:\05_Works\003_软件开发\230828_Behaviour_Simulator\231010_BSim\BSim\bin\Release\net48\BSim.dll"])  # -> Ns; inputs Run: Boolean, PathNet: list of Line; same code as record_path_net

pt_21 = Point(exsit_locate)
e_ievent_exit = CSharpScript(
    ID="Exsit",
    Locate=pt_21,
    ActDis=Slider(0.3, range=0..1),
    Reference="C:\05_Works\003_软件开发\230828_Behaviour_Simulator\231010_BSim\BSim\bin\Release\net48\BSim.dll")  # -> out, IE; inputs ID: String, Locate: Point3d, ActDis: Double
# ---------- e_ievent_exit: C# ----------
    IE = new IEvent_Exit(ID, Locate, ActDis);
# ---------- end e_ievent_exit ----------

pt_22 = Point(exsit_locate_3)
e_ievent_exit_2 = CSharpScript(
    ID="Exsit",
    Locate=pt_22,
    ActDis=Slider(0.3, range=0..1),
    Reference="C:\05_Works\003_软件开发\230828_Behaviour_Simulator\231010_BSim\BSim\bin\Release\net48\BSim.dll")  # -> out, IE; inputs ID: String, Locate: Point3d, ActDis: Double; same code as e_ievent_exit

pt_23 = Point(exsit_locate_2)
e_ievent_exit_3 = CSharpScript(
    ID="Exsit",
    Locate=pt_23,
    ActDis=Slider(0.3, range=0..1),
    Reference="C:\05_Works\003_软件开发\230828_Behaviour_Simulator\231010_BSim\BSim\bin\Release\net48\BSim.dll")  # -> out, IE; inputs ID: String, Locate: Point3d, ActDis: Double; same code as e_ievent_exit

pt_24 = Point(exsit_locate_4)
e_ievent_exit_4 = CSharpScript(
    ID="Exsit",
    Locate=pt_24,
    ActDis=Slider(0.3, range=0..1),
    Reference="C:\05_Works\003_软件开发\230828_Behaviour_Simulator\231010_BSim\BSim\bin\Release\net48\BSim.dll")  # -> out, IE; inputs ID: String, Locate: Point3d, ActDis: Double; same code as e_ievent_exit

# ----
# IComunication
c_icommunicate = CSharpScript(Reference=["C:\05_Works\003_软件开发\230828_Behaviour_Simulator\231010_BSim\BSim\bin\Release\net48\BSim.dll", "C:\Program Files\Rhino 7\Plug-ins\Grasshopper\Components\KangarooSolver.dll"])  # -> C
# ---------- c_icommunicate: C# ----------
    List<Communicate> PP_Commun = new List<Communicate>()
      {
        new ICom_Avoid(1.05, 2),
        new ICom_Talk(0.5, 30, 5, 1)
        };

    C = PP_Commun;
# ---------- c_icommunicate: C# additional code ----------
  public class ICom_Talk_: Communicate
  {
    double Distance;
    int talkTime;

    public ICom_Talk_(double Distance, int talkTime)
    {
      this.Distance = Distance;
      this.talkTime = talkTime;
    }

    public override List<IGoal> Interact(ABM EN, Person P0, Person P1)
    {
      int max = 5;

      List<IGoal> goals = new List<IGoal>(0);

      bool feasible = false;

      if (P0.State == Person_state.Walk && P1.State == Person_state.Walk)
      {
        feasible = true;
      }

      if (!feasible) { return goals; }

      double Dis = P0.SizeR + P1.SizeR + Distance;
      if (P0.Locate.DistanceTo(P1.Locate) < Dis && feasible)
      {
        //Did not talked before;
        List<BSim.Person.Memory> P0_talked = P0.Brain.Where(p => p.Event.IsType("Talk")).ToList();
        List<BSim.Person.Memory> P1_talked = P1.Brain.Where(p => p.Event.IsType("Talk")).ToList();

        if (P0_talked.Count < max && P1_talked.Count < max)
        {
          int seed = EN.Iteration;
          seed += EN.PPs.IndexOf(P0);

          Random rd = new Random(seed);
          int num = rd.Next(0, 100);

          if (num == 5)
          {
            if (P0.Target != null)
            {
              P0.ToDoList.Insert(0, P0.Target.Type.Name);
              P0.Target.Expire(P0);
            }

            P0.Target = new IEvent_Talk("Talk", P1, Dis);
            P0.State = Person_state.Talk;
            P0.Brain.Add(new Person.Memory(P0.Target, talkTime));
            P0.Path = new List<Point3d>();

            if (P1.Target != null)
            {
              P1.ToDoList.Insert(0, P1.Target.Type.Name);
              P1.Target.Expire(P1);
            }

            P1.Target = new IEvent_Talk("Talk", P0, Dis);
            P1.State = Person_state.Talk;
            P1.Brain.Add(new Person.Memory(P1.Target, talkTime));
            P1.Path = new List<Point3d>();
          }
        }
      }


      IEvent_Talk P0_t = P0.Target as IEvent_Talk;
      IEvent_Talk P1_t = P1.Target as IEvent_Talk;

      if (P0_t != null && P1_t != null)
      {
        if (P0_t.PP.Name == P1.Name && P1_t.PP.Name == P0.Name)
        {
          if (P0.Brain[P0.Brain.Count - 1].Step > P1.Brain[P1.Brain.Count - 1].Step)
          {
            P0.Brain[P0.Brain.Count - 1].Step = P1.Brain[P1.Brain.Count - 1].Step;
          }
          else
          {
            P1.Brain[P1.Brain.Count - 1].Step = P0.Brain[P0.Brain.Count - 1].Step;
          }
        }
      }

      return goals;
    }
  }
# ---------- end c_icommunicate ----------

# ----
# IComunication
c_icommunicate_2 = CSharpScript(Reference=["C:\05_Works\003_软件开发\230828_Behaviour_Simulator\231010_BSim\BSim\bin\Release\net48\BSim.dll", "C:\Program Files\Rhino 7\Plug-ins\Grasshopper\Components\KangarooSolver.dll"])  # -> C; same code as c_icommunicate

# ----
# IComunication
c_icommunicate_3 = CSharpScript(Reference=["C:\05_Works\003_软件开发\230828_Behaviour_Simulator\231010_BSim\BSim\bin\Release\net48\BSim.dll", "C:\Program Files\Rhino 7\Plug-ins\Grasshopper\Components\KangarooSolver.dll"])  # -> C; same code as c_icommunicate

# ----
# IComunication
c_icommunicate_4 = CSharpScript(Reference=["C:\05_Works\003_软件开发\230828_Behaviour_Simulator\231010_BSim\BSim\bin\Release\net48\BSim.dll", "C:\Program Files\Rhino 7\Plug-ins\Grasshopper\Components\KangarooSolver.dll"])  # -> C; same code as c_icommunicate

# ----
# Path NetWork
number_slider = Slider(0.25, range=0..5)
R = Slider(0.2, range=0..5)
roomobs = Curve(_01_room_obs_2)
bounding = Curve(<curve referenced from the Rhino model>)
boundary_2 = BoundarySurfaces(Edges=bounding)
triremesh = TriRemesh(Geometry=boundary_2, Length=number_slider, Iterations=25)  # -> Triangulation, Dual, Creases
offset = OffsetCurve(Curve=roomobs, Distance=R, Corners=1)  # -> flatten(Curve)
wbvertices = WeaverbirdsVerticesComponent(MeshClosedPolylinesGroup=triremesh.Triangulation, Weld=True)
incurves = PointInCurves(Point=wbvertices, Curves=offset)  # -> Relationship, Index, Point
equals = Equality(FirstNumber=incurves.Relationship, SecondNumber=0)  # -> Equality, Inequality
dispatch = Dispatch(List=wbvertices, DispatchPattern=equals.Equality)  # -> ListA, ListB
pt_25 = Point(dispatch.ListA)
con = DelaunayEdges(Points=pt_25, Plane=PlaneXY(0, 0, 0))  # -> Connectivity, Edges
len = Length(Curve=con.Edges)
smaller = SmallerThan(FirstNumber=len, SecondNumber=Slider(0.3, range=0..10))  # -> SmallerThan, OrEqualTo
dispatch_2 = Dispatch(List=con.Edges, DispatchPattern=smaller.SmallerThan)  # -> ListA, ListB
crv_18 = Curve(dispatch_2.ListA)

# ----
# ABM Model
# Simulation
abm_model = CSharpScript(
    S=flatten(s_ispace.SP),
    A=flatten(a_iperson),
    C=flatten(c_icommunicate),
    E=flatten([e_ievent_exit.IE, e_ievent_untrapped.IE, e_ievent_m_vs_as_st.IE]),
    Reference="C:\05_Works\003_软件开发\230828_Behaviour_Simulator\231010_BSim\BSim\bin\Release\net48\BSim.dll")  # -> Model; inputs S: list, A: list, C: list, E: list
# ---------- abm_model: C# ----------
    List<ISpace> ISpaces = S.Select(p => (ISpace) p).ToList();
    List<Person> Persons = A.Select(p => (Person) p).ToList();
    List<Communicate> Communis = C.Select(p => (Communicate) p).ToList();
    List<Event> Events = E.Select(p => (Event) p).ToList();

    ABM AgentBasedModel = new ABM(ISpaces[0], Events, Persons, Communis);

    Model = AgentBasedModel;
# ---------- end abm_model ----------
trigger = Trigger(Interval=10, TimerInterval=10, Target=simulation)  # disabled
simulation = CSharpScript(
    Model=abm_model,
    Reset=Button(),
    Reference="C:\05_Works\003_软件开发\230828_Behaviour_Simulator\231010_BSim\BSim\bin\Release\net48\BSim.dll")  # -> out, M; inputs Reset: Boolean
# ---------- simulation: C# usings ----------
using BSim;

using System.Windows.Forms;

using System.Linq;

using System.IO;
using System.Runtime.Serialization;
using System.Runtime.Serialization.Formatters.Binary;
# ---------- simulation: C# ----------
    string timeRep = "";

    if(Reset)
    {
      ABM_simu = (ABM) Model;
    }

    if(ABM_simu != null)
    {
      try{
        ABM_simu.Simulate(Reset, out timeRep);
      }
      catch (Exception e)
      {
        Print(e.ToString());
      }
      Print(ABM_simu.PS.iteration.ToString());
    }

    Component.Message = timeRep;
    M = ABM_simu;
# ---------- simulation: C# additional code ----------
  ABM ABM_simu;
# ---------- end simulation ----------

# ----
# ABM Model
# Simulation
abm_model_2 = CSharpScript(
    S=flatten(s_ispace_3.SP),
    A=flatten(a_iperson_3),
    C=flatten(c_icommunicate_3),
    E=flatten([e_ievent_exit_3.IE, e_ievent_untrapped_3.IE, e_ievent_m_vs_as_st_3.IE]),
    Reference="C:\05_Works\003_软件开发\230828_Behaviour_Simulator\231010_BSim\BSim\bin\Release\net48\BSim.dll")  # -> Model; inputs S: list, A: list, C: list, E: list; same code as abm_model
trigger_2 = Trigger(Interval=10, TimerInterval=10, Target=simulation_2)  # disabled
simulation_2 = CSharpScript(
    Model=abm_model_2,
    Reset=Button(),
    Reference="C:\05_Works\003_软件开发\230828_Behaviour_Simulator\231010_BSim\BSim\bin\Release\net48\BSim.dll")  # -> out, M; inputs Reset: Boolean; same code as simulation

# ----
# ABM Model
# Simulation
abm_model_3 = CSharpScript(
    S=flatten(s_ispace_2.SP),
    A=flatten(a_iperson_2),
    C=flatten(c_icommunicate_2),
    E=flatten([e_ievent_exit_2.IE, e_ievent_untrapped_2.IE, e_ievent_m_vs_as_st_2.IE]),
    Reference="C:\05_Works\003_软件开发\230828_Behaviour_Simulator\231010_BSim\BSim\bin\Release\net48\BSim.dll")  # -> Model; inputs S: list, A: list, C: list, E: list; same code as abm_model
trigger_3 = Trigger(Interval=10, TimerInterval=10, Target=simulation_3)  # disabled
simulation_3 = CSharpScript(
    Model=abm_model_3,
    Reset=Button(),
    Reference="C:\05_Works\003_软件开发\230828_Behaviour_Simulator\231010_BSim\BSim\bin\Release\net48\BSim.dll")  # -> out, M; inputs Reset: Boolean; same code as simulation

# ----
# ABM Model
# Simulation
abm_model_4 = CSharpScript(
    S=flatten(s_ispace_4.SP),
    A=flatten(a_iperson_4),
    C=flatten(c_icommunicate_4),
    E=flatten([e_ievent_exit_4.IE, e_ievent_untrapped_4.IE, e_ievent_m_vs_as_st_4.IE]),
    Reference="C:\05_Works\003_软件开发\230828_Behaviour_Simulator\231010_BSim\BSim\bin\Release\net48\BSim.dll")  # -> Model; inputs S: list, A: list, C: list, E: list; same code as abm_model
trigger_4 = Trigger(Interval=10, TimerInterval=10, Target=simulation_4)  # disabled
simulation_4 = CSharpScript(
    Model=abm_model_4,
    Reset=Button(),
    Reference="C:\05_Works\003_软件开发\230828_Behaviour_Simulator\231010_BSim\BSim\bin\Release\net48\BSim.dll")  # -> out, M; inputs Reset: Boolean; same code as simulation

panel_5 = Panel(simulation.out)

showminitarget = CSharpScript(M=simulation.M, Reference="C:\05_Works\003_软件开发\230828_Behaviour_Simulator\231010_BSim\BSim\bin\Release\net48\BSim.dll")  # -> out, Views, Detect, Trajs, TraPts
# ---------- showminitarget: C# usings ----------
using System.Linq;
using BSim;

using System.Diagnostics;
using System.Windows.Forms;
# ---------- showminitarget: C# ----------
    List<Line> PointTo = new List<Line>();
    List<Point3d> TPts = new List<Point3d>();
    List<Line> PlCv = new List<Line>();
    List<Line> ViewLn = new List<Line>();
    DataTree<Point3d> Paths = new DataTree<Point3d>();

    ABM ABM = M as ABM;
    int k = 0;
    foreach(Person doc in ABM.PPs)
    {
      //PointTo.Add(new Line(doc.Locate, TargetPt(doc)));
      TPts.Add(TargetPt(doc));

      PlCv.AddRange(WayPath(doc.Path));

      Paths.AddRange(doc.Path, new GH_Path(k));

      ViewLn.Add(Viewline(doc));

      Point3d? CPt = ABM.Space.Obs_ClosetPt(doc.Locate, doc.SizeR * 1.005);
      if(CPt != null){PointTo.Add(new Line(doc.Locate, (Point3d) CPt));}

      k++;
    }

    Print(ABM.debug);
    Views = ViewLn;
    Detect = PointTo;
    Trajs = PlCv;
    TraPts = Paths;
# ---------- showminitarget: C# additional code ----------
  public Line Viewline(Person P)
  {
    Line ln = new Line(P.Locate, P.Locate);
    if(P.Path.Count > 0)
    {
      ln = new Line(P.Locate, P.Path[P.step]);
    }

    return ln;
  }

  public List<Line> WayPath(List<Point3d>P)
  {
    List<Line> ln = new List<Line>();
    if(P.Count > 1)
    {
      for(int i = 0;i < P.Count - 1;i++)
      {ln.Add(new Line(P[i], P[i + 1]));}
    }

    return ln;
  }

  public Point3d TargetPt(Person P)
  {
    if(P.Path.Count > 0)
    {
      return P.Path[P.Path.Count - 1];
    }
    else
    {
      return P.Locate;
    }
  }
# ---------- end showminitarget ----------
crv_19 = Curve(showminitarget.Views)
crv_20 = Curve(showminitarget.Trajs)
pt_26 = Point(showminitarget.TraPts)  # disabled
path = CSharpScript(M=pt_26, Reference="C:\05_Works\003_软件开发\230828_Behaviour_Simulator\231010_BSim\BSim\bin\Release\net48\BSim.dll")  # -> out, TraPts, MinLen; inputs M: list of Point3d; disabled
# ---------- path: C# ----------
    List<Line> lns = WayPath(Smooth(Smooth(Smooth(M, 0.5), 0.5),0.5));
    lns.Sort((a,b) => a.Length.CompareTo(b.Length));
    TraPts = lns;
    MinLen = lns[0];
# ---------- path: C# additional code ----------
  private static List<Point3d> Smooth(List<Point3d> Pts, double t)
  {
    List<Vector3d> vecs = new List<Vector3d>(Pts.Count - 1);
    List<double> score = new List<double>(Pts.Count - 2);

    for (int i = 0; i < Pts.Count - 1; i++)
    {
      vecs.Add(new Vector3d(Pts[i + 1] - Pts[i]));
    }

    for (int i = 0; i < vecs.Count - 1; i++)
    {
      double angle = Math.Acos(vecs[i] * vecs[i + 1] / (vecs[i].Length * vecs[i + 1].Length));
      score.Add(angle / (vecs[i].Length + vecs[i + 1].Length));
    }


    double score_ave = 0.0;
    foreach (double s in score) { if (s > 0) { score_ave += s; } }
    score_ave /= score.Count;

    List<Point3d> keyPts = new List<Point3d>() { Pts[0] };

    for (int i = 0; i < score.Count; i++)
    {
      if (score[i] > score_ave * t) { keyPts.Add(Pts[i + 1]); }
    }

    keyPts.Add(Pts[Pts.Count - 1]);
    return keyPts;
  }

  public List<Line> WayPath(List<Point3d>P)
  {
    List<Line> ln = new List<Line>();
    if(P.Count > 1)
    {
      for(int i = 0;i < P.Count - 1;i++)
      {ln.Add(new Line(P[i], P[i + 1]));}
    }

    return ln;
  }
# ---------- end path ----------
crv_21 = Curve(path.TraPts)  # disabled
crv_22 = Curve(path.MinLen)  # disabled

result_display = CSharpScript(
    Model=simulation.M,
    Reference="C:\05_Works\003_软件开发\230828_Behaviour_Simulator\231010_BSim\BSim\bin\Release\net48\BSim.dll")  # -> out, A, M
# ---------- result_display: C# usings ----------
using BSim;

using System.Windows.Forms;

using System.Linq;
using System.Drawing;
# ---------- result_display: C# ----------
    ABM ABM = (ABM) Model;
    Person_Body = ABM.PPs.Select(p => p.Body).ToList();
    Person_Text = ABM.PPs.Select(p => p.State.ToString()).ToList();
    Person_Bar = ABM.PPs.Select(p => ProgressBar(p)).ToList();
    Person_Locate = ABM.PPs.Select(p => p.Locate + new Vector3d(0, -p.SizeR * 0.25, 0) + new Vector3d(-p.SizeR * 0.5, 0, 0)).ToList();


    foreach(Person P in ABM.PPs)
    {
      Print(P.Name);
      Print(P.State.ToString());
      Print(P.NextToDo);
      Print("_____________");
    }
    M = ABM.PPs;
# ---------- result_display: C# additional code ----------
  List<Point3d>Person_Locate = new List<Point3d>();
  List<Curve>Person_Body = new List<Curve>();
  List<string>Person_Text = new List<string>();
  List<List<Point3d>>Person_Bar = new List<List<Point3d>>();

  public List<Point3d> ProgressBar(Person P)
  {
    if(P.Brain.Count > 0)
    {
      double percent = (double) P.Brain[P.Brain.Count - 1].Step / (double) P.Brain[P.Brain.Count - 1].MaxStep;
      Point3d basePt = new Point3d(P.Locate); basePt.Y += P.SizeR * 1.3;
      Point3d P0 = basePt - new Vector3d(P.SizeR, 0, 0) * percent + new Vector3d(0, 0.02, 0);
      Point3d P1 = basePt - new Vector3d(P.SizeR, 0, 0) * percent - new Vector3d(0, 0.02, 0);
      Point3d P2 = basePt + new Vector3d(P.SizeR, 0, 0) * percent - new Vector3d(0, 0.02, 0);
      Point3d P3 = basePt + new Vector3d(P.SizeR, 0, 0) * percent + new Vector3d(0, 0.02, 0);

      if(percent == 1){return new List <Point3d>();}
      List <Point3d> polygon = new List<Point3d>(){P0,P1,P2,P3,P0};
      return polygon;
    }
    else
    {
      return new List <Point3d>(){};
    }
  }

  public override void DrawViewportWires(IGH_PreviewArgs args)
  {
    Plane pl0_Plane;
    args.Viewport.GetFrustumFarPlane(out pl0_Plane);
    Rhino.Display.Text3d drawText = null;  // Initialize to null

    for (int i = 0; i < Person_Bar.Count; i++)
    {
      pl0_Plane.Origin = Person_Locate[i];

      //args.Display.DrawCurve(new PolylineCurve(Person_Bar[i]), Color.Black, 2);
      args.Display.DrawPolygon(Person_Bar[i], Color.Gray, true);
      args.Display.DrawCurve(Person_Body[i], Color.Black, 2);

      drawText = new Rhino.Display.Text3d(Person_Text[i], pl0_Plane, 0.1);
      args.Display.Draw3dText(drawText, Color.Black);
    }

    if(drawText != null)
    {drawText.Dispose();}

  }
# ---------- end result_display ----------
panel_6 = Panel(simulation_2.out)
panel_7 = Panel(simulation_3.out)

showminitarget_2 = CSharpScript(
    M=simulation_2.M,
    Reference="C:\05_Works\003_软件开发\230828_Behaviour_Simulator\231010_BSim\BSim\bin\Release\net48\BSim.dll")  # -> out, Views, Detect, Trajs, TraPts; same code as showminitarget
crv_23 = Curve(showminitarget_2.Views)
crv_24 = Curve(showminitarget_2.Trajs)
pt_27 = Point(showminitarget_2.TraPts)  # disabled
path_2 = CSharpScript(M=pt_27, Reference="C:\05_Works\003_软件开发\230828_Behaviour_Simulator\231010_BSim\BSim\bin\Release\net48\BSim.dll")  # -> out, TraPts, MinLen; inputs M: list of Point3d; disabled; same code as path
crv_25 = Curve(path_2.TraPts)  # disabled
crv_26 = Curve(path_2.MinLen)  # disabled

result_display_2 = CSharpScript(
    Model=simulation_2.M,
    Reference="C:\05_Works\003_软件开发\230828_Behaviour_Simulator\231010_BSim\BSim\bin\Release\net48\BSim.dll")  # -> out, A, M; same code as result_display

showminitarget_3 = CSharpScript(
    M=simulation_3.M,
    Reference="C:\05_Works\003_软件开发\230828_Behaviour_Simulator\231010_BSim\BSim\bin\Release\net48\BSim.dll")  # -> out, Views, Detect, Trajs, TraPts; same code as showminitarget
crv_27 = Curve(showminitarget_3.Views)
crv_28 = Curve(showminitarget_3.Trajs)
pt_28 = Point(showminitarget_3.TraPts)  # disabled
path_3 = CSharpScript(M=pt_28, Reference="C:\05_Works\003_软件开发\230828_Behaviour_Simulator\231010_BSim\BSim\bin\Release\net48\BSim.dll")  # -> out, TraPts, MinLen; inputs M: list of Point3d; disabled; same code as path
crv_29 = Curve(path_3.TraPts)  # disabled
crv_30 = Curve(path_3.MinLen)  # disabled

result_display_3 = CSharpScript(
    Model=simulation_3.M,
    Reference="C:\05_Works\003_软件开发\230828_Behaviour_Simulator\231010_BSim\BSim\bin\Release\net48\BSim.dll")  # -> out, A, M; same code as result_display
panel_8 = Panel(simulation_4.out)

showminitarget_4 = CSharpScript(
    M=simulation_4.M,
    Reference="C:\05_Works\003_软件开发\230828_Behaviour_Simulator\231010_BSim\BSim\bin\Release\net48\BSim.dll")  # -> out, Views, Detect, Trajs, TraPts; same code as showminitarget
crv_31 = Curve(showminitarget_4.Views)
crv_32 = Curve(showminitarget_4.Trajs)
pt_29 = Point(showminitarget_4.TraPts)  # disabled
path_4 = CSharpScript(M=pt_29, Reference="C:\05_Works\003_软件开发\230828_Behaviour_Simulator\231010_BSim\BSim\bin\Release\net48\BSim.dll")  # -> out, TraPts, MinLen; inputs M: list of Point3d; disabled; same code as path
crv_33 = Curve(path_4.TraPts)  # disabled
crv_34 = Curve(path_4.MinLen)  # disabled

result_display_4 = CSharpScript(
    Model=simulation_4.M,
    Reference="C:\05_Works\003_软件开发\230828_Behaviour_Simulator\231010_BSim\BSim\bin\Release\net48\BSim.dll")  # -> out, A, M; same code as result_display
panel_9 = Panel(result_display.out)
panel_10 = Panel(result_display_2.out)
panel_11 = Panel(result_display_3.out)
panel_12 = Panel(result_display_4.out)
panel_13 = Panel("8266")
panel_14 = Panel("9855")
panel_15 = Panel("7988")
panel_16 = Panel("12120")

# ----
# IO
button = Button()
read_person_doc = CSharpScript(
    Run=button,
    Reference=["C:\Program Files\Rhino 7\Plug-ins\Grasshopper\Components\KangarooSolver.dll", "C:\05_Works\003_软件开发\230828_Behaviour_Simulator\231010_BSim\BSim\bin\Release\net48\BSim.dll"])  # -> Doc; inputs Run: Boolean
# ---------- read_person_doc: C# ----------
    if(Run)
    {
      OpenFileDialog openFileDialog = new OpenFileDialog();
      openFileDialog.Filter = "CSV files (*.csv)|*.csv";
      openFileDialog.Title = "Open Path Data";
      openFileDialog.RestoreDirectory = true;

      if (openFileDialog.ShowDialog() == DialogResult.OK)
      {
        Docs = ImportPersonDocsFromCSV(openFileDialog.FileName);
      }

    }

    Doc = Docs;
# ---------- read_person_doc: C# additional code ----------
  List<Person_Doc>Docs;
  public static void ExportPersonDocsToCSV(List<Person_Doc> personDocs, string filePath)
  {
    using (StreamWriter sw = new StreamWriter(filePath))
    {
      foreach (Person_Doc doc in personDocs)
      {
        // Write CSV Header
        sw.WriteLine("ID");
        sw.WriteLine(doc.id);
        sw.WriteLine("EventName,Duration");
        for (int i = 0; i < doc.eventName.Count; i++)
        {
          sw.WriteLine(string.Format("{0},{1}", doc.eventName[i], doc.duration[i].ToString()));
        }
        sw.WriteLine("Traj");

        for (int i = 0; i < doc.trajectory.Count; i++)
        {
          Point3d P = doc.trajectory[i];
          sw.WriteLine(string.Format("{0},{1},{2}", P.X.ToString(), P.Y.ToString(), P.Z.ToString()));
        }

      }
    }
  }

  public static List<Person_Doc> ImportPersonDocsFromCSV(string filePath)
  {
    List<Person_Doc> personDocs = new List<Person_Doc>();
    string[] lines = File.ReadAllLines(filePath);

    Person_Doc currentDoc = null;

    for (int i = 0; i < lines.Length; i++)
    {
      if (lines[i].StartsWith("ID"))
      {
        // If a new ID is found and currentDoc is not null, add it to the list
        if (currentDoc != null)
        {
          personDocs.Add(currentDoc);
        }
        // Start a new Person_Doc
        string id = lines[++i]; // Increment i to get the ID from the next line
        currentDoc = new Person_Doc(id, new List<Point3d>(), new List<string>(), new List<int>());
      }
      else if (lines[i].StartsWith("EventName"))
      {
        // Skip the header line for EventName, Duration
        continue;
      }
      else if (lines[i].StartsWith("Traj"))
      {
        // Now we expect trajectory points until the next ID or EOF
        while (++i < lines.Length && !lines[i].StartsWith("ID"))
        {
          string[] parts = lines[i].Split(',');
          double x = double.Parse(parts[0]);
          double y = double.Parse(parts[1]);
          double z = double.Parse(parts[2]);
          currentDoc.trajectory.Add(new Point3d(x, y, z));
        }
        // Decrement i because the for loop will increment it
        i--;
      }
      else
      {
        // It must be an EventName line
        string[] parts = lines[i].Split(',');
        currentDoc.eventName.Add(parts[0]);
        currentDoc.duration.Add(int.Parse(parts[1]));
      }
    }

    // Add the last doc if not null
    if (currentDoc != null)
    {
      personDocs.Add(currentDoc);
    }

    return personDocs;
  }
# ---------- end read_person_doc ----------
write_person_doc = CSharpScript(
    M=simulation.M,
    Run=Button(),
    Reference=["C:\Program Files\Rhino 7\Plug-ins\Grasshopper\Components\KangarooSolver.dll", "C:\05_Works\003_软件开发\230828_Behaviour_Simulator\231010_BSim\BSim\bin\Release\net48\BSim.dll"])  # -> Doc; inputs Run: Boolean
# ---------- write_person_doc: C# ----------
    if(Run)
    {
      SaveFileDialog saveFileDialog = new SaveFileDialog();
      saveFileDialog.Filter = "CSV files (*.csv)|*.csv";
      saveFileDialog.Title = "Setting Data";
      saveFileDialog.RestoreDirectory = true;

      if (saveFileDialog.ShowDialog() == DialogResult.OK)
      {
        ABM ABM = (ABM) M;
        ExportPersonDocsToCSV(ABM.Document, saveFileDialog.FileName);

      }
    }

    Doc = ((ABM) M).Document;
# ---------- write_person_doc: C# additional code ----------
  public static void ExportPersonDocsToCSV(List<Person_Doc> personDocs, string filePath)
  {
    using (StreamWriter sw = new StreamWriter(filePath))
    {
      foreach (Person_Doc doc in personDocs)
      {
        // Write CSV Header
        sw.WriteLine("ID");
        sw.WriteLine(doc.id);
        sw.WriteLine("EventName,Duration");
        for (int i = 0; i < doc.eventName.Count; i++)
        {
          sw.WriteLine(string.Format("{0},{1}", doc.eventName[i], doc.duration[i].ToString()));
        }
        sw.WriteLine("Traj");

        for (int i = 0; i < doc.trajectory.Count; i++)
        {
          Point3d P = doc.trajectory[i];
          sw.WriteLine(string.Format("{0},{1},{2}", P.X.ToString(), P.Y.ToString(), P.Z.ToString()));
        }

      }
    }
  }

  public static List<Person_Doc> ImportPersonDocsFromCSV(string filePath)
  {
    List<Person_Doc> personDocs = new List<Person_Doc>();
    string[] lines = File.ReadAllLines(filePath);

    Person_Doc currentDoc = null;

    for (int i = 0; i < lines.Length; i++)
    {
      if (lines[i].StartsWith("ID"))
      {
        // If a new ID is found and currentDoc is not null, add it to the list
        if (currentDoc != null)
        {
          personDocs.Add(currentDoc);
        }
        // Start a new Person_Doc
        string id = lines[++i]; // Increment i to get the ID from the next line
        currentDoc = new Person_Doc(id, new List<Point3d>(), new List<string>(), new List<int>());
      }
      else if (lines[i].StartsWith("EventName"))
      {
        // Skip the header line for EventName, Duration
        continue;
      }
      else if (lines[i].StartsWith("Traj"))
      {
        // Now we expect trajectory points until the next ID or EOF
        while (++i < lines.Length && !lines[i].StartsWith("ID"))
        {
          string[] parts = lines[i].Split(',');
          double x = double.Parse(parts[0]);
          double y = double.Parse(parts[1]);
          double z = double.Parse(parts[2]);
          currentDoc.trajectory.Add(new Point3d(x, y, z));
        }
        // Decrement i because the for loop will increment it
        i--;
      }
      else
      {
        // It must be an EventName line
        string[] parts = lines[i].Split(',');
        currentDoc.eventName.Add(parts[0]);
        currentDoc.duration.Add(int.Parse(parts[1]));
      }
    }

    // Add the last doc if not null
    if (currentDoc != null)
    {
      personDocs.Add(currentDoc);
    }

    return personDocs;
  }
# ---------- end write_person_doc ----------

# ----
# IO
button_2 = Button()
read_person_doc_2 = CSharpScript(
    Run=button_2,
    Reference=["C:\Program Files\Rhino 7\Plug-ins\Grasshopper\Components\KangarooSolver.dll", "C:\05_Works\003_软件开发\230828_Behaviour_Simulator\231010_BSim\BSim\bin\Release\net48\BSim.dll"])  # -> Doc; inputs Run: Boolean; same code as read_person_doc
write_person_doc_2 = CSharpScript(
    M=simulation_2.M,
    Run=Button(),
    Reference=["C:\Program Files\Rhino 7\Plug-ins\Grasshopper\Components\KangarooSolver.dll", "C:\05_Works\003_软件开发\230828_Behaviour_Simulator\231010_BSim\BSim\bin\Release\net48\BSim.dll"])  # -> Doc; inputs Run: Boolean; same code as write_person_doc

# ----
# IO
button_3 = Button()
read_person_doc_3 = CSharpScript(
    Run=button_3,
    Reference=["C:\Program Files\Rhino 7\Plug-ins\Grasshopper\Components\KangarooSolver.dll", "C:\05_Works\003_软件开发\230828_Behaviour_Simulator\231010_BSim\BSim\bin\Release\net48\BSim.dll"])  # -> Doc; inputs Run: Boolean; same code as read_person_doc
write_person_doc_3 = CSharpScript(
    M=simulation_3.M,
    Run=Button(),
    Reference=["C:\Program Files\Rhino 7\Plug-ins\Grasshopper\Components\KangarooSolver.dll", "C:\05_Works\003_软件开发\230828_Behaviour_Simulator\231010_BSim\BSim\bin\Release\net48\BSim.dll"])  # -> Doc; inputs Run: Boolean; same code as write_person_doc

# ----
# IO
button_4 = Button()
read_person_doc_4 = CSharpScript(
    Run=button_4,
    Reference=["C:\Program Files\Rhino 7\Plug-ins\Grasshopper\Components\KangarooSolver.dll", "C:\05_Works\003_软件开发\230828_Behaviour_Simulator\231010_BSim\BSim\bin\Release\net48\BSim.dll"])  # -> Doc; inputs Run: Boolean; same code as read_person_doc
write_person_doc_4 = CSharpScript(
    M=simulation_4.M,
    Run=Button(),
    Reference=["C:\Program Files\Rhino 7\Plug-ins\Grasshopper\Components\KangarooSolver.dll", "C:\05_Works\003_软件开发\230828_Behaviour_Simulator\231010_BSim\BSim\bin\Release\net48\BSim.dll"])  # -> Doc; inputs Run: Boolean; same code as write_person_doc

cellexclude_9 = Curve(cellexclude_5)  # disabled
cellbound_9 = Boundary(cellbound_5)  # disabled
viewobs_9 = Curve(viewobs_5)  # disabled
trees_9 = Curve(trees_5)  # disabled
W = WidthCount(w_count)  # disabled
H = HeightCount(h_count)  # disabled

cellexclude_10 = Curve(cellexclude_6)
cellbound_10 = Boundary(cellbound_6)
viewobs_10 = Curve(viewobs_6)
trees_10 = Curve(trees_6)
W_2 = WidthCount(w_count_2)
H_2 = HeightCount(h_count_2)

cellexclude_11 = Curve(cellexclude_7)  # disabled
cellbound_11 = Boundary(cellbound_7)  # disabled
viewobs_11 = Curve(viewobs_7)  # disabled
trees_11 = Curve(trees_7)  # disabled
W_3 = WidthCount(w_count_3)  # disabled
H_3 = HeightCount(h_count_3)  # disabled

cellexclude_12 = Curve(cellexclude_8)  # disabled
cellbound_12 = Boundary(cellbound_8)  # disabled
viewobs_12 = Curve(viewobs_8)  # disabled
trees_12 = Curve(trees_8)  # disabled
W_4 = WidthCount(w_count_4)  # disabled
H_4 = HeightCount(h_count_4)  # disabled

toggle = BooleanToggle(True)  # disabled
selectdata = SelectData(_1=read_person_doc, gate=toggle)  # disabled
data = Data(selectdata)  # disabled
number_slider_2 = Slider(500, range=0..1000)  # disabled
number_slider_3 = Slider(1000, range=0..1000)  # disabled

# ----
# 绕行系数
detour_coefficient = CSharpScript(Docs=data, Reference="C:\05_Works\003_软件开发\230828_Behaviour_Simulator\231010_BSim\BSim\bin\Release\net48\BSim.dll")  # -> out, DetourCoeff_E; inputs Docs: list; disabled
# ---------- detour_coefficient: C# usings ----------
using System.Linq;
using BSim;
using System.Diagnostics;
using System.Windows.Forms;
# ---------- detour_coefficient: C# ----------
    List<Person_Doc> Doc = Docs.Select(p => (Person_Doc) p).ToList();

    List<double> DetCoeff = new List<double>();

    for(int i = 0;i < Doc.Count;i++)
    {
      Person_Doc D = Doc[i];

      int accIndex = 0;
      double accDetCoeff = 0.0;
      int count = 0;

      for(int j = 0;j < D.eventName.Count;j++)
      {
        if(D.eventName[j] == "Walk")
        {
          Point3d[] traj = D.trajectory.Where((p,index) => index >= accIndex && index < accIndex + D.duration[j]).ToArray();


          double Coeff = DetourCoeff(traj.ToList());
          if(Coeff > 0){accDetCoeff += Coeff;count++;}
        }
        accIndex += D.duration[j];
      }

      DetCoeff.Add(accDetCoeff / count);
    }


    DetourCoeff_E = DetCoeff;
# ---------- detour_coefficient: C# additional code ----------
  public double DetourCoeff(List<Point3d>pts)
  {
    if(pts.Count < 2){return -1;}

    double AbsDis = pts[0].DistanceTo(pts.Last());
    double AccDis = 0.0;

    for(int i = 1;i < pts.Count;i++)
    {
      AccDis += pts[i].DistanceTo(pts[i - 1]);
    }

    return AccDis / AbsDis;
  }
# ---------- end detour_coefficient ----------
num = Number(detour_coefficient.DetourCoeff_E)  # disabled
average = Average(Input=num)  # disabled
panel_17 = Panel(average)  # disabled

area = Area(Geometry=trees_9)  # -> Area, Centroid; disabled
senerylistener = CSharpScript(
    Docs=data,
    Scenery=area.Centroid,
    RoomCurves=viewobs_9,
    Reference="C:\05_Works\003_软件开发\230828_Behaviour_Simulator\231010_BSim\BSim\bin\Release\net48\BSim.dll")  # -> out, Ta, Ta_S; inputs Docs: list, Scenery: list of Point3d, RoomCurves: list of Curve; disabled
# ---------- senerylistener: C# ----------
    List<Person_Doc> Doc = Docs.Select(p => (Person_Doc) p).ToList();
    
    List<Point3d> ta = new List<Point3d>();
    List<double> ta_s = new List<double>();


    foreach(Person_Doc doc in Doc)
    {

      List<Point3d> ta_pts = ((Person_Doc) doc).trajectory.Where((p,i) => i % 5 == 0).ToList();
      List<double> ta_sc = new List<double>(ta_pts.Count);
      foreach(Point3d P in ta_pts)
      {
        ta_sc.Add(ScenEvaluate(RoomCurves, Scenery, Scenery.Select(p => 1.0).ToList(), P));
      }
      ta.AddRange(ta_pts);
      ta_s.AddRange(ta_sc);
    }


    Ta = ta;
    Ta_S = ta_s;
# ---------- senerylistener: C# additional code ----------
  public double ScenEvaluate(List<Curve>RoomCurves, List<Point3d> Scenery, List<double>scores, Point3d standPt)
  {
    double tolerance = 0.0001;
    double eva = 0;

    foreach(Point3d S in Scenery)
    {
      Curve cv = (new Line(S, standPt)).ToNurbsCurve();

      bool see = true;
      foreach(Curve room in RoomCurves)
      {
        var intersectionEvents = Rhino.Geometry.Intersect.Intersection.CurveCurve(cv, room, tolerance, tolerance);
        if(intersectionEvents.Count > 0){see = false;break;}
      }

      if(see){eva += scores[Scenery.IndexOf(S)];}
    }

    return eva;
  }
# ---------- end senerylistener ----------
gradient = Gradient(
    LowerLimit=0,
    UpperLimit=5,
    Parameter=senerylistener.Ta_S,
    stops=[0: RGB(0, 35, 74), 0.201: RGB(57, 134, 250), 0.395: RGB(105, 190, 255), 0.653: RGB(147, 201, 41), 1: RGB(198, 249, 48)])  # disabled
cir = Circle(Plane=senerylistener.Ta, Radius=0.3)  # disabled
argb = SplitARGB(Colour=gradient, IntegerChannels=True)  # -> Alpha, Red, Green, Blue; disabled
crv_35 = Curve(simplify(graft(cir)))  # disabled
rgb = ColourRGB(Alpha=20, Red=argb.Red, Green=argb.Green, Blue=argb.Blue)  # disabled
boundary_3 = BoundarySurfaces(Edges=crv_35, UseTasks=False)  # -> flatten(Surfaces); disabled

# ---- group: 视觉评价方差
# 视觉评分
c_script = CSharpScript(nums=senerylistener.Ta_S)  # -> out, Ave, Var; inputs nums: list of Double; disabled
# ---------- c_script: C# ----------
    double ave = 0.0;
    foreach(double n in nums)
    {
      ave += n;
    }

    ave = ave / nums.Count;

    double abs_d = 0.0;
    foreach(double n in nums)
    {
      abs_d += Math.Pow(ave - n, 2);
    }
    Ave = ave;
    Var = Math.Sqrt(abs_d);
# ---------- end c_script ----------
平均数 = Panel(c_script.Ave)  # disabled
方差 = Panel(c_script.Var)  # disabled

# ----
walkspeed = CSharpScript(Docs=data, Reference="C:\05_Works\003_软件开发\230828_Behaviour_Simulator\231010_BSim\BSim\bin\Release\net48\BSim.dll")  # -> out, Ta, Ta_S; inputs Docs: list; disabled
# ---------- walkspeed: C# ----------
        List<Person_Doc> Doc = Docs.Select(p => (Person_Doc) p).ToList();

    DataTree<double> speed = new DataTree<double>();
    DataTree<Line> tra_segments = new DataTree<Line>();

    for(int k = 0;k < Doc.Count;k++)
    {
      List<Point3d> ta_pts = ((Person_Doc) Doc[k]).trajectory.Where((p,i) => i % 5 == 0).ToList();
      List<Line> tra_seg = new List<Line>();
      speed.AddRange(Eva_Speed(ta_pts, out tra_seg), new GH_Path(k));
      tra_segments.AddRange(tra_seg, new GH_Path(k));
    }


    Ta = speed;
    Ta_S = tra_segments;
# ---------- walkspeed: C# additional code ----------
  public List<double> Eva_Speed(List<Point3d>pts, out List<Line> Segments)
  {
    List<double> speed = new List<double>();
    Segments = new List<Line>();
    for(int i = 1;i < pts.Count;i++)
    {
      speed.Add(pts[i].DistanceTo(pts[i - 1]));
      Segments.Add(new Line(pts[i - 1], pts[i]));
    }

    return speed;
  }
# ---------- end walkspeed ----------
number_slider_4 = Slider(0.4, range=0..1)  # disabled
gradient_2 = Gradient(
    LowerLimit=0,
    UpperLimit=number_slider_4,
    Parameter=walkspeed.Ta,
    stops=[0: RGB(234, 38, 0), 0.226: RGB(234, 126, 0), 0.505: RGB(254, 244, 84), 0.75: RGB(173, 203, 249), 1: RGB(75, 107, 169)])  # disabled
visualizecurve_230516 = VisualizeCURVE(cvs=flatten(walkspeed.Ta_S), cols=flatten(gradient_2), text_size=2, thick=10)  # disabled

R_2 = Slider(1, range=0..2)  # disabled
mplane = MeshPlane(Boundary=cellbound_9, WidthCount=W, HeightCount=H)  # -> Mesh, Area; disabled
demesh = DeconstructMesh(Mesh=mplane.Mesh)  # -> Vertices, Faces, Colours, Normals; disabled
pt_30 = Point(senerylistener.Ta)  # disabled
incurves_2 = PointInCurves(Point=demesh.Vertices, Curves=cellexclude_9)  # -> Relationship, Index, Point; disabled
equals_2 = Equality(FirstNumber=incurves_2.Relationship, SecondNumber=0)  # -> Equality, Inequality; disabled
dispatch_3 = Dispatch(List=demesh.Vertices, DispatchPattern=equals_2.Equality)  # -> ListA, ListB; disabled
pt_31 = Point(dispatch_3.ListA)  # disabled
c_script_2 = CSharpScript(Units=pt_31, Cloud=pt_30, R=R_2)  # -> out, A; inputs Units: list of Point3d, Cloud: list of Point3d, R: Double; disabled
# ---------- c_script_2: C# usings ----------
using System.Linq;
using System.Threading.Tasks;
# ---------- c_script_2: C# ----------
    List<double[,]> M = Cloud.Select(p => new double[Units.Count, 2]).ToList();

    Parallel.For(0, Cloud.Count, (index) =>
      {
      double[,] Record = new double[Units.Count, 2];

      Point3d pt = Cloud[index];

      for(int i = 0;i < Units.Count;i++)
      {
        double r = Units[i].DistanceTo(pt);
        if(Units[i].DistanceTo(pt) <= R)
        {
          Record[i, 0] = (double) i;
          Record[i, 1] = 1.0 - r / R;
        }
      }

      M[index] = Record;

      });

    double[] InUnit = new double[Units.Count];
    foreach(double[,] D in M)
    {
      for(int i = 0;i < Units.Count;i++)
      {
        int index = System.Convert.ToInt32(D[i, 0]);
        InUnit[index] += D[i, 1];
      }
    }

    A = InUnit;
# ---------- end c_script_2 ----------
bnd = Bounds(Numbers=c_script_2.A)  # disabled
dedomain = DeconstructDomain(Domain=bnd)  # -> Start, End; disabled
gradient_3 = Gradient(
    LowerLimit=dedomain.Start,
    UpperLimit=number_slider_3,
    Parameter=c_script_2.A,
    stops=[0: RGB(255, 255, 255), 0.5: RGB(255, 255, 0), 1: RGB(255, 0, 0)])  # disabled

# ----
# 功能容量
pt_32 = Point(<point referenced from the Rhino model>)  # disabled
showresults = CSharpScript(
    Docs=data,
    O=pt_32,
    Reference="C:\05_Works\003_软件开发\230828_Behaviour_Simulator\231010_BSim\BSim\bin\Release\net48\BSim.dll")  # -> out; inputs Docs: list, O: Point3d; disabled
# ---------- showresults: C# usings ----------
using System.Linq;
using BSim;
using System.Drawing;
using System.Diagnostics;
using System.Windows.Forms;
# ---------- showresults: C# ----------
    List<Person_Doc> Doc = Docs.Select(p => (Person_Doc) p).ToList();
    Point3d basePt = new Point3d(O);
    string Compostion = CompositionAnalysis(Doc);Print(Compostion);
    int k = 0;
    foreach(Person_Doc doc in Doc)
    {
      GH_Path path = new GH_Path(k);
      List<Line> bar = ShowResult(doc, basePt, 0.01);

      Bar_Tree.AddRange(bar, path);
      Text_Tree.AddRange(doc.eventName, path);
      Color_Tree.AddRange(ColorCode(doc), path);
      PlyBar_Tree.AddRange(bar.Select(p => LineToPolyline(p)).ToList(), path);

      basePt = basePt + new Vector3d(0, -0.3, 0);
      k++;
    }
# ---------- showresults: C# additional code ----------
  DataTree<Line> Bar_Tree = new DataTree<Line>();
  DataTree<string> Text_Tree = new DataTree<string>();
  DataTree<Color> Color_Tree = new DataTree<Color>();
  DataTree<List<Point3d>> PlyBar_Tree = new DataTree<List<Point3d>>();

  double tol = Config.tolerance;

  public override void BeforeRunScript()
  {
    Bar_Tree.Clear();
    Text_Tree.Clear();
    Color_Tree.Clear();
    PlyBar_Tree.Clear();
  }


  public string CompositionAnalysis(List<Person_Doc> Doc)
  {
    List < string > DefaultCategory = new List<string>(){"Walk","Talk","Wait"};
    string rep = "";
    List<string> Lib_event = new List<string>();
    List<int> Lib_time = new List<int>();
    foreach(Person_Doc doc in Doc)
    {
      for(int i = 0;i < doc.eventName.Count;i++)
      {
        string Ename = doc.eventName[i];
        if(!DefaultCategory.Contains(Ename)){Ename = "Busy";}

        if(Lib_event.Contains(Ename))
        {
          int index = Lib_event.IndexOf(Ename);
          Lib_time[index] += doc.duration[i];
        }
        else
        {
          Lib_event.Add(Ename);
          Lib_time.Add(doc.duration[i]);
        }
      }
    }

    int sum = 0;
    foreach(int time in Lib_time)
    {sum += time;}

    for(int i = 0;i < Lib_event.Count;i++)
    {
      if(sum != 0){
        double percent = Math.Ceiling(10000 * (double) Lib_time[i] / (double) sum) / 100;
        rep += string.Format("[{0}: {1}%]", Lib_event[i], percent.ToString());
      }
    }

    return rep;
  }

  public List<Color>ColorCode(Person_Doc doc)
  {
    List<Color> cols = new List<Color>(doc.eventName.Count);
    foreach(string name in doc.eventName)
    {
      switch(name)
      {
        case "Walk":
          cols.Add(Color.Gray);
          break;
        case "Wait":
          cols.Add(Color.Blue);
          break;
        case "Free":
          cols.Add(Color.Gray);
          break;
        case "Talk":
          cols.Add(Color.Orange);
          break;
        case "Gone":
          cols.Add(Color.Black);
          break;
        default:
          cols.Add(Color.Brown);
          break;
      }
    }

    return cols;
  }

  public List<Line> ShowResult(Person_Doc doc, Point3d orin, double s)
  {
    List<Line> bars = new List<Line>(doc.eventName.Count);

    Point3d pt = new Point3d(orin);
    for(int i = 0;i < doc.eventName.Count;i++)
    {
      Point3d ed = pt + new Vector3d(s * (double) doc.duration[i], 0, 0);
      bars.Add(new Line(pt, ed));
      pt = ed;
    }

    return bars;
  }

  public List<Point3d> LineToPolyline(Line ln)
  {
    if(ln.Length < tol){return new List<Point3d>(){ln.From,ln.To};}
    double th = 0.05;
    Point3d P0 = ln.From + new Vector3d(0, th, 0);
    Point3d P1 = ln.To + new Vector3d(0, th, 0);
    Point3d P2 = ln.To - new Vector3d(0, th, 0);
    Point3d P3 = ln.From - new Vector3d(0, th, 0);
    return new List<Point3d>(){P0,P1,P2,P3,P0};
  }

  public override void DrawViewportWires(IGH_PreviewArgs args)
  {
    Plane pl0_Plane;
    args.Viewport.GetFrustumFarPlane(out pl0_Plane);
    Rhino.Display.Text3d drawText = null;  // Initialize to null

    for(int i = 0;i < Bar_Tree.BranchCount;i++)
    {
      for(int j = 0;j < PlyBar_Tree.Branch(i).Count;j++)
      {
        Line Bar = Bar_Tree.Branch(i)[j];
        List<Point3d> PBar = PlyBar_Tree.Branch(i)[j];
        Color col = Color_Tree.Branch(i)[j];
        args.Display.DrawPolygon(PBar, col, true);

        string text = Text_Tree.Branch(i)[j];
        pl0_Plane.Origin = Bar.From * 0.5 + Bar.To * 0.5 + new Vector3d(0, 0.05, 0);
        drawText = new Rhino.Display.Text3d(text, pl0_Plane, 0.1);
        args.Display.Draw3dText(drawText, Color.Black);
      }

    }

    if(drawText != null)
    {drawText.Dispose();}

  }
# ---------- end showresults ----------
panel_18 = Panel(showresults)  # disabled

# ---- group: 速度评价方差
# 移动速度
c_script_3 = CSharpScript(nums=flatten(walkspeed.Ta))  # -> out, Ave, Var; inputs nums: list of Double; disabled; same code as c_script
平均数_2 = Panel(c_script_3.Ave)  # disabled
方差_2 = Panel(c_script_3.Var)  # disabled

# ----
cluster = Cluster(num=c_script_2.A, B=number_slider_2)  # disabled
panel_19 = Panel(cluster)  # disabled
panel_20 = Panel(c_script_2.A)  # disabled

preview = CustomPreview(Geometry=cir, Material=gradient)  # disabled
preview_2 = CustomPreview(Geometry=boundary_3, Material=rgb)  # disabled

dots = DotDisplay(Point=pt_31, Colour=gradient_3, Size=0.05)  # disabled

selectdata_2 = SelectData(_1=read_person_doc_2, gate=Toggle(False))
data_2 = Data(selectdata_2)

# ----
# 绕行系数
detour_coefficient_2 = CSharpScript(Docs=data_2, Reference="C:\05_Works\003_软件开发\230828_Behaviour_Simulator\231010_BSim\BSim\bin\Release\net48\BSim.dll")  # -> out, DetourCoeff_E; inputs Docs: list; same code as detour_coefficient
num_2 = Number(detour_coefficient_2.DetourCoeff_E)
average_2 = Average(Input=num_2)
panel_21 = Panel(average_2)

area_2 = Area(Geometry=trees_10)  # -> Area, Centroid
senerylistener_2 = CSharpScript(
    Docs=data_2,
    Scenery=area_2.Centroid,
    RoomCurves=viewobs_10,
    Reference="C:\05_Works\003_软件开发\230828_Behaviour_Simulator\231010_BSim\BSim\bin\Release\net48\BSim.dll")  # -> out, Ta, Ta_S; inputs Docs: list, Scenery: list of Point3d, RoomCurves: list of Curve; same code as senerylistener
gradient_4 = Gradient(
    LowerLimit=0,
    UpperLimit=5,
    Parameter=senerylistener_2.Ta_S,
    stops=[0: RGB(0, 35, 74), 0.201: RGB(57, 134, 250), 0.395: RGB(105, 190, 255), 0.653: RGB(147, 201, 41), 1: RGB(198, 249, 48)])
cir_2 = Circle(Plane=senerylistener_2.Ta, Radius=0.3)
argb_2 = SplitARGB(Colour=gradient_4, IntegerChannels=True)  # -> Alpha, Red, Green, Blue
crv_36 = Curve(simplify(graft(cir_2)))
rgb_2 = ColourRGB(Alpha=20, Red=argb_2.Red, Green=argb_2.Green, Blue=argb_2.Blue)
boundary_4 = BoundarySurfaces(Edges=crv_36, UseTasks=False)  # -> flatten(Surfaces)

# ---- group: 视觉评价方差
# 视觉评分
c_script_4 = CSharpScript(nums=senerylistener_2.Ta_S)  # -> out, Ave, Var; inputs nums: list of Double; same code as c_script
平均数_3 = Panel(c_script_4.Ave)
方差_3 = Panel(c_script_4.Var)

# ----
walkspeed_2 = CSharpScript(Docs=data_2, Reference="C:\05_Works\003_软件开发\230828_Behaviour_Simulator\231010_BSim\BSim\bin\Release\net48\BSim.dll")  # -> out, Ta, Ta_S; inputs Docs: list; same code as walkspeed
gradient_5 = Gradient(
    LowerLimit=0,
    UpperLimit=Slider(0.4, range=0..1),
    Parameter=walkspeed_2.Ta,
    stops=[0: RGB(234, 38, 0), 0.226: RGB(234, 126, 0), 0.505: RGB(254, 244, 84), 0.75: RGB(173, 203, 249), 1: RGB(75, 107, 169)])
visualizecurve_230516_2 = VisualizeCURVE(cvs=flatten(walkspeed_2.Ta_S), cols=flatten(gradient_5), text_size=2, thick=10)

R_3 = Slider(1, range=0..2)
mplane_2 = MeshPlane(Boundary=cellbound_10, WidthCount=W_2, HeightCount=H_2)  # -> Mesh, Area
demesh_2 = DeconstructMesh(Mesh=mplane_2.Mesh)  # -> Vertices, Faces, Colours, Normals
pt_33 = Point(senerylistener_2.Ta)
incurves_3 = PointInCurves(Point=demesh_2.Vertices, Curves=cellexclude_10)  # -> Relationship, Index, Point
equals_3 = Equality(FirstNumber=incurves_3.Relationship, SecondNumber=0)  # -> Equality, Inequality
dispatch_4 = Dispatch(List=demesh_2.Vertices, DispatchPattern=equals_3.Equality)  # -> ListA, ListB
pt_34 = Point(dispatch_4.ListA)
c_script_5 = CSharpScript(Units=pt_34, Cloud=pt_33, R=R_3)  # -> out, A; inputs Units: list of Point3d, Cloud: list of Point3d, R: Double; same code as c_script_2
bnd_2 = Bounds(Numbers=c_script_5.A)
dedomain_2 = DeconstructDomain(Domain=bnd_2)  # -> Start, End
gradient_6 = Gradient(
    LowerLimit=dedomain_2.Start,
    UpperLimit=Slider(1000, range=0..1000),
    Parameter=c_script_5.A,
    stops=[0: RGB(255, 255, 255), 0.5: RGB(255, 255, 0), 1: RGB(255, 0, 0)])

# ----
# 功能容量
pt_35 = Point(<point referenced from the Rhino model>)
showresults_2 = CSharpScript(
    Docs=data_2,
    O=pt_35,
    Reference="C:\05_Works\003_软件开发\230828_Behaviour_Simulator\231010_BSim\BSim\bin\Release\net48\BSim.dll")  # -> out; inputs Docs: list, O: Point3d; same code as showresults
panel_22 = Panel(showresults_2)

# ---- group: 速度评价方差
# 移动速度
c_script_6 = CSharpScript(nums=flatten(walkspeed_2.Ta))  # -> out, Ave, Var; inputs nums: list of Double; same code as c_script
平均数_4 = Panel(c_script_6.Ave)
方差_4 = Panel(c_script_6.Var)

# ----
cluster_2 = Cluster(num=c_script_5.A, B=Slider(500, range=0..1000))
panel_23 = Panel(cluster_2)
panel_24 = Panel(c_script_5.A)

preview_3 = CustomPreview(Geometry=cir_2, Material=gradient_4)
preview_4 = CustomPreview(Geometry=boundary_4, Material=rgb_2)

dots_2 = DotDisplay(Point=pt_34, Colour=gradient_6, Size=0.05)

toggle_2 = BooleanToggle(False)  # disabled
selectdata_3 = SelectData(_1=read_person_doc_3, gate=toggle_2)  # disabled
data_3 = Data(selectdata_3)  # disabled
number_slider_5 = Slider(500, range=0..1000)  # disabled
number_slider_6 = Slider(1000, range=0..1000)  # disabled

# ----
# 绕行系数
detour_coefficient_3 = CSharpScript(Docs=data_3, Reference="C:\05_Works\003_软件开发\230828_Behaviour_Simulator\231010_BSim\BSim\bin\Release\net48\BSim.dll")  # -> out, DetourCoeff_E; inputs Docs: list; disabled; same code as detour_coefficient
num_3 = Number(detour_coefficient_3.DetourCoeff_E)  # disabled
average_3 = Average(Input=num_3)  # disabled
panel_25 = Panel(average_3)  # disabled

area_3 = Area(Geometry=trees_11)  # -> Area, Centroid; disabled
senerylistener_3 = CSharpScript(
    Docs=data_3,
    Scenery=area_3.Centroid,
    RoomCurves=viewobs_11,
    Reference="C:\05_Works\003_软件开发\230828_Behaviour_Simulator\231010_BSim\BSim\bin\Release\net48\BSim.dll")  # -> out, Ta, Ta_S; inputs Docs: list, Scenery: list of Point3d, RoomCurves: list of Curve; disabled; same code as senerylistener
gradient_7 = Gradient(
    LowerLimit=0,
    UpperLimit=5,
    Parameter=senerylistener_3.Ta_S,
    stops=[0: RGB(0, 35, 74), 0.201: RGB(57, 134, 250), 0.395: RGB(105, 190, 255), 0.653: RGB(147, 201, 41), 1: RGB(198, 249, 48)])  # disabled
cir_3 = Circle(Plane=senerylistener_3.Ta, Radius=0.3)  # disabled
argb_3 = SplitARGB(Colour=gradient_7, IntegerChannels=True)  # -> Alpha, Red, Green, Blue; disabled
crv_37 = Curve(simplify(graft(cir_3)))  # disabled
rgb_3 = ColourRGB(Alpha=20, Red=argb_3.Red, Green=argb_3.Green, Blue=argb_3.Blue)  # disabled
boundary_5 = BoundarySurfaces(Edges=crv_37, UseTasks=False)  # -> flatten(Surfaces); disabled

# ---- group: 视觉评价方差
# 视觉评分
c_script_7 = CSharpScript(nums=senerylistener_3.Ta_S)  # -> out, Ave, Var; inputs nums: list of Double; disabled; same code as c_script
平均数_5 = Panel(c_script_7.Ave)  # disabled
方差_5 = Panel(c_script_7.Var)  # disabled

# ----
walkspeed_3 = CSharpScript(Docs=data_3, Reference="C:\05_Works\003_软件开发\230828_Behaviour_Simulator\231010_BSim\BSim\bin\Release\net48\BSim.dll")  # -> out, Ta, Ta_S; inputs Docs: list; disabled; same code as walkspeed
number_slider_7 = Slider(0.4, range=0..1)  # disabled
gradient_8 = Gradient(
    LowerLimit=0,
    UpperLimit=number_slider_7,
    Parameter=walkspeed_3.Ta,
    stops=[0: RGB(234, 38, 0), 0.226: RGB(234, 126, 0), 0.505: RGB(254, 244, 84), 0.75: RGB(173, 203, 249), 1: RGB(75, 107, 169)])  # disabled
visualizecurve_230516_3 = VisualizeCURVE(cvs=flatten(walkspeed_3.Ta_S), cols=flatten(gradient_8), text_size=2, thick=10)  # disabled

R_4 = Slider(1, range=0..2)  # disabled
mplane_3 = MeshPlane(Boundary=cellbound_11, WidthCount=W_3, HeightCount=H_3)  # -> Mesh, Area; disabled
demesh_3 = DeconstructMesh(Mesh=mplane_3.Mesh)  # -> Vertices, Faces, Colours, Normals; disabled
pt_36 = Point(senerylistener_3.Ta)  # disabled
incurves_4 = PointInCurves(Point=demesh_3.Vertices, Curves=cellexclude_11)  # -> Relationship, Index, Point; disabled
equals_4 = Equality(FirstNumber=incurves_4.Relationship, SecondNumber=0)  # -> Equality, Inequality; disabled
dispatch_5 = Dispatch(List=demesh_3.Vertices, DispatchPattern=equals_4.Equality)  # -> ListA, ListB; disabled
pt_37 = Point(dispatch_5.ListA)  # disabled
c_script_8 = CSharpScript(Units=pt_37, Cloud=pt_36, R=R_4)  # -> out, A; inputs Units: list of Point3d, Cloud: list of Point3d, R: Double; disabled; same code as c_script_2
bnd_3 = Bounds(Numbers=c_script_8.A)  # disabled
dedomain_3 = DeconstructDomain(Domain=bnd_3)  # -> Start, End; disabled
gradient_9 = Gradient(
    LowerLimit=dedomain_3.Start,
    UpperLimit=number_slider_6,
    Parameter=c_script_8.A,
    stops=[0: RGB(255, 255, 255), 0.5: RGB(255, 255, 0), 1: RGB(255, 0, 0)])  # disabled

# ----
# 功能容量
pt_38 = Point(<point referenced from the Rhino model>)  # disabled
showresults_3 = CSharpScript(
    Docs=data_3,
    O=pt_38,
    Reference="C:\05_Works\003_软件开发\230828_Behaviour_Simulator\231010_BSim\BSim\bin\Release\net48\BSim.dll")  # -> out; inputs Docs: list, O: Point3d; disabled; same code as showresults
panel_26 = Panel(showresults_3)  # disabled

# ---- group: 速度评价方差
# 移动速度
c_script_9 = CSharpScript(nums=flatten(walkspeed_3.Ta))  # -> out, Ave, Var; inputs nums: list of Double; disabled; same code as c_script
平均数_6 = Panel(c_script_9.Ave)  # disabled
方差_6 = Panel(c_script_9.Var)  # disabled

# ----
cluster_3 = Cluster(num=c_script_8.A, B=number_slider_5)  # disabled
panel_27 = Panel(cluster_3)  # disabled
panel_28 = Panel(c_script_8.A)  # disabled

preview_5 = CustomPreview(Geometry=cir_3, Material=gradient_7)  # disabled
preview_6 = CustomPreview(Geometry=boundary_5, Material=rgb_3)  # disabled

dots_3 = DotDisplay(Point=pt_37, Colour=gradient_9, Size=0.05)  # disabled

toggle_3 = BooleanToggle(False)  # disabled
selectdata_4 = SelectData(_1=read_person_doc_4, gate=toggle_3)  # disabled
data_4 = Data(selectdata_4)  # disabled
number_slider_8 = Slider(500, range=0..1000)  # disabled
number_slider_9 = Slider(1000, range=0..1000)  # disabled

# ----
# 绕行系数
detour_coefficient_4 = CSharpScript(Docs=data_4, Reference="C:\05_Works\003_软件开发\230828_Behaviour_Simulator\231010_BSim\BSim\bin\Release\net48\BSim.dll")  # -> out, DetourCoeff_E; inputs Docs: list; disabled; same code as detour_coefficient
num_4 = Number(detour_coefficient_4.DetourCoeff_E)  # disabled
average_4 = Average(Input=num_4)  # disabled
panel_29 = Panel(average_4)  # disabled

area_4 = Area(Geometry=trees_12)  # -> Area, Centroid; disabled
senerylistener_4 = CSharpScript(
    Docs=data_4,
    Scenery=area_4.Centroid,
    RoomCurves=viewobs_12,
    Reference="C:\05_Works\003_软件开发\230828_Behaviour_Simulator\231010_BSim\BSim\bin\Release\net48\BSim.dll")  # -> out, Ta, Ta_S; inputs Docs: list, Scenery: list of Point3d, RoomCurves: list of Curve; disabled; same code as senerylistener
gradient_10 = Gradient(
    LowerLimit=0,
    UpperLimit=5,
    Parameter=senerylistener_4.Ta_S,
    stops=[0: RGB(0, 35, 74), 0.201: RGB(57, 134, 250), 0.395: RGB(105, 190, 255), 0.653: RGB(147, 201, 41), 1: RGB(198, 249, 48)])  # disabled
cir_4 = Circle(Plane=senerylistener_4.Ta, Radius=0.3)  # disabled
argb_4 = SplitARGB(Colour=gradient_10, IntegerChannels=True)  # -> Alpha, Red, Green, Blue; disabled
crv_38 = Curve(simplify(graft(cir_4)))  # disabled
rgb_4 = ColourRGB(Alpha=20, Red=argb_4.Red, Green=argb_4.Green, Blue=argb_4.Blue)  # disabled
boundary_6 = BoundarySurfaces(Edges=crv_38, UseTasks=False)  # -> flatten(Surfaces); disabled

# ---- group: 视觉评价方差
# 视觉评分
c_script_10 = CSharpScript(nums=senerylistener_4.Ta_S)  # -> out, Ave, Var; inputs nums: list of Double; disabled; same code as c_script
平均数_7 = Panel(c_script_10.Ave)  # disabled
方差_7 = Panel(c_script_10.Var)  # disabled

# ----
walkspeed_4 = CSharpScript(Docs=data_4, Reference="C:\05_Works\003_软件开发\230828_Behaviour_Simulator\231010_BSim\BSim\bin\Release\net48\BSim.dll")  # -> out, Ta, Ta_S; inputs Docs: list; disabled; same code as walkspeed
number_slider_10 = Slider(0.4, range=0..1)  # disabled
gradient_11 = Gradient(
    LowerLimit=0,
    UpperLimit=number_slider_10,
    Parameter=walkspeed_4.Ta,
    stops=[0: RGB(234, 38, 0), 0.226: RGB(234, 126, 0), 0.505: RGB(254, 244, 84), 0.75: RGB(173, 203, 249), 1: RGB(75, 107, 169)])  # disabled
visualizecurve_230516_4 = VisualizeCURVE(cvs=flatten(walkspeed_4.Ta_S), cols=flatten(gradient_11), text_size=2, thick=10)  # disabled

R_5 = Slider(1, range=0..2)  # disabled
mplane_4 = MeshPlane(Boundary=cellbound_12, WidthCount=W_4, HeightCount=H_4)  # -> Mesh, Area; disabled
demesh_4 = DeconstructMesh(Mesh=mplane_4.Mesh)  # -> Vertices, Faces, Colours, Normals; disabled
pt_39 = Point(senerylistener_4.Ta)  # disabled
incurves_5 = PointInCurves(Point=demesh_4.Vertices, Curves=cellexclude_12)  # -> Relationship, Index, Point; disabled
equals_5 = Equality(FirstNumber=incurves_5.Relationship, SecondNumber=0)  # -> Equality, Inequality; disabled
dispatch_6 = Dispatch(List=demesh_4.Vertices, DispatchPattern=equals_5.Equality)  # -> ListA, ListB; disabled
pt_40 = Point(dispatch_6.ListA)  # disabled
c_script_11 = CSharpScript(Units=pt_40, Cloud=pt_39, R=R_5)  # -> out, A; inputs Units: list of Point3d, Cloud: list of Point3d, R: Double; disabled; same code as c_script_2
bnd_4 = Bounds(Numbers=c_script_11.A)  # disabled
dedomain_4 = DeconstructDomain(Domain=bnd_4)  # -> Start, End; disabled
gradient_12 = Gradient(
    LowerLimit=dedomain_4.Start,
    UpperLimit=number_slider_9,
    Parameter=c_script_11.A,
    stops=[0: RGB(255, 255, 255), 0.5: RGB(255, 255, 0), 1: RGB(255, 0, 0)])  # disabled

# ----
# 功能容量
pt_41 = Point(<point referenced from the Rhino model>)  # disabled
showresults_4 = CSharpScript(
    Docs=data_4,
    O=pt_41,
    Reference="C:\05_Works\003_软件开发\230828_Behaviour_Simulator\231010_BSim\BSim\bin\Release\net48\BSim.dll")  # -> out; inputs Docs: list, O: Point3d; disabled; same code as showresults
panel_30 = Panel(showresults_4)  # disabled

# ---- group: 速度评价方差
# 移动速度
c_script_12 = CSharpScript(nums=flatten(walkspeed_4.Ta))  # -> out, Ave, Var; inputs nums: list of Double; disabled; same code as c_script
平均数_8 = Panel(c_script_12.Ave)  # disabled
方差_8 = Panel(c_script_12.Var)  # disabled

# ----
cluster_4 = Cluster(num=c_script_11.A, B=number_slider_8)  # disabled
panel_31 = Panel(cluster_4)  # disabled
panel_32 = Panel(c_script_11.A)  # disabled

preview_7 = CustomPreview(Geometry=cir_4, Material=gradient_10)  # disabled
preview_8 = CustomPreview(Geometry=boundary_6, Material=rgb_4)  # disabled

dots_4 = DotDisplay(Point=pt_40, Colour=gradient_12, Size=0.05)  # disabled

# ==== cluster SelectData: SelectData via identifications
_0 = ClusterInput()
gate = ClusterInput()
_1 = ClusterInput()
c_script = CSharpScript(ListA=_0, ListB=_1, gate=gate)  # -> flatten(A); inputs ListA: list, ListB: list, gate: Int32
# ---------- c_script: C# ----------
    if(gate == 0)
    {
      A = ListA;
    }
    else if(gate == 1)
    {
      A = ListB;
    }
# ---------- end c_script ----------
out = ClusterOutput(c_script)

# ==== cluster VisualizeCURVE: Visualize
text_size = ClusterInput()
thick = ClusterInput()
cvs = ClusterInput()
labels = ClusterInput()
cols = ClusterInput()
c_script = CSharpScript(cvs=cvs, cols=cols, labels=labels, text_size=text_size, thick=thick)  # inputs cvs: list of Curve, cols: list of Color, labels: list of String, text_size: Double, thick: list of Double
# ---------- c_script: C# usings ----------
using System.IO;
using System.Linq;
using System.Data;
using System.Drawing;
using System.Reflection;
using System.Windows.Forms;
using System.Xml;

using System.Runtime.InteropServices;

using Rhino.DocObjects;
using Rhino.Collections;
using GH_IO;
using GH_IO.Serialization;
# ---------- c_script: C# ----------
    dis_cvs.Clear();
    dis_cols.Clear();
    dis_th.Clear();
    dis_labels.Clear();
    if(cvs == null){return;}
    dis_cvs.AddRange(cvs);
    if(cols.Count == 1)    {      dis_cols = dis_cvs.Select(p => cols[0]).ToList();    }
    else if(cols.Count == 0){      dis_cols = dis_cvs.Select(p => Color.Black).ToList();    }
    else{dis_cols.AddRange(cols);}

    if(labels.Count == 1)    {      dis_labels = dis_cvs.Select(p => labels[0]).ToList();    }
    else if(labels.Count == 0){      dis_labels = dis_cvs.Select(p => "").ToList();    }
    else{dis_labels.AddRange(labels);}

    if(thick.Count == 1)    {      dis_th = dis_cvs.Select(p => thick[0]).ToList();    }
    else if(labels.Count == 0){      dis_th = dis_cvs.Select(p => 1.0).ToList();    }
    else{dis_th.AddRange(thick);}

    if(text_size > 0)
    { txt_size = text_size;}
# ---------- c_script: C# additional code ----------
  private List<Curve> dis_cvs = new List<Curve>();
  private List<Color> dis_cols = new List<Color>();
  private List<double> dis_th = new List<double>();
  private List<string> dis_labels = new List<string>();
  private double txt_size = 1.5;

  public override void BeforeRunScript()
  {
    dis_cvs.Clear();
    dis_cols.Clear();
    dis_th.Clear();
    dis_labels.Clear();
  }

  public override BoundingBox ClippingBox
  {
    get
    {
      return BoundingBox.Empty;
    }
  }

  public override void DrawViewportWires(IGH_PreviewArgs args)
  {
    Plane pl0_Plane;
    args.Viewport.GetFrustumFarPlane(out pl0_Plane);

    Rhino.Display.Text3d drawText = null;  // Initialize to null

    for (int i = 0; i < dis_cvs.Count; i++)
    {
      Curve cv = dis_cvs[i];
      Color col = dis_cols[i];
      double th = dis_th[i];
      string txt = dis_labels[i];

      pl0_Plane.Origin = cv.PointAt(0.5 * cv.Domain.Length);

      args.Display.DrawCurve(cv, col, System.Convert.ToInt32(th));

      // Create a new Text3d object
      //drawText = new Rhino.Display.Text3d(txt, pl0_Plane, txt_size);
      //args.Display.Draw3dText(drawText, col);
    }

    // Dispose of the last Text3d object
    if (drawText != null)
    {
      drawText.Dispose();
    }
  }
# ---------- end c_script ----------

# ==== cluster Cluster
num = ClusterInput()
B = ClusterInput()
num_2 = Number(num)
larger = LargerThan(FirstNumber=num_2, SecondNumber=B)  # -> LargerThan, OrEqualTo
dispatch = Dispatch(List=num_2, DispatchPattern=larger.LargerThan)  # -> ListA, ListB
lng = ListLength(List=dispatch.ListA)
lng_2 = ListLength(List=num_2)
division = Division(A=lng, B=lng_2)
subtraction = Subtraction(A=1, B=division)
R = ClusterOutput(subtraction)
