# Grasshopper definition CityScaleCase.gh (Grasshopper 1.0.7)

enterexist_locations = Point([Point(889.3467779, 219.3921789, 0), Point(639.2817244, 1493.249295, 0), Point(-195.4373354, 916.6460976, 0), Point(-172.8239449, 810.5840897, 0), Point(-134.6073316, 631.339375, 0), Point(-111.3489002, 522.2519772, 0), Point(-90.17688244, 422.9503396, 0), Point(-49.97042884, 234.3728157, 0), Point(-28.61917649, 134.2305265, 0), Point(477.5878215, 117.815722, 0), Point(220.1775425, 1403.602529, 0), Point(116.8432888, 1381.499238, 0), Point(135.6255074, 33.45733783, 0), Point(815.2588612, 1591.771028, 0), Point(1148.542386, 283.3329169, 0), Point(-101.6219723, 1334.76932, 0), Point(-251.3442255, 1178.862283, 0), Point(-228.9636965, 1073.89245, 0)])
number_of_agents = Integer(6312)
poi_mainclass = Text(["购", "食", "住", "购", "食", "食", "食", "食", "食", "购"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])
poi_locations = Point([Point(149.2387546, 1221.266596, 0), Point(-252.2862648, 1231.220604, 0), Point(-258.541934, 1260.561132, 0), Point(-248.1158188, 1211.660252, 0), Point(-243.9453727, 1192.0999, 0), Point(-237.4517769, 1161.64344, 0)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])
enterexist_ids = Text(["相门地铁站", "仓街北", "蒹葭巷", "悬桥巷", "南星桥巷", "大儒巷", "肖家巷", "钮家巷", "建新巷", "平江路南", "平江路北", "兰庭苑北", "丁家巷", "东园", "相门", "赛银巷", "东花轿巷", "曹胡徐巷"])
int = Integer([80, 120, 500, 60, 120, 120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])
pt = Point([Point(815.2588612, 1591.771028, 0), Point(-134.6073316, 631.339375, 0), Point(815.2588612, 1591.771028, 0), Point(-111.3489002, 522.2519772, 0), Point(1148.542386, 283.3329169, 0), Point(-90.17688244, 422.9503396, 0)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])
int_2 = Integer([0, 0, 6, 0, 0, 0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])
pt_2 = Point([Point(149.2387546, 1221.266596, 0), Point(-252.2862648, 1231.220604, 0), Point(-258.541934, 1260.561132, 0), Point(-248.1158188, 1211.660252, 0), Point(-243.9453727, 1192.0999, 0), Point(-237.4517769, 1161.64344, 0)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])
data = Data(Tree({0}: ["思婆桥", "平江路南"], {1}: ["More than Vintage 不止中古", "雪糕桥", "平江路南"], {2}: ["松鹤楼菜馆", "众安桥与小新桥", "悬桥巷"], {3}: ["潘宅", "悬桥巷"], {4}: ["平江历史街区-挹清廊", "南星桥巷"], {5}: ["平江历史街区-黄丕烈藏书楼", "悬桥巷"]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))
poi_ids = Text(["东花桥巷林坤源汉服文化体验馆", "鼎盛鲜", "苏州夏陌余白酒店", "宏福堂", "面外公苏式面", "宴福兴饮食店"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])

# ----
# Agents
number_slider = Slider(2, range=0..100)
series = Series(Start=0, Step=1, Count=number_of_agents)
pt_3 = Point(pt)
multiplication = Multiplication(A=series, B=number_slider)
int_3 = Integer(number_of_agents)
metabolism = CSharpScript(Iteration=int_2, Reference="C:\USERS\SYCAR\ONEDRIVE\NET_LIBRARY\BSim.dll")  # -> Meta; inputs Iteration: Int32
# ---------- metabolism: C# usings ----------
using BSim;

using System.Windows.Forms;

using System.Linq;
# ---------- metabolism: C# ----------
    Meta = (Metabolism) (new MetaP(Iteration));
# ---------- metabolism: C# additional code ----------
  public class MetaP:Metabolism
  {
    public int emergeIteration;
    public MetaP(int Iteration)
    {
      this.emergeIteration = Iteration;
    }
    public bool IfEmerge(Person P, ABM ABM)
    {
      if(ABM.PS.iteration == emergeIteration){return true;}
      else{return false;}
    }

    public bool IfExpire(Person P, ABM ABM)
    {
      if(P.State == Person_state.Gone){return true;}
      else{return false;}
    }

    public object log (Person P, ABM ABM)
    {
      return null;
    }
    
    public override string ToString()
    {
      return "Emerge at " + emergeIteration.ToString();
    }
  }
# ---------- end metabolism ----------
makemove = CSharpScript(
    ATol=Slider(0.6, range=0..1),
    Speed=Slider(0.0375, range=0..1),
    Strengh=Slider(1, range=0..1),
    Reference="C:\USERS\SYCAR\ONEDRIVE\NET_LIBRARY\BSim.dll")  # -> IWalk; inputs ATol: Double, Speed: Double, Strengh: Double
# ---------- makemove: C# ----------
    IWalk = new IBehav_MakeMove(ATol, Speed, Strengh);
# ---------- end makemove ----------
ibehavior = CSharpScript(N=int_3, Reference=["C:\USERS\SYCAR\ONEDRIVE\NET_LIBRARY\BSim.dll", "C:\Users\sycar\OneDrive\NET_Library\BSim.dll"])  # -> BE; inputs N: Int32
# ---------- ibehavior: C# usings ----------
using BSim;

using System.Windows.Forms;

using System.Linq;

//using KangarooSolver;
# ---------- ibehavior: C# ----------
    DataTree<Behavior> BEs = new DataTree<Behavior>();

    List <Behavior> Behaviors = new List<Behavior>(){
        new IBehav_NextJob(SelectTheCloset),//IBehavior_Func.RandomSelectTheLeastOccupied
        new IBehav_DoJob()//,
        //new IBehav_AvoidObs(4) //,
        //new IBehav_Wait(0.9, 2)
        };

    for(int i = 0;i < N;i++)
    {
      BEs.AddRange(Behaviors, new GH_Path(i));
    }
    BE = BEs;
# ---------- ibehavior: C# additional code ----------
  public static List<Event> SelectTheCloset(Person P, ABM ABM)
  {
    List<Event> ValidPoIs = new List<Event>();
    //Pack the untraveled interest points
    foreach (Event poi in ABM.POIs)
    {
      if (!poi.IsType(P.NextToDo)) {continue;}
      if (poi.CanBeVisit(P, ABM))
      {
        ValidPoIs.Add(poi);
      }
    }

    if (ValidPoIs.Count == 0) { return new List<Event>(); }

    //Select the least beTarget Poi
    ValidPoIs.Sort(
      (a, b) => (a.locate.DistanceTo(P.Locate) * Math.Pow((a.beTarget.Count + 1), 2)).CompareTo(b.locate.DistanceTo(P.Locate) * Math.Pow((b.beTarget.Count + 1), 2))
      );

    //Select the next Poi
    Event POI = ValidPoIs[0];
    return new List<Event>() { POI };
  }
# ---------- end ibehavior ----------
concat = Concatenate(FragmentA="Person_", FragmentB=series)
a_iperson = CSharpScript(
    ID=simplify(graft(concat)),
    Locate=simplify(graft(pt_3)),
    RSize=Slider(0.3, range=0..1),
    Strengh=Slider(2, range=0..10),
    VLength=Slider(10, range=0..10),
    VAngle=Slider(1.2, range=0..10),
    IWalk=makemove,
    Meta=simplify(graft(metabolism)),
    BE=ibehavior,
    TDL=simplify(data),
    Reference="C:\USERS\SYCAR\ONEDRIVE\NET_LIBRARY\BSim.dll")  # -> flatten(IPerson); inputs ID: String, Locate: Point3d, RSize: Double, Strengh: Double, VLength: Double, VAngle: Double, BE: list, TDL: list
# ---------- a_iperson: C# ----------
    List<Behavior> Behaves = BE.Select(p => p as Behavior).ToList();
    List<string> ToDoList = TDL.Select(p => (string) p).ToList();

    Person P = new Person(ID, Locate, RSize, Strengh, VLength, VAngle, (Behavior) IWalk, Behaves, ToDoList);
    P.Meta = (Metabolism) Meta;
    IPerson = P;
# ---------- end a_iperson ----------

# ----
# IEvents
panel = Panel(int)
pt_4 = Point(poi_locations)
占位生成器 = CSharpScript(ori_pt=pt_4, Iter=Slider(150, range=0..1000))  # -> out, A; inputs ori_pt: list of Point3d, Iter: Int32
# ---------- 占位生成器: C# ----------
    DataTree<Point3d> tree_pts = new DataTree<Point3d>();
    for(int i = 0;i < ori_pt.Count;i++)
    {
      tree_pts.AddRange(RotatePt(ori_pt[i], 200, 0.3), new GH_Path(i));
    }
      A =tree_pts;
# ---------- 占位生成器: C# additional code ----------
  private List<Point3d> RotatePt(Point3d o, int iter, double R)
  {
    List<Point3d> list = new List<Point3d>();
    int lay = 1;
    int sum = 0;
    int count = lay * 6;

    for(int i = 0;i < iter;i++)
    {
      double a = Math.PI / (count * 0.5);
      double r = 2 * R * lay;

      double b = a * (i - sum);
      list.Add(new Point3d(o.X + Math.Sin(b) * r, o.Y + Math.Cos(b) * r, o.Z));

      if(i == sum + count - 1)
      {
        lay++;
        sum += count;
        count = lay * 6;
      }
    }

    return list;
  }
# ---------- end 占位生成器 ----------
e_ievent_m_vs_as_st = CSharpScript(
    ID=simplify(graft(poi_ids)),
    Locate=simplify(graft(pt_4)),
    Category=simplify(graft(poi_mainclass)),
    SubPoints=占位生成器.A,
    TimeCons=simplify(graft(panel)),
    ActDis=Slider(0.6, range=0..1),
    Reference="C:\USERS\SYCAR\ONEDRIVE\NET_LIBRARY\BSim.dll")  # -> out, flatten(IE); inputs ID: String, Locate: Point3d, Category: String, SubPoints: list of Point3d, TimeCons: Int32, ActDis: Double
# ---------- e_ievent_m_vs_as_st: C# ----------
    IE = new IEvent_M_vS_aS_St(ID, Locate, TimeCons, ActDis, SubPoints, Category);
# ---------- end e_ievent_m_vs_as_st ----------
e_ievent_exit = CSharpScript(
    ID=enterexist_ids,
    Locate=enterexist_locations,
    ActDis=Slider(0.3, range=0..1),
    Reference="C:\USERS\SYCAR\ONEDRIVE\NET_LIBRARY\BSim.dll")  # -> out, IE; inputs ID: String, Locate: Point3d, ActDis: Double
# ---------- e_ievent_exit: C# ----------
    IE = new IEvent_Exit(ID, Locate, ActDis);
# ---------- end e_ievent_exit ----------
events = Merge(Data1=flatten(e_ievent_m_vs_as_st.IE), Data3=flatten(e_ievent_exit.IE))

# ----
# Prep-Calculation
# ISpace
even_grid = Curve([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])
# ABM Config
# {The abm model is running on a Graph
# (E,V)-based Map, ISpace indicates the Map configuration}
swatch = ColourSwatch(SwatchColor=RGB(128, 128, 128))
gm = Curve(even_grid)
# Load the *.bin file (Map)
button = Button()
displaycurves = DisPlayCurves(cvs=flatten(gm), cols=flatten(swatch), thick=flatten(Slider(3, range=0..10)))
crv = Curve(gm)
crv_2 = Curve(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)
s_ispace = CSharpScript(
    Obstacles=crv_2,
    Obs_Div=Slider(1, range=0..1),
    Path_Net=crv,
    LoadFile=button,
    Reference="C:\Users\sycar\OneDrive\NET_Library\BSim.dll")  # -> out, SP; inputs Obstacles: list of Curve, Obs_Div: Double, Path_Net: list of Line, LoadFile: Boolean
# ---------- s_ispace: C# usings ----------
using BSim;
using BSim_IO;
using System.IO;
using System.Windows.Forms;

using System.Linq;
# ---------- s_ispace: C# ----------
    if(LoadFile)
    {
      openFileDialog = new OpenFileDialog();
      openFileDialog.Filter = "Bin files (*.bin)|*.bin";
      openFileDialog.Title = "Open Path Data";
      openFileDialog.RestoreDirectory = true;

      string path = "";
      if (openFileDialog.ShowDialog() == DialogResult.OK)
      {
        path = openFileDialog.FileName;

        List<Point3d> Nodes;
        List<List<int>> Adj;
        List<List<double>> Wi;
        List<List<int>> data;
        PathNet.PathNetWork(Path_Net, tol, out Nodes, out Adj, out Wi);

        try
        {
          BSim_IO.IO.Matr2D_ReadWithBin(path, out data);
          PathNet.QuickPath QP = new PathNet.QuickPath(data, Nodes);
          Space = new ISpace(Obstacles, Obs_Div, QP, Nodes);
          Component.Message = "Loaded:\n" + openFileDialog.SafeFileName;
        }
        catch(Exception e)
        {
          Component.Message = "Error: UnMatch";
          Print(e.ToString());
        }
      }
      openFileDialog.Dispose();
    }

    SP = Space;
# ---------- s_ispace: C# additional code ----------
  ISpace Space;
  OpenFileDialog openFileDialog;
  double tol = 0.001;


  /// <summary>
  /// This method will be called once every solution, after any calls to RunScript.
  /// </summary>
  public override void AfterRunScript()
  {
    if(openFileDialog != null)openFileDialog.Dispose();
  }
# ---------- end s_ispace ----------
preprocess_gm = CSharpScript(
    Run=Button(),
    PathNet=crv,
    Reference=["C:\Program Files\Rhino 7\Plug-ins\Grasshopper\Components\KangarooSolver.dll", "C:\USERS\SYCAR\ONEDRIVE\NET_LIBRARY\BSim.dll"])  # -> out, Ns; inputs Run: Boolean, PathNet: list of Line
# ---------- preprocess_gm: C# usings ----------
using System.Linq;
using BSim;
using BSim_Network;
using BSim_IO;
using System.Diagnostics;
using System.IO;
using Path=BSim.PathNet;
using System.Windows.Forms;
using System.Threading.Tasks;
# ---------- preprocess_gm: C# ----------
    if(Run)
    {
      saveFileDialog = new SaveFileDialog();
      saveFileDialog.Filter = "bin files (*.bin)|*.bin";
      saveFileDialog.Title = "Setting Data";
      saveFileDialog.RestoreDirectory = true;

      if (saveFileDialog.ShowDialog() == DialogResult.OK)
      {
        saveFileDialog.Dispose();

        W = new MiniWatch();//Start Watch;


        Path.PathNetWork(PathNet, tol, out Nodes, out Adj, out Wi);
        BSim_Network.Prep_Dijkstra PD = new BSim_Network.Prep_Dijkstra(Adj, Wi);

        report = "";
        W.Record("Initialize");
        //Load the Environment;

        data = PD.Prep();

        W.Record("Dijkstra");

        BSim_IO.IO.Matr2D_ExportToBin(saveFileDialog.FileName, data);

        W.Record("Export_Bin");
        report = W.GetTime();

        saveFileDialog.Dispose();
      }

    }
    Component.Message = report;
    Ns = Nodes;
# ---------- preprocess_gm: C# additional code ----------
  double tol = 0.001;
  MiniWatch W;
  List<List<int>> data;
  List<Point3d> Nodes;
  SaveFileDialog saveFileDialog;
  List<List<int>> Adj;
  List<List<double>> Wi;
  string report = "";
# ---------- end preprocess_gm ----------

# ----
# IComunication
c_icommunicate = CSharpScript(Reference="C:\USERS\SYCAR\ONEDRIVE\NET_LIBRARY\BSim.dll")  # -> C
# ---------- c_icommunicate: C# ----------
    List<Communicate> PP_Commun = new List<Communicate>()
      {
        new ICom_Avoid(1.05, 2),
        //new ICom_Talk(0.5, 30, 10, 2)
      };

    C = PP_Commun;
# ---------- end c_icommunicate ----------

# ----
# ABM
# Model
abm_model = CSharpScript(
    S=flatten(s_ispace.SP),
    A=flatten(a_iperson),
    C=flatten(c_icommunicate),
    E=flatten(events),
    Reference="C:\USERS\SYCAR\ONEDRIVE\NET_LIBRARY\BSim.dll")  # -> Model; inputs S: list, A: list, C: list, E: list
# ---------- abm_model: C# ----------
    List<ISpace> ISpaces = S.Select(p => (ISpace) p).ToList();
    List<Person> Persons = A.Select(p => (Person) p).ToList();
    List<Communicate> Communis = C.Select(p => (Communicate) p).ToList();
    List<Event> Events = E.Select(p => (Event) p).ToList();

    ABM AgentBasedModel = new ABM(ISpaces[0], Events, Persons, Communis);

    Model = AgentBasedModel;
# ---------- end abm_model ----------

# ----
# Simulation
button_2 = Button()
trigger = Trigger(Interval=10, TimerInterval=10, Target=simulation)  # disabled
# Simulator
# delta T:
# Walk speed: 1.5m/s
# Real world time: 1s
data_2 = Data(abm_model)
simulation = CSharpScript(Model=data_2, reset=button_2, run=Toggle(True), Reference="C:\Users\sycar\OneDrive\NET_Library\BSim.dll")  # -> out, M; inputs reset: Boolean, run: Boolean
# ---------- simulation: C# usings ----------
using BSim;

using System.Windows.Forms;

using System.Linq;

using System.Threading;
using System.Threading.Tasks;

using System.IO;
using System.Runtime.Serialization;
using System.Runtime.Serialization.Formatters.Binary;
# ---------- simulation: C# ----------
    int MaxIter = 20000;
    Run = run;
    Reset = reset;
    string timeRep = "";

    if (Reset)
    {
      ABM_simu = (ABM) Model;
      agentCount = ABM_simu.PPs_Wait.Count;
    }
    else if(Run)
    {
      if(ABM_simu != null && ABM_simu.PS.iteration < MaxIter && ABM_simu.PPs_Sink.Count<agentCount)
      {
        try{
          Print(ABM_simu.Simulate(Reset, out timeRep));
        }
        catch (Exception e)
        {
          Print(e.ToString());
        }
      }
    }

    if(ABM_simu != null){Print(ABM_simu.PS.iteration.ToString());}

    Component.Message = timeRep;
    M = ABM_simu;
# ---------- simulation: C# additional code ----------
  ABM ABM_simu;
  bool Reset = false;
  bool Run = false;
  int agentCount = -1;
# ---------- end simulation ----------

panel_2 = Panel(simulation.out)
showminitarget = CSharpScript(M=simulation.M, Reference="C:\USERS\SYCAR\ONEDRIVE\NET_LIBRARY\BSim.dll")  # -> out, Views, Detect, Cur_Pts, Abm_Count
# ---------- showminitarget: C# usings ----------
using System.Linq;
using BSim;

using System.Diagnostics;
using System.Windows.Forms;
# ---------- showminitarget: C# ----------
    List<Line> PointTo = new List<Line>();
    List<Point3d> TPts = new List<Point3d>();
    List<Line> PlCv = new List<Line>();
    List<Line> ViewLn = new List<Line>();
    DataTree<Point3d> Paths = new DataTree<Point3d>();

    ABM ABM = M as ABM;
    int k = 0;
    
    foreach(Person doc in ABM.PPs)
    {
      TPts.Add(doc.Locate);
      k++;
    }

    Component.Message = "agents: " + ABM.PPs.Count.ToString() + "\n Generated: " + ABM.Document.Count.ToString();
    Print(ABM.debug);
    Views = ViewLn;
    Detect = PointTo;
    Cur_Pts = TPts;
    Abm_Count = ABM.PPs.Count;
# ---------- showminitarget: C# additional code ----------
  public Line Viewline(Person P)
  {
    Line ln = new Line(P.Locate, P.Locate);
    if(P.Path.Count > 0)
    {
      ln = new Line(P.Locate, P.Path[P.step]);
    }

    return ln;
  }

  public List<Line> WayPath(List<Point3d>P)
  {
    List<Line> ln = new List<Line>();
    if(P.Count > 1)
    {
      for(int i = 0;i < P.Count - 1;i++)
      {ln.Add(new Line(P[i], P[i + 1]));}
    }

    return ln;
  }

  public Point3d TargetPt(Person P)
  {
    if(P.Path.Count > 0)
    {
      return P.Path[P.Path.Count - 1];
    }
    else
    {
      return P.Locate;
    }
  }
# ---------- end showminitarget ----------
swatch_2 = ColourSwatch(SwatchColor=RGB(235, 5, 5))  # disabled
dots = DotDisplay(Point=showminitarget.Cur_Pts, Colour=swatch_2, Size=5)  # disabled

# ----
# Document
button_3 = Button()
read_person_doc = CSharpScript(
    Run=button_3,
    Reference=["C:\Program Files\Rhino 7\Plug-ins\Grasshopper\Components\KangarooSolver.dll", "C:\USERS\SYCAR\ONEDRIVE\NET_LIBRARY\BSim.dll"])  # -> Doc; inputs Run: Boolean
# ---------- read_person_doc: C# usings ----------
using System.Linq;
using BSim;
using BSim_IO;
using System.Diagnostics;
using System.IO;
using Path=BSim.PathNet;
using System.Windows.Forms;
# ---------- read_person_doc: C# ----------
    if(Run)
    {
      OpenFileDialog openFileDialog = new OpenFileDialog();
      openFileDialog.Filter = "Bin files (*.bin)|*.bin";
      openFileDialog.Title = "Open Result Data";
      openFileDialog.RestoreDirectory = true;

      if (openFileDialog.ShowDialog() == DialogResult.OK)
      {
        BSim_IO.IO.Doc_ReadWithBin(openFileDialog.FileName, out Docs);
        Component.Message = "Loaded:\n" + openFileDialog.SafeFileName;
        openFileDialog.Dispose();
      }
    }

    Doc = Docs;
# ---------- read_person_doc: C# additional code ----------
  List<Person_Doc>Docs;
# ---------- end read_person_doc ----------
write_person_doc = CSharpScript(
    M=simulation.M,
    Run=Button(),
    Reference=["C:\Program Files\Rhino 7\Plug-ins\Grasshopper\Components\KangarooSolver.dll", "C:\USERS\SYCAR\ONEDRIVE\NET_LIBRARY\BSim.dll"])  # -> Doc; inputs Run: Boolean
# ---------- write_person_doc: C# ----------
    if(Run)
    {
      SaveFileDialog saveFileDialog = new SaveFileDialog();
      saveFileDialog.Filter = "Bin files (*.bin)|*.bin";
      saveFileDialog.Title = "Simulated Data";
      saveFileDialog.RestoreDirectory = true;

      if (saveFileDialog.ShowDialog() == DialogResult.OK)
      {
        ABM ABM = (ABM) M;
        BSim_IO.IO.Doc_ExportToBin(saveFileDialog.FileName, ABM.Document);
      }
    }
# ---------- end write_person_doc ----------

the_agents_in_certain_iter = CSharpScript(D=read_person_doc, I=int_2, n=Slider(2058, range=0..20000), Reference="C:\USERS\SYCAR\ONEDRIVE\NET_LIBRARY\BSim.dll")  # -> out, Views, Detect, Cur_Pts, Abm_Count; inputs D: list, I: list of Int32, n: Int32; disabled
# ---------- the_agents_in_certain_iter: C# ----------
    int Get_iter = n;

    List<Point3d> TPts = new List<Point3d>();

    //List<Person_Doc> Docs = M as List<Person_Doc>;

    foreach(Person_Doc doc in D)
    {
      string id = doc.id;
      int index = System.Convert.ToInt32(id.Split('_')[1]);

      int meta_iter = I[index];
      if(meta_iter < Get_iter)
      {
        int k = Get_iter - meta_iter;
        if(k < doc.trajectory.Count)
        {TPts.Add(doc.trajectory[Get_iter - meta_iter]);}
      }
    }

    Cur_Pts = TPts;
# ---------- end the_agents_in_certain_iter ----------
swatch_3 = ColourSwatch(SwatchColor=RGB(21, 0, 255))  # disabled
dots_2 = DotDisplay(Point=the_agents_in_certain_iter.Cur_Pts, Colour=swatch_3, Size=5)  # disabled
preview = CustomPreview(Geometry=the_agents_in_certain_iter.Cur_Pts, Material=swatch_3)  # disabled

# ==== cluster DisPlayCurves
cvs = ClusterInput()
thick = ClusterInput()
cols = ClusterInput()
c_script = CSharpScript(cvs=cvs, cols=cols, thick=thick)  # inputs cvs: list of Curve, cols: list of Color, thick: list of Double
# ---------- c_script: C# usings ----------
using System.IO;
using System.Linq;
using System.Data;
using System.Drawing;
using System.Reflection;
using System.Windows.Forms;
using System.Xml;

using System.Runtime.InteropServices;

using Rhino.DocObjects;
using Rhino.Collections;
using GH_IO;
using GH_IO.Serialization;
# ---------- c_script: C# ----------
    dis_cvs.Clear();
    dis_cols.Clear();
    dis_th.Clear();
    List<int> valid = Enumerable.Range(0, cvs.Count).Where(i => cvs[i].IsValid).ToList();

    if(cvs == null){return;}
    dis_cvs = valid.Select(i => cvs[i]).ToList();
    if(cols.Count == 1){      dis_cols = valid.Select(p => cols[0]).ToList();}
    else if(cols.Count == 0){      dis_cols = valid.Select(p => Color.Black).ToList();}
    else{dis_cols = valid.Select(i => cols[i]).ToList();}

    if(thick.Count == 1) {dis_th = valid.Select(p => thick[0]).ToList();}
    else if(thick.Count == 0){dis_th = valid.Select(p => 1.0).ToList();}
    else{dis_th = valid.Select(i => thick[i]).ToList();}
# ---------- c_script: C# additional code ----------
  private List<Curve> dis_cvs = new List<Curve>();
  private List<Color> dis_cols = new List<Color>();
  private List<double> dis_th = new List<double>();

  public override void BeforeRunScript()
  {
    dis_cvs.Clear();
    dis_cols.Clear();
    dis_th.Clear();
  }

  public override BoundingBox ClippingBox
  {
    get
    {
      return BoundingBox.Empty;
    }
  }

  public override void DrawViewportWires(IGH_PreviewArgs args)
  {
    Plane pl0_Plane;
    args.Viewport.GetFrustumFarPlane(out pl0_Plane);

    Rhino.Display.Text3d drawText = null;  // Initialize to null

    for (int i = 0; i < dis_cvs.Count; i++)
    {
      Curve cv = dis_cvs[i];
      Color col = dis_cols[i];
      double th = dis_th[i];

      pl0_Plane.Origin = cv.PointAt(0.5 * cv.Domain.Length);

      args.Display.DrawCurve(cv, col, System.Convert.ToInt32(th));

      // Create a new Text3d object
      //drawText = new Rhino.Display.Text3d(txt, pl0_Plane, txt_size);
      //args.Display.Draw3dText(drawText, col);
    }

    // Dispose of the last Text3d object
    if (drawText != null)
    {
      drawText.Dispose();
    }
  }
# ---------- end c_script ----------
